# Grasshopper definition Force_displacement.gh (Grasshopper 1.0.7)

geometry = Geometry(<curve referenced from the Rhino model>)
explode = Explode(Curve=geometry, Recursive=True)  # -> Segments, Vertices
ghpython_script = GhPythonScript(points=explode.Vertices)  # -> out, output, displacement; inputs points: list of Point3d
# ---------- ghpython_script: Python ----------
__author__ = "Flora"
__version__ = "2021.06.30"

import math
import rhinoscriptsyntax as rs

def CalcDistance(p1, p2):
    """
    Function to calculate distance in space between two points (p)
    p1, p2: (f) lists of coordinates for point1 and point2
    """
    #print (p2)
    dist = math.sqrt((p2[0]-p1[0])**2 + (p2[1]-p1[1])**2 + (p2[2]-p2[2])**2)
    #print (dist)
    return(dist)


def LennardJones (e, s, p1, p2):
    """
    Archetype model for simple yet realistic intermolecular interactions
    e: dispersion energy
    s: distance at which the particle-particle potential energy V is zero 
    (size of the particle) TODO: add list of molecules //usual s = 0.34nm
    p1,p2: centroid coordinates of two molecules
    
    V: potential energy
    """
    r = CalcDistance(p1,p2)
    V = 4*e*((s/r)**12 - (s/r)**6)
    return V
    



def CalculateNewPositions () :
    for i in range (1, len(points)-1):
        V1=LennardJones(-1,100,points[i],points[i-1])
        V2=LennardJones(-1,100,points[i],points[i+1])
        print (V1)
        Vector1=rs.Rhino.Geometry.Vector3d(points[i-1].X-points[i].X,points[i-1].Y-points[i].Y,points[i-1].Z-points[i].Z)
        Vector1.Unitize()*V1
        Vector2=rs.Rhino.Geometry.Vector3d(points[i+1].X-points[i].X,points[i-1].Y-points[i].Y,points[i+1].Z-points[i].Z)
        Vector2.Unitize()*V2
        
        displacement[i] = rs.Rhino.Geometry.Vector3d.Add(Vector1,Vector2)*10
        print(displacement[i])
        
        
        points[i] = rs.Rhino.Geometry.Point3d.Add(points[i],displacement[i])


displacement=[]
for i in points:
    displacement.append(rs.Rhino.Geometry.Vector3d(0,0,0))

CalculateNewPositions ()

output=points
# ---------- end ghpython_script ----------
point = Point(ghpython_script.output)
vector_display_ex = VectorDisplayEx(Point=explode.Vertices, Vector=ghpython_script.displacement, Colour=RGB(0, 0, 0), Width=2)
