# Grasshopper definition Force_displacement_Fixed.gh (Grasshopper 1.0.7)

geometry = Geometry(<curve referenced from the Rhino model>)
explode = Explode(Curve=geometry, Recursive=True)  # -> Segments, Vertices

# ---- group: LennardJones
lennardjonesforce = GhPythonScript(points=explode.Vertices)  # -> output, displacement; inputs points: list of Point3d; disabled
# ---------- lennardjonesforce: Python ----------
"""Provides a scripting component.
    Inputs:
        x: The x script variable
        y: The y script variable
    Output:
        a: The a output variable"""

__author__ = "Flora"
__version__ = "2021.06.30"

import math
import rhinoscriptsyntax as rs

def CalcDistance(p1, p2):
    """
    Function to calculate distance in space between two points (p)
    p1, p2: (f) lists of coordinates for point1 and point2
    """
    #print (p2)
    dist = math.sqrt((p2[0]-p1[0])**2 + (p2[1]-p1[1])**2 + (p2[2]-p2[2])**2)
    #print (dist)
    return(dist)


def LennardJones (e, s, p1, p2):
    """
    Archetype model for simple yet realistic intermolecular interactions
    e: dispersion energy
    s: distance at which the particle-particle potential energy V is zero 
    (size of the particle) TODO: add list of molecules //usual s = 0.34nm
    p1,p2: centroid coordinates of two molecules
    
    V: potential energy
    """
    r = CalcDistance(p1,p2)
    V = 4*e*((s/r)**12 - (s/r)**6)
    return V
    

def SpringHookLaw(p1, p2):
    ##k = constant factor characteristic of the spring (i.e., its stiffness)
    k= 0.5
    return k*CalcDistance(p1,p2)

def CalculateNewPositions () :
    for i in range (1, len(points)-1):
        V1=LennardJones(-1,100,points[i],points[i-1])
        V2=LennardJones(-1,100,points[i],points[i+1])
        print ("asdf:" + str(V1)+ str(V2))
        Vector1=rs.Rhino.Geometry.Vector3d(points[i-1].X-points[i].X,points[i-1].Y-points[i].Y,points[i-1].Z-points[i].Z)
        Vector1.Unitize()
        Vector2=rs.Rhino.Geometry.Vector3d(points[i+1].X-points[i].X,points[i+1].Y-points[i].Y,points[i+1].Z-points[i].Z)
        Vector2.Unitize()
        
        displacement[i] = rs.Rhino.Geometry.Vector3d.Add(Vector1*V1,Vector2*V2)
        print(displacement[i])
        
        
        newPoints[i] = rs.Rhino.Geometry.Point3d.Add(points[i],displacement[i])

newPoints=[]
displacement=[]
for i in points:
    displacement.append(rs.Rhino.Geometry.Vector3d(0,0,0))
    newPoints.append(i)

CalculateNewPositions ()

print(len(newPoints))
output=newPoints
# ---------- end lennardjonesforce ----------
point = Point(lennardjonesforce.output)  # disabled
vector_display_ex = VectorDisplayEx(Point=explode.Vertices, Vector=lennardjonesforce.displacement, Colour=RGB(0, 0, 0), Width=2)  # disabled

# ---- group: HookeLaw
spring_force = GhPythonScript(points=explode.Vertices)  # -> output, displacement; inputs points: list of Point3d
# ---------- spring_force: Python ----------
__author__ = "Flora"
__version__ = "2021.06.30"

import math
import rhinoscriptsyntax as rs

def CalcDistance(p1, p2):
    """
    Function to calculate distance in space between two points (p)
    p1, p2: (f) lists of coordinates for point1 and point2
    """
    #print (p2)
    dist = math.sqrt((p2[0]-p1[0])**2 + (p2[1]-p1[1])**2 + (p2[2]-p2[2])**2)
    #print (dist)
    return(dist)


def LennardJones (e, s, p1, p2):
    """
    Archetype model for simple yet realistic intermolecular interactions
    e: dispersion energy
    s: distance at which the particle-particle potential energy V is zero 
    (size of the particle) TODO: add list of molecules //usual s = 0.34nm
    p1,p2: centroid coordinates of two molecules
    
    V: potential energy
    """
    r = CalcDistance(p1,p2)
    V = 4*e*((s/r)**12 - (s/r)**6)
    return V
    

def SpringHookLaw(p1, p2):
    ##k = constant factor characteristic of the spring (i.e., its stiffness)
    k= 0.5
    return k*CalcDistance(p1,p2)

def CalculateNewPositions () :
    for i in range (1, len(points)-1):
        V1=SpringHookLaw(points[i],points[i-1])
        V2=SpringHookLaw(points[i],points[i+1])
        print ("asdf:" + str(V1)+ str(V2))
        Vector1=rs.Rhino.Geometry.Vector3d(points[i-1].X-points[i].X,points[i-1].Y-points[i].Y,points[i-1].Z-points[i].Z)
        Vector1.Unitize()
        Vector2=rs.Rhino.Geometry.Vector3d(points[i+1].X-points[i].X,points[i+1].Y-points[i].Y,points[i+1].Z-points[i].Z)
        Vector2.Unitize()
        
        displacement[i] = rs.Rhino.Geometry.Vector3d.Add(Vector1*V1,Vector2*V2)
        print(displacement[i])
        
        
        newPoints[i] = rs.Rhino.Geometry.Point3d.Add(points[i],displacement[i])

newPoints=[]
displacement=[]
for i in points:
    displacement.append(rs.Rhino.Geometry.Vector3d(0,0,0))
    newPoints.append(i)

CalculateNewPositions ()

print(len(newPoints))
output=newPoints
# ---------- end spring_force ----------
point_2 = Point(spring_force.output)
vector_display_ex_2 = VectorDisplayEx(Point=explode.Vertices, Vector=spring_force.displacement, Colour=RGB(0, 0, 0), Width=2)
