# Grasshopper definition Force_displacement_pdb.gh (Grasshopper 1.0.7)

input_pdb_path = Panel("C:\Users\Flora\OneDrive - The Alan Turing Institute\Turing\1.Projects\3.Protein_folding\1.Data\GlyP_AMP.pdb")
pdb_reader = PDB_Reader(pdb_path=input_pdb_path)  # -> aa_id_2, aa_name_2, atom_order_3, xyz_point, atoms_name_2
geometry = Geometry(<curve referenced from the Rhino model>)
explode = Explode(Curve=geometry, Recursive=True)  # -> Segments, Vertices
aa_range = Domain("180:183")
filter_aa_properties = GhPythonScript(
    AA_id=pdb_reader.aa_id_2,
    AA_name=pdb_reader.aa_name_2,
    atoms_xyz=pdb_reader.xyz_point,
    atoms_name=pdb_reader.atoms_name_2,
    mask=aa_range)  # -> out, AA_name_list, AA_ID_list, atoms_name_list, atoms_xyz_list; inputs AA_id: list of Int32, AA_name: list, atoms_xyz: list, atoms_name: list
#   port AA_id: Amino Acid names
# ---------- filter_aa_properties: Python ----------
__author__ = "Flora"
__version__ = "2020.10.28"

"""
This module reads PDB output lists and creates double lists of AA coordinates and 
properties per AA atom, masked by a domain, ready to be converted to trees.
eg. [['75.814,-34.543,47.16', '74.639,-34.529,48.079'...],[...]]
    Inputs:
        AA_id: Amino Acid id number (int list)
        AA_name: Amino Acid name (string list)
        atoms_xyz: coordinates in 3Dspace per atom (3d point rhino item)
        atoms_name: atom names (string list)
    Output:
        atoms_xyz_list/name: list of coordinates/names of all atoms per AA
        AA_name_list: list of unique AA names in order per AA 
"""

import rhinoscriptsyntax as rs


#TODO: seperate per protein ("TER") 

def ListAANames(AA_id, AA_name):
    """
    Creates a list of unique AA names
    AA_id: [] index of AA per atom
    AA_name: [] name of AA per atom
    
    AA_name_list: [] of uniqe AA names
    """
    counter=-1
    AA_name_list=[]
    for i in range (len(AA_id)):
        if AA_id[i]!=counter: #a new aminoacid
            AA_name_list.append(AA_name[i]) #stores name per chain of AA
            counter=AA_id[i]
    return (AA_name_list)


def ListAtomsperAA(AA_id, atoms_list):
    """
    Groups atoms in lists per AA 
    AA_id: [] index of AA per atom
    atoms_list: [] single list of atoms 
    
    list: [] grouped values in lists per AA
    """
    counter=-1
    list, sublist =[],[]

    for i in range (len(AA_id)):
        if AA_id[i]!=counter: #a new aminoacid
            if sublist != []:
                list.append(sublist) #store list of atoms per AA
            sublist=[]
            sublist.append(atoms_list[i])
            counter=AA_id[i]

        else: # existing aminoacid
            sublist.append(atoms_list[i])

    list.append(sublist)  #stores list of atoms of final AA
    return (list)


def Mask(mask, list):
    """
    Creates a sublist per domain  
    mask: gh domain (10:100)
    list: [] any list 
    
    list_masked: [] output sublist
    """
    list_masked = list [int(mask[0]):int(mask[1])]
    return (list_masked)


if __name__ == "__main__": 
    if (mask!= None) :
        AA_name_list= Mask(mask, ListAANames(AA_id, AA_name))
        AA_ID_list=Mask(mask, ListAANames(AA_id, AA_id))
        atoms_xyz_list=Mask(mask,ListAtomsperAA(AA_id, atoms_xyz))
        atoms_name_list=Mask(mask,ListAtomsperAA(AA_id, atoms_name))
        
    else: 
        AA_name_list= ListAANames(AA_id, AA_name)
        atoms_xyz_list=ListAtomsperAA(AA_id, atoms_xyz)
        atoms_name_list=ListAtomsperAA(AA_id, atoms_name)
# ---------- end filter_aa_properties ----------
ghpython_script = GhPythonScript(points=explode.Vertices)  # -> out, output, displacement; inputs points: list of Point3d
# ---------- ghpython_script: Python ----------
__author__ = "Flora"
__version__ = "2021.06.30"

import math
import rhinoscriptsyntax as rs

def CalcDistance(p1, p2):
    """
    Function to calculate distance in space between two points (p)
    p1, p2: (f) lists of coordinates for point1 and point2
    """
    #print (p2)
    dist = math.sqrt((p2[0]-p1[0])**2 + (p2[1]-p1[1])**2 + (p2[2]-p2[2])**2)
    #print (dist)
    return(dist)


def LennardJones (e, s, p1, p2):
    """
    Archetype model for simple yet realistic intermolecular interactions
    e: dispersion energy
    s: distance at which the particle-particle potential energy V is zero 
    (size of the particle) TODO: add list of molecules //usual s = 0.34nm
    p1,p2: centroid coordinates of two molecules
    
    V: potential energy
    """
    r = CalcDistance(p1,p2)
    V = 4*e*((s/r)**12 - (s/r)**6)
    return V
    



def CalculateNewPositions () :
    for i in range (1, len(points)-1):
        V1=LennardJones(-1,100,points[i],points[i-1])
        V2=LennardJones(-1,100,points[i],points[i+1])
        print (V1)
        Vector1=rs.Rhino.Geometry.Vector3d(points[i-1].X-points[i].X,points[i-1].Y-points[i].Y,points[i-1].Z-points[i].Z)
        Vector1.Unitize()*V1
        Vector2=rs.Rhino.Geometry.Vector3d(points[i+1].X-points[i].X,points[i-1].Y-points[i].Y,points[i+1].Z-points[i].Z)
        Vector2.Unitize()*V2
        
        displacement[i] = rs.Rhino.Geometry.Vector3d.Add(Vector1,Vector2)*10
        print(displacement[i])
        
        
        points[i] = rs.Rhino.Geometry.Point3d.Add(points[i],displacement[i])


displacement=[]
for i in points:
    displacement.append(rs.Rhino.Geometry.Vector3d(0,0,0))

CalculateNewPositions ()

output=points
# ---------- end ghpython_script ----------
point = Point(ghpython_script.output)
sidechains = GhPythonScript(
    AA_name_list=filter_aa_properties.AA_name_list,
    atoms_name_list=filter_aa_properties.atoms_name_list,
    atoms_xyz_list=filter_aa_properties.atoms_xyz_list)  # -> out, AA_name, start, end, atom_names, atom_xyz; inputs AA_name_list: list, atoms_name_list: list, atoms_xyz_list: list
# ---------- sidechains: Python ----------
__author__ = "Flora"
__version__ = "2020.10.28"

"""
Provides a scripting component.
    Inputs:
        AA: Amino Acid id number (int list)
        AA_name: Amino Acid name (string list)
        xyz: coordinates in 3Dspace per atom (3d point rhino item)
        atoms: atom names (string list)
    Output:
        a: xyz coordinates for debug
        start: list of coordinates of all atoms per AA (for starting points of lines) 
        end: list of coordinates of all atoms per AA (for ending poins of lines)
"""


import rhinoscriptsyntax as rs


sidechains_dict = {
"GLN":{"A": ["C","C","CA","CA","CB","CG","CD","CD"],
    "B":["O","CA","N","CB","CG","CD","NE2","OE1"]},
"GLU":{"A": ["C","C","CA","CA","CB","CG","CD","CD"],
    "B":["O","CA","N","CB","CG","CD","OE2","OE1"]},
"LYS":{"A": ["C","C","CA","CA","CB","CG","CD","CE"],
    "B": ["O","CA","N","CB","CG","CD","CE","NZ"]},
"ARG":{"A":["C","C","CA","CA","CB","CG","CD","NE","CZ","CZ"],
    "B": ["O","CA","N","CB","CG","CD","NE","CZ","NH1","NH2"]},
"ILE":{"A": ["C","C","CA","CA","CB","CB","CG1"],
    "B": ["O","CA","N","CB","CG1","CG2","CD1"]},
"SER":{"A": ["C","C","CA","CA","CB"],
    "B": ["O","CA","N","CB","OG"]},
"VAL":{"A": ["C","C","CA","CA","CB","CB"],
    "B": ["O","CA","N","CB","CG2","CG1"]},
"HIS": {"A": ["C","C","CA","CA","CB","CG","CG","CD2","CE1","ND1"], 
    "B": ["O","CA","N","CB","CG","ND1","CD2","NE2","NE2","CE1"]},
"GLY":{"A":["C","C","CA"],
    "B": ["O","CA","N"]},
"LEU":{"A": ["C","C","CA","CA","CB","CG","CG"],
    "B": ["O","CA","N","CB","CG","CD1","CD2"]},
"ALA":{"A": ["C","C","CA","CA"],
    "B": ["O","CA","N","CB"]},
"ASN":{"A": ["C","C","CA","CA","CB","CG","CG"],
    "B": ["O","CA","N","CB","CG","OD1","ND2"]},
"THR":{"A": ["C","C","CA","CA","CB","CB"],
    "B": ["O","CA","N","CB","CG2","OG1"]},
"PRO":{"A": ["C","C","CA","CA","CB","CG","CD"],
    "B": ["O","CA","N","CB","CG","CD","N"]},
"ASP":{"A":["C","C","CA","CA","CB","CG","CG"],
    "B": ["O","CA","N","CB","CG","OD1","OD2"]},
"TYR":{"A": ["C","C","CA","CA","CB","CG","CG","CD1","CD2","CE1","CE2","CZ"],
    "B": ["O","CA","N","CB","CG","CD1","CD2","CE1","CE2","CZ","CZ","OH"]},
"PHE":{"A": ["C","C","CA","CA","CB","CG","CG","CD1","CD2","CE1","CE2"],
    "B": ["O","CA","N","CB","CG","CD1","CD2","CE1","CE2","CZ","CZ"]},
"TRP":{"A": ["C","C","CA","CA","CB","CG","CG","CD1","CD2","NE1","CD2","CE2","CE3","CZ3","CH2"], 
    "B": ["O","CA","N","CB","CG","CD2","CD1","NE1","CE2","CE2","CE3","CZ2","CZ3","CH2","CZ2"]},
}


AA_sublist=[]
amino_start =[]
amino_end=[]

atom_names=[]
atom_xyz=[]

def construct_sidechains_points():
    None  #TODO

def construct_sidechains(AA_name_list,atoms_name_list,atoms_xyz_list):

    for i in range (len(AA_name_list)): 
        amino_acid = sidechains_dict.get(AA_name_list[i])
        
        if(amino_acid != None): #if the amino acid exists in the pdb 
            AA_sublist.append(AA_name_list[i])
            
            A = amino_acid.get('A') #get the list of the first points of the AA
            B = amino_acid.get('B') #get the list of the second points of the AA
            atom_list = atoms_name_list[i]
            xyz_list = atoms_xyz_list[i]
            

            #fix beggining and end for lines
            start, end= sidechain(amino_acid,A,B,atom_list,xyz_list)
             
            amino_start.append(start)
            amino_end.append(end)
            
            atom_names.append(atom_list)
            atom_xyz.append(xyz_list)

        else: error = "Amino Acid doesnt exist"

def sidechain(amino_acid,A,B,atom_list,xyz_list):
    start, end=[],[]
    for x in range (len(A)):
        for y in range (len(atom_list)):  
            if (A[x]==atom_list[y]):
                start.append(xyz_list[y])
            if (B[x]==atom_list[y]):
                end.append(xyz_list[y])
    return (start,end)


#Created By piac
#from https://gist.github.com/piac/ef91ac83cb5ee92a1294
def list_to_tree(input, none_and_holes=True, source=[0]):
    """Transforms nestings of lists or tuples to a Grasshopper DataTree"""
    from Grasshopper import DataTree as Tree
    from Grasshopper.Kernel.Data import GH_Path as Path
    from System import Array
    def proc(input,tree,track):
        path = Path(Array[int](track))
        if len(input) == 0 and none_and_holes: tree.EnsurePath(path); return
        for i,item in enumerate(input):
            if hasattr(item, '__iter__'): #if list or tuple
                track.append(i); proc(item,tree,track); track.pop()
            else:
                if none_and_holes: tree.Insert(item,path,i)
                elif item is not None: tree.Add(item,path)
    if input is not None: t=Tree[object]();proc(input,t,source[:]);return t


#sidechain(atoms_xyz_list, amino_names, atoms_name_list)
construct_sidechains(AA_name_list,atoms_name_list,atoms_xyz_list)

atom_names=list_to_tree(atom_names)
atom_xyz=list_to_tree(atom_xyz)
AA_name=list_to_tree(AA_sublist)
start= list_to_tree(amino_start)
end=list_to_tree(amino_end)


#print (atoms_xyz_list)
# ---------- end sidechains ----------
vector_display_ex = VectorDisplayEx(Point=explode.Vertices, Vector=ghpython_script.displacement, Colour=RGB(0, 0, 0), Width=2)
find_aa_index = GhPythonScript(input=sidechains.atom_names, search="CA")  # -> output; inputs input: list
# ---------- find_aa_index: Python ----------
__author__ = "Flora"
__version__ = "2020.10.27"

import rhinoscriptsyntax as rs

output=[]

for i in range(len(input)):
    if input[i] == search: #.find(search)!=-1:
        #print (input[i])
        output.append(i)
# ---------- end find_aa_index ----------
list_item = ListItem(List=sidechains.atom_xyz, Index=find_aa_index, Wrap=True)  # -> flatten(Item)
ghpython_script_2 = GhPythonScript(points=list_item, e=Slider(6, range=-2..10), s=Slider(3.8, range=0..10))  # -> out, output, displacement; inputs points: list of Point3d
# ---------- ghpython_script_2: Python ----------
__author__ = "Flora"
__version__ = "2021.06.30"

import math
import rhinoscriptsyntax as rs

def CalcDistance(p1, p2):
    """
    Function to calculate distance in space between two points (p)
    p1, p2: (f) lists of coordinates for point1 and point2
    """
    #print (p2)
    print (p1, p2)
    dist = math.sqrt((p2[0]-p1[0])**2 + (p2[1]-p1[1])**2 + (p2[2]-p1[2])**2)
    print (dist)
    return(dist)


def LennardJones (e, s, p1, p2):
    """
    Archetype model for simple yet realistic intermolecular interactions
    e: dispersion energy
    s: distance at which the particle-particle potential energy V is zero 
    (size of the particle) TODO: add list of molecules //usual s = 0.34nm
    p1,p2: centroid coordinates of two molecules
    
    V: potential energy
    """
    r = CalcDistance(p1,p2)
    V = 4*e*((s/r)**12 - (s/r)**6)
    #print V
    #print (V,r)

    return V
    



def CalculateNewPositions () :
    for i in range (1, len(points)-1):
        V1=LennardJones(e,s,points[i],points[i-1])
        V2=LennardJones(e,s,points[i],points[i+1])
        #print (V1)
        Vector1=rs.Rhino.Geometry.Vector3d(points[i-1].X-points[i].X,points[i-1].Y-points[i].Y,points[i-1].Z-points[i].Z)
        Vector1.Unitize()*V1
        #print (Vector1.Unitize()*V1)
        Vector2=rs.Rhino.Geometry.Vector3d(points[i+1].X-points[i].X,points[i-1].Y-points[i].Y,points[i+1].Z-points[i].Z)
        Vector2.Unitize()*V2
        
        displacement[i] = rs.Rhino.Geometry.Vector3d.Add(Vector1,Vector2)
        #print(displacement[i])
        
        points[i] = rs.Rhino.Geometry.Point3d.Add(points[i],displacement[i])
print ()

displacement=[]
for i in points:
    displacement.append(rs.Rhino.Geometry.Vector3d(0,0,0))

CalculateNewPositions ()

output=points
# ---------- end ghpython_script_2 ----------
point_2 = Point(list_item)
point_3 = Point(ghpython_script_2.output)
cloud_display = CloudDisplay(Points=list_item, Colours=ColourSwatch(SwatchColor=RGB(82, 209, 92)), Size=0.8, SpriteType=0)
vector_display_ex_2 = VectorDisplayEx(Point=list_item, Vector=ghpython_script_2.displacement, Colour=RGB(0, 0, 0), Width=2)

# ==== cluster PDB_Reader
pdb_path = ClusterInput()

# ---- group: PDB Reader
# Component to read a PDB file
# and output each item seperately
pdb_path_2 = FilePath(pdb_path)
read_file_universal = GhPythonScript(path=pdb_path_2)  # -> out, contents
# ---------- read_file_universal: Python ----------
"""An alternative to "read file" gh component, for Mac.
    Inputs:
        path: path of file
    Output:
        contents: output file in txt"""

__author__ = "Flora"
__version__ = "2021.04.13"

import rhinoscriptsyntax as rs
contents = []

try:
    with open(path, 'r') as fp:
        #contents = fp.read()
        for cnt, line in enumerate(fp):
            contents.append(line)
except:
    e = gh.GH_RuntimeMessageLevel.Warning
    ghenv.Component.AddRuntimeMessage(e, "Grasshopper cannot read lines in file: try 'read file component'")

fp.close()
# ---------- end read_file_universal ----------
filter_dbd = GhPythonScript(PDB=read_file_universal.contents)  # -> P, TER
# ---------- filter_dbd: Python ----------
"""Script to clean PDB files.
    Inputs:
        x: The x script variable
        y: The y script variable
    Output:
        a: The a P variable"""

__author__ = "Flora"
__version__ = "2020.10.23"

import rhinoscriptsyntax as rs

PDB = PDB.replace("            ",",")
PDB = PDB.replace("           ",",")
PDB = PDB.replace("          ",",")
PDB = PDB.replace("         ",",")
PDB = PDB.replace("        ",",")
PDB = PDB.replace("       ",",")
PDB = PDB.replace("      ",",")
PDB = PDB.replace("     ",",")
PDB = PDB.replace("    ",",")
PDB = PDB.replace("   ",",")
PDB = PDB.replace("  ",",")
PDB = PDB.replace(" ",",")
#PDB = PDB.replace("TER,","")

if PDB.find("TER"):
    P = PDB
# ---------- end filter_dbd ----------
num = Number([-1, -2])
cull_i = CullIndex(List=filter_dbd.P, Indices=num, Wrap=True)
split = TextSplit(Text=cull_i, Separators=",")

# ---- group: PDB Reader / Atoms_XYZ
z = ListItem(List=split, Index="8", Wrap=True)  # -> flatten(Item)
y = ListItem(List=split, Index="7", Wrap=True)  # -> flatten(Item)
x = ListItem(List=split, Index="6", Wrap=True)  # -> flatten(Item)
num_2 = Number(z)
num_3 = Number(y)
num_4 = Number(x)
pt = ConstructPoint(XCoordinate=num_4, YCoordinate=num_3, ZCoordinate=num_2)

# ---- group: PDB Reader / Atoms_name
item = ListItem(List=split, Index="2", Wrap=True)  # -> flatten(Item)
atoms_name = Text(item)

# ---- group: PDB Reader / AA_name
item_2 = ListItem(List=split, Index="3", Wrap=True)  # -> flatten(Item)
aa_name = Text(item_2)

# ---- group: PDB Reader / Atoms_order
atom_order = ListItem(List=split, Index="1", Wrap=True)  # -> flatten(Item)
atom_order_2 = Number(atom_order)

# ---- group: PDB Reader / AA_id
amino_acid_id = ListItem(List=split, Index="5", Wrap=True)  # -> flatten(Item)
aa_id = Number(amino_acid_id)

# ----
atoms_name_2 = ClusterOutput(atoms_name)
atom_order_3 = ClusterOutput(atom_order_2)
aa_name_2 = ClusterOutput(aa_name)
aa_id_2 = ClusterOutput(aa_id)
xyz_point = ClusterOutput(pt)
