# Grasshopper definition ProteinGenerator.gh (Grasshopper 1.0.7)
# Copyright: Use it.  Mod it.  Share it. Just please give credit and keep this party going.
# Copyright: Use it.  Mod it.  Share it. Just please give credit and kepp this party going.
# plug-ins: Human UI, MetaHopper

# ----
# Visualisation Parameters
colour_swatch = ColourSwatch(SwatchColor=RGB(255, 0, 68))
size_of_main_chain_aa = Slider(0.5, range=0..1)
create_color_picker = CreateColorPicker(
    DefaultColor=colour_swatch,
    AvailableColors=[RGB(255, 0, 0), RGB(0, 128, 0), RGB(0, 255, 255), RGB(128, 128, 128), RGB(255, 255, 0)])
create_color_picker_2 = CreateColorPicker(
    DefaultColor=colour_swatch,
    AvailableColors=[RGB(255, 0, 0), RGB(0, 128, 0), RGB(0, 255, 255), RGB(128, 128, 128), RGB(255, 255, 0)])
create_color_picker_3 = CreateColorPicker(
    DefaultColor=colour_swatch,
    AvailableColors=[RGB(255, 0, 0), RGB(0, 255, 0), RGB(0, 255, 255), RGB(128, 128, 128), RGB(255, 255, 0)])
value_listener = ValueListener(Elements=create_color_picker_3, SomeProperty=True)  # -> Values, Indices
value_listener_2 = ValueListener(Elements=create_color_picker, SomeProperty=True)  # -> Values, Indices
value_listener_3 = ValueListener(Elements=create_color_picker_2, SomeProperty=True)  # -> Values, Indices
create_slider = CreateSlider(Slider=size_of_main_chain_aa, ShowBounds=False, ShowTicks=False, ShowTooltip=False, ShowValLabel=True, showLabel=True)
value_listener_4 = ValueListener(Elements=create_slider, SomeProperty=True)  # -> Values, Indices
create_toggle = CreateToggle(Default=Toggle(False), Label="Record state")
create_toggle_2 = CreateToggle(Default=Toggle(False), Label="Σ Data")
create_toggle_3 = CreateToggle(Default=Toggle(False), Label="Data per slice")
create_toggle_4 = CreateToggle(Default=Toggle(False), Label="Show previous state")
create_toggle_5 = CreateToggle(Default=Toggle(True), Label="Secondary Structure")
create_toggle_6 = CreateToggle(Default=Toggle(False), Label="Side Chains")
create_toggle_7 = CreateToggle(Default=Toggle(False), Label="Primary Structure")
merge = Merge(Data1=value_listener.Values, Data2=value_listener_2.Values, Data3=value_listener_3.Values, Data4=colour_swatch)  # -> flatten(Result)
merge_2 = Merge(Data1=flatten(create_color_picker_3), Data2=flatten(create_color_picker), Data3=flatten(create_color_picker_2))
value_listener_5 = ValueListener(Elements=create_toggle_3, SomeProperty=True)  # -> Values, Indices
value_listener_6 = ValueListener(Elements=create_toggle_4, SomeProperty=True)  # -> Values, Indices
cluster = Cluster_2(ui_elements=merge_2)
value_listener_7 = ValueListener(Elements=create_toggle, SomeProperty=True)  # -> Values, Indices
value_listener_8 = ValueListener(Elements=create_toggle_5, SomeProperty=True)  # -> Values, Indices
value_listener_9 = ValueListener(Elements=create_toggle_6, SomeProperty=True)  # -> Values, Indices
value_listener_10 = ValueListener(Elements=create_toggle_2, SomeProperty=True)  # -> Values, Indices
value_listener_11 = ValueListener(Elements=create_toggle_7, SomeProperty=True)  # -> Values, Indices
enable_disable_object = EnableDisableObject(Enabled=value_listener_10.Values, AllObjects_Object=multiplylist_3)
hide_show_object_preview = HideShowObjectPreview(Visible=value_listener_6.Values, AllObjects_Object=[cloud_display, cloud_display_2, cloud_display_3])
hide_show_object_preview_2 = HideShowObjectPreview(Visible=value_listener_8.Values, AllObjects_Object=protein_ribbon)
enable_disable_object_2 = EnableDisableObject(Enabled=value_listener_11.Values, AllObjects_Object=[list_item_3, list_item_2, list_item_4])
enable_disable_object_3 = EnableDisableObject(Enabled=value_listener_5.Values, AllObjects_Object=multiplylist_2)
enable_disable_object_4 = EnableDisableObject(Enabled=value_listener_9.Values, AllObjects_Object=[line, graft_tree])
enable_disable_object_5 = EnableDisableObject(Enabled=value_listener_7.Values, AllObjects_Object=[cloud_display, cloud_display_2, cloud_display_3])
merge_3 = Merge(
    Data1=cluster,
    Data2=flatten(create_slider),
    Data3=flatten(create_toggle_5),
    Data4=flatten(create_toggle_7),
    Data5=flatten(create_toggle_6),
    Data6=flatten(create_toggle_2),
    Data7=flatten(create_toggle_3),
    Data8=flatten(create_toggle),
    Data9=flatten(create_toggle_4))
enable_disable_object_6 = EnableDisableObject(AllObjects_Object=protein_ribbon)
create_expander = CreateExpander(UIElements=merge_3, Header="VISUALISATION PARAMETERS", Open=True)

# ----
# Interpolation Parameters
random_seed = Slider(0.5, range=0..1)
create_color_picker_4 = CreateColorPicker()
create_slider_2 = CreateSlider(Slider=random_seed, ShowBounds=False, ShowTicks=False, ShowTooltip=False, ShowValLabel=True, showLabel=True)
value_listener_12 = ValueListener(Elements=create_slider_2, SomeProperty=True)  # -> Values, Indices
merge_4 = Merge(Data1=flatten(create_color_picker_4), Data2=flatten(create_slider_2))
create_expander_2 = CreateExpander(UIElements=merge_4, Header="INTERPOLATION PARAMETERS", Open=True)

chart_type = ValueList({"Pie Chart": 0, "Horizontal Bar Chart": 1, "Vertical Bar Chart": 2, "Doughnut Chart": 3, "Gauge Chart": 4}, selected="Vertical Bar Chart")
pan = Panel("""GLN
HIS
THR
VAL
MET""")
pan_2 = Panel("""342
431
554
123
34""")
create_chart = CreateChart(Data=pan_2, Names=pan, Title="Protein", SubTitle="Heavy water", ChartType=chart_type)

# ----
# Use the ANIMATE slider to
# interpolate between states
animate = Slider(0.8, range=0..1)
create_slider_3 = CreateSlider(Slider=animate, ShowBounds=False, ShowTicks=False, ShowTooltip=False, ShowValLabel=True, showLabel=True)
value_listener_13 = ValueListener(Elements=create_slider_3, SomeProperty=True)  # -> Values, Indices

hide_show_object_preview_3 = HideShowObjectPreview()
construct_domain = ConstructDomain(DomainStart=0, DomainEnd=1)

# ----
# INTERFACE
listtotree = GhPythonScript()  # -> output; inputs Lists: list
# ---------- listtotree: Python ----------
__author__ = "Flora"
__version__ = "2021.01.18"

import rhinoscriptsyntax as rs



#Created By piac
#from https://gist.github.com/piac/ef91ac83cb5ee92a1294
def list_to_tree(input, none_and_holes=True, source=[0]):
    """Transforms nestings of lists or tuples to a Grasshopper DataTree"""
    from Grasshopper import DataTree as Tree
    from Grasshopper.Kernel.Data import GH_Path as Path
    from System import Array
    def proc(input,tree,track):
        path = Path(Array[int](track))
        if len(input) == 0 and none_and_holes: tree.EnsurePath(path); return
        for i,item in enumerate(input):
            if hasattr(item, '__iter__'): #if list or tuple
                track.append(i); proc(item,tree,track); track.pop()
            else:
                if none_and_holes: tree.Insert(item,path,i)
                elif item is not None: tree.Add(item,path)
    if input is not None: t=Tree[object]();proc(input,t,source[:]);return t

output=list_to_tree(Lists)
# ---------- end listtotree ----------
create_stack = CreateStack(Horizontal=True)
multiplylist = GhPythonScript(tree=listtotree)  # -> tree, multipliedList; inputs tree: tree
# ---------- multiplylist: Python ----------
__author__ = "Flora"
__version__ = "2021.01.18"

import rhinoscriptsyntax as rs

for i in range(tree.BranchCount):
    #subList=[]
    print(i)
    #for ii in tree.Branch(i):
    #    subList.append(list[i])
    #multipliedList.append(subList)

#multipliedList=list_to_tree(multipliedList)
# ---------- end multiplylist ----------

panel = Panel("""50:55
100:110
80:85""")
enable_disable_object_7 = EnableDisableObject(Enabled=Toggle(False), AllObjects_Object=cluster_9)

# ----
# PARSE PDB
# Input Active (End) state
# PDB path
# Input Inactive state
# PDB path
input_pdb_path = Panel("C:\Users\froumpani\OneDrive - The Alan Turing Institute\Turing\1.Projects\3.Protein_folding\1.Data\GlyP_AMP.pdb")
input_pdb_path_2 = Panel("C:\Users\froumpani\OneDrive - The Alan Turing Institute\Turing\1.Projects\3.Protein_folding\1.Data\GlyP_G6P.pdb")
pdb_reader = PDB_Reader(pdb_path=input_pdb_path)  # -> atom_4, aa_id_2, aa_name_2, atom_id_2, xyz_point, atoms_name_2, atom_3
pdb_reader_2 = PDB_Reader(pdb_path=input_pdb_path_2)  # -> atom_4, aa_id_2, aa_name_2, atom_id_2, xyz_point, atoms_name_2, atom_3
aa_range = Domain(Domain(0, 6798))
filter_aa_properties = GhPythonScript(
    AA_id=pdb_reader.aa_id_2,
    AA_name=pdb_reader.aa_name_2,
    atoms_id=pdb_reader.atom_id_2,
    atoms_xyz=pdb_reader.xyz_point,
    atoms_name=pdb_reader.atoms_name_2,
    mask=aa_range)  # -> out, AA_name_list, atoms_id_list, AA_ID_list, atoms_name_list, atoms_xyz_list; inputs AA_id: list of Int32, AA_name: list, atoms_id: list, atoms_xyz: list, atoms_name: list
#   port AA_id: Amino Acid names
# ---------- filter_aa_properties: Python ----------
__author__ = "Flora"
__version__ = "2020.10.28"

"""
This module reads PDB output lists and creates double lists of AA coordinates and 
properties per AA atom, masked by a domain, ready to be converted to trees.
eg. [['75.814,-34.543,47.16', '74.639,-34.529,48.079'...],[...]]
    Inputs:
        AA_id: Amino Acid id number (int list)
        AA_name: Amino Acid name (string list)
        atoms_xyz: coordinates in 3Dspace per atom (3d point rhino item)
        atoms_name: atom names (string list)
    Output:
        atoms_xyz_list/name: list of coordinates/names of all atoms per AA
        AA_name_list: list of unique AA names in order per AA 
"""

import rhinoscriptsyntax as rs


#TODO: seperate per protein ("TER") 

def ListAANames(AA_id, AA_name):
    """
    Creates a list of unique AA names
    AA_id: [] index of AA per atom
    AA_name: [] name of AA per atom
    
    AA_name_list: [] of uniqe AA names
    """
    counter=-1
    AA_name_list=[]
    for i in range (len(AA_id)):
        if AA_id[i]!=counter: #a new aminoacid
            AA_name_list.append(AA_name[i]) #stores name per chain of AA
            counter=AA_id[i]
    return (AA_name_list)


def ListAtomsperAA(AA_id, atoms_list):
    """
    Groups atoms in lists per AA 
    AA_id: [] index of AA per atom
    atoms_list: [] single list of atoms 
    
    list: [] grouped values in lists per AA
    """
    counter=-1
    list, sublist =[],[]

    for i in range (len(AA_id)):
        if AA_id[i]!=counter: #a new aminoacid
            if sublist != []:
                list.append(sublist) #store list of atoms per AA
            sublist=[]
            sublist.append(atoms_list[i])
            counter=AA_id[i]

        else: # existing aminoacid
            sublist.append(atoms_list[i])

    list.append(sublist)  #stores list of atoms of final AA
    return (list)


def Mask(mask, list):
    """
    Creates a sublist per domain  
    mask: gh domain (10:100)
    list: [] any list 
    
    list_masked: [] output sublist
    """
    list_masked = list [int(mask[0]):int(mask[1])]
    return (list_masked)


if __name__ == "__main__": 
    if (mask!= None) :
        AA_name_list= Mask(mask, ListAANames(AA_id, AA_name))
        AA_ID_list=Mask(mask, ListAANames(AA_id, AA_id))
        atoms_xyz_list=Mask(mask,ListAtomsperAA(AA_id, atoms_xyz))
        atoms_name_list=Mask(mask,ListAtomsperAA(AA_id, atoms_name))
        atoms_id_list=Mask(mask,ListAtomsperAA(AA_id, atoms_id))
        
    else: 
        AA_name_list= ListAANames(AA_id, AA_name)
        atoms_xyz_list=ListAtomsperAA(AA_id, atoms_xyz)
        atoms_name_list=ListAtomsperAA(AA_id, atoms_name)
# ---------- end filter_aa_properties ----------
filter_aa_properties_2 = GhPythonScript(
    AA_id=pdb_reader_2.aa_id_2,
    AA_name=pdb_reader_2.aa_name_2,
    atoms_xyz=pdb_reader_2.xyz_point,
    atoms_name=pdb_reader_2.atoms_name_2,
    mask=aa_range)  # -> out, AA_name_list, atoms_name_list, atoms_xyz_list; inputs AA_id: list of Int32, AA_name: list, atoms_xyz: list, atoms_name: list
#   port AA_id: Amino Acid names
# ---------- filter_aa_properties_2: Python ----------
__author__ = "Flora"
__version__ = "2020.10.28"

"""
This module reads PDB output lists and creates double lists of AA coordinates and 
properties per AA atom, masked by a domain, ready to be converted to trees.
eg. [['75.814,-34.543,47.16', '74.639,-34.529,48.079'...],[...]]
    Inputs:
        AA_id: Amino Acid id number (int list)
        AA_name: Amino Acid name (string list)
        atoms_xyz: coordinates in 3Dspace per atom (3d point rhino item)
        atoms_name: atom names (string list)
    Output:
        atoms_xyz_list/name: list of coordinates/names of all atoms per AA
        AA_name_list: list of unique AA names in order per AA 
"""

import rhinoscriptsyntax as rs


#TODO: seperate per protein ("TER") 

def ListAANames(AA_id, AA_name):
    """
    Creates a list of unique AA names
    AA_id: [] index of AA per atom
    AA_name: [] name of AA per atom
    
    AA_name_list: [] of uniqe AA names
    """
    counter=-1
    AA_name_list=[]
    for i in range (len(AA_id)):
        if AA_id[i]!=counter: #a new aminoacid
            AA_name_list.append(AA_name[i]) #stores name per chain of AA
            counter=AA_id[i]
    return (AA_name_list)


def ListAtomsperAA(AA_id, atoms_list):
    """
    Groups atoms in lists per AA 
    AA_id: [] index of AA per atom
    atoms_list: [] single list of atoms 
    
    list: [] grouped values in lists per AA
    """
    counter=-1
    list, sublist =[],[]

    for i in range (len(AA_id)):
        if AA_id[i]!=counter: #a new aminoacid
            if sublist != []:
                list.append(sublist) #store list of atoms per AA
            sublist=[]
            sublist.append(atoms_list[i])
            counter=AA_id[i]

        else: # existing aminoacid
            sublist.append(atoms_list[i])

    list.append(sublist)  #stores list of atoms of final AA
    return (list)


def Mask(mask, list):
    """
    Creates a sublist per domain  
    mask: gh domain (10:100)
    list: [] any list 
    
    list_masked: [] output sublist
    """
    list_masked = list [int(mask[0]):int(mask[1])]
    return (list_masked)


if __name__ == "__main__": 
    if (mask!= None) :
        AA_name_list= Mask(mask, ListAANames(AA_id, AA_name))
        atoms_xyz_list=Mask(mask,ListAtomsperAA(AA_id, atoms_xyz))
        atoms_name_list=Mask(mask,ListAtomsperAA(AA_id, atoms_name))
        
    else: 
        AA_name_list= ListAANames(AA_id, AA_name)
        atoms_xyz_list=ListAtomsperAA(AA_id, atoms_xyz)
        atoms_name_list=ListAtomsperAA(AA_id, atoms_name)
# ---------- end filter_aa_properties_2 ----------
item = ListItem(List=filter_aa_properties.AA_ID_list, Index=0, Wrap=True)

# ---- group: State Data
# PARSE DATA
# Input State data
# path (csv)
panel_2 = Panel("C:\Users\froumpani\OneDrive - The Alan Turing Institute\Turing\1.Projects\3.Protein_folding\1.Data\State_data_all.csv")
input_experiment_id = Panel("0")
state_reader = StateReader(path=panel_2, index=input_experiment_id)  # -> states_2, start_aa_3, end_aa_3, uptake_3, centre_3, exposure_4, sequence_2
list_of_experiments = Panel(state_reader.states_2)
number_slider = Slider(56, range=0..1000)

# ----
aa_range_2 = Domain(Domain(0, 100))
aa_range_3 = Domain(Domain(0, 300))
create_text_box = CreateTextBox(Label="Slices stack", DefaultText="40:180", UpdateButton=True, showLabel=True)
create_range_slider = CreateRangeSlider(SliderRange=aa_range_3, StartingRange=aa_range_2)  # disabled
create_pulldown_menu = CreatePulldownMenu(Label="Experiment", ListItems=state_reader.states_2, showLabel=True)
value_listener_14 = ValueListener(Elements=create_range_slider, SomeProperty=True)  # -> Values, Indices; disabled
value_listener_15 = ValueListener(Elements=create_text_box, SomeProperty=True)  # -> Values, Indices
value_listener_16 = ValueListener(Elements=create_pulldown_menu, SomeProperty=True)  # -> Values, Indices
text_split = TextSplit(Text=value_listener_15.Values, Separators=",")
number_slider_2 = Slider(145, range=0..1000)
number_slider_3 = Slider(102, range=0..400)
number_slider_4 = Slider(93, range=0..1000)
panel_3 = Panel("""0
0
1
1""")
merge_5 = Merge(Data2=create_text_box, Data3=create_pulldown_menu)  # -> flatten(Result)
panel_4 = Panel("""0
1
0
1""")
create_grid = CreateGrid(
    UIElements=merge_5,
    RowDefinitions=Slider(153, range=0..1000),
    ColumnDefinitions=[Slider(188, range=0..1000), Slider(239, range=0..1000)],
    ElementRow=panel_3,
    ElementColumn=panel_4,
    ElementRowSpan=1,
    ElementColumnSpan=1)
adjust_element_positioning = AdjustElementPositioning(
    ElementsToAdjust=create_grid,
    Margin="10",
    AbsolutePositioning=False,
    Width=Slider(1391, range=0..10000),
    Height=Slider(163, range=0..1000))

# ---- group: State Data / Seperates list per Exposure
create_set = CreateSet(List=state_reader.exposure_4)  # -> Set, Map
equality = Equality(FirstNumber=graft(create_set.Set), SecondNumber=state_reader.exposure_4)  # -> Equality, Inequality

# ---- group: State Data / Slices (AA ID series) creation using start AA and End AA of slice ID
subtraction = Subtraction(A=state_reader.end_aa_3, B=state_reader.start_aa_3)
addition = Addition(A=subtraction, B=1)
series = Series(Start=state_reader.start_aa_3, Step=1, Count=addition)

# ---- group: Interpolator
# INTERPOLATOR
xyz_tree = GhPythonScript(xyz=filter_aa_properties_2.atoms_xyz_list)  # -> out, x_list, y_list, z_list; inputs xyz: list
# ---------- xyz_tree: Python ----------
__author__ = "Flora"
__version__ = "2020.10.28"

"""
Provides a scripting component.
    Inputs:
        AA: Amino Acid id number (int list)
        AA_name: Amino Acid name (string list)
        xyz: coordinates in 3Dspace per atom (3d point rhino item)
        atoms: atom names (string list)
    Output:
        a: xyz coordinates for debug
        start: list of coordinates of all atoms per AA (for starting points of lines) 
        end: list of coordinates of all atoms per AA (for ending poins of lines)
"""


import rhinoscriptsyntax as rs


x_list,y_list,z_list=[],[],[]

def create_xyz_list():

    for i in range (len(xyz)):
        x1,y1,z1=[],[],[]
        for j in range (len(xyz[i])):
            if (xyz[i][j]!=None):
                xyz_str= str(xyz[i][j])
                x,y,z= xyz_str.split(",")
                x1.append(x)
                y1.append(y)
                z1.append(z)
            else:
                x1.append("None")
        x_list.append(x1)
        y_list.append(y1)
        z_list.append(z1)

create_xyz_list()
# ---------- end xyz_tree ----------
exposure_id = Slider(3, range=0..7)
xyz_tree_2 = GhPythonScript(xyz=filter_aa_properties.atoms_xyz_list)  # -> out, x_list, y_list, z_list; inputs xyz: list
# ---------- xyz_tree_2: Python ----------
__author__ = "Flora"
__version__ = "2020.10.28"

"""
This componment gets the x,y,z list and creates seperate x,y,z, lists per AA 
atom.
    Inputs:
        AA: Amino Acid id number (int list)
        AA_name: Amino Acid name (string list)
        xyz: coordinates in 3Dspace per atom (3d point rhino item)
        atoms: atom names (string list)
    Output:
        a: xyz coordinates for debug
        start: list of coordinates of all atoms per AA (for starting points of lines) 
        end: list of coordinates of all atoms per AA (for ending poins of lines)
"""


import rhinoscriptsyntax as rs


x_list,y_list,z_list=[],[],[]

def create_xyz_list():

    for i in range (len(xyz)):
        x1,y1,z1=[],[],[]
        for j in range (len(xyz[i])):
            if (xyz[i][j]!=None):
                xyz_str= str(xyz[i][j])
                x,y,z= xyz_str.split(",")
                x1.append(x)
                y1.append(y)
                z1.append(z)
            else:
                x1.append("Ter")
                y1.append("Ter")
                z1.append("Ter")
        x_list.append(x1)
        y_list.append(y1)
        z_list.append(z1)


create_xyz_list()
# ---------- end xyz_tree_2 ----------
linear_interpolation = GhPythonScript(
    x1=xyz_tree_2.x_list,
    x2=xyz_tree.x_list,
    y1=xyz_tree_2.y_list,
    y2=xyz_tree.y_list,
    z1=xyz_tree_2.z_list,
    z2=xyz_tree.z_list,
    exposures=create_set.Set,
    a=value_listener_12.Values,
    exp_id=exposure_id)  # -> out, xyz_list; inputs x1: list, x2: list, y1: list, y2: list, z1: list, z2: list, exposures: list
# ---------- linear_interpolation: Python ----------
"""Simple Linear Interpolator.
    Inputs:
        x: The x script variable
        y: The y script variable
        z: The z script variable
    Output:
        xyz_list: new xyz coordinates"""

__author__ = "Flora"
__version__ = "2020.11.12"

import rhinoscriptsyntax as rs
import math as mth



exposures_norm = [exp/max(exposures) for exp in exposures]
exposures_norm_log = [mth.log(exp+1)/mth.log(max(exposures)+1) for exp in exposures]



exp_id = int(exp_id)
x,y,z=[],[],[]
#x=p*(x2-x1)+x1

splits = []

for i in range(len(x1)):
    xyz_temp=[]
    for j in range (len(x1[i])):
        if x1[i][j]!= "Ter":
            x1f= float(x1[i][j])+a
            x2f= float(x2[i][j])+a
            x_new=exposures_norm[exp_id]*(x2f-x1f)+x1f

            y1f= float(y1[i][j])
            y2f= float(y2[i][j])
            y_new=exposures_norm[exp_id]*(y2f-y1f)+y1f
            
            z1f= float(z1[i][j])
            z2f= float(z2[i][j])
            z_new=exposures_norm[exp_id]*(z2f-z1f)+z1f
            
            xyz_temp.append("%s,%s,%s" %(x_new,y_new,z_new))
        else:
            xyz_temp.append("Ter")
    x.append(xyz_temp)


#Originally Created By piac
#from https://gist.github.com/piac/ef91ac83cb5ee92a1294
#NOTE: for later use
def list_to_tree(input, none_and_holes=True, source=[0]):
    """Transforms nestings of lists or tuples to a Grasshopper DataTree"""
    from Grasshopper import DataTree as Tree
    from Grasshopper.Kernel.Data import GH_Path as Path
    from System import Array
    def proc(input,tree,track):
        path = Path(Array[int](track))
        if len(input) == 0 and none_and_holes: tree.EnsurePath(path); return
        for i,item in enumerate(input):
            if hasattr(item, '__iter__'): #if list or tuple
                track.append(i); proc(item,tree,track); track.pop()
            else:
                if none_and_holes: tree.Insert(item,path,i)
                elif item is not None: tree.Add(item,path)
    if input is not None: t=Tree[object]();proc(input,t,source[:]);return t

xyz_list=x

#list_to_tree(x)
# ---------- end linear_interpolation ----------
ghpython_script = GhPythonScript(x=exposure_id)  # -> out, a
# ---------- ghpython_script: Python ----------
__author__ = "Flora"
__version__ = "2021.06.02"

import rhinoscriptsyntax as rs

if (x==0.0):
    a=0

if (x==0.1):
    a=50
    
if (x==0.2):
    a=150
    
if (x==0.3):
    a=250
    
if (x==0.4):
    a=350

if (x==0.5):
    a=500

if (x==0.6):
    a=1000

if (x==0.7):
    a=5000
    
if (x==0.8):
    a=10000

if (x==0.9):
    a=15000
# ---------- end ghpython_script ----------
number = Number(ghpython_script.a)

# ---- group: PDB exporter
pdb_exporter = PDB_Exporter(pdb_path=input_pdb_path, xyz=linear_interpolation.xyz_list, atoms_id=filter_aa_properties.atoms_id_list)
enable_disable_object_8 = EnableDisableObject(Enabled=Toggle(True), AllObjects_Object=pdb_exporter)

# ---- group: Slices
# SLICES
domain = Domain(text_split)
panel_5 = Panel(domain)

# ---- group: Static Movement Visualisation
panel_6 = Panel("""CA
C
N""")
cluster_2 = Cluster_4(
    domain=domain,
    aa_name_list=filter_aa_properties.AA_name_list,
    atoms_name_list=filter_aa_properties.atoms_name_list,
    atoms_xyz_list=filter_aa_properties.atoms_xyz_list,
    search=panel_6)  # -> pt_2, pl
cluster_3 = Cluster_4(
    domain=domain,
    aa_name_list=filter_aa_properties.AA_name_list,
    atoms_name_list=filter_aa_properties.atoms_name_list,
    atoms_xyz_list=filter_aa_properties_2.atoms_xyz_list,
    search=panel_6)  # -> pt_2, pl
cluster_4 = Cluster_5(A=cluster_2.pt_2, B=cluster_3.pt_2)
ln = Line(StartPoint=cluster_2.pt_2, EndPoint=cluster_3.pt_2)
material = CreateMaterial(
    Diffuse=ColourSwatch(SwatchColor=RGB(110, 110, 110)),
    Specular=RGB(255, 255, 255),
    Emission=RGB(0, 0, 0),
    Transparency=Slider(0.5, range=0..1),
    Shine=0)
loft = Loft(Curves=ln, Options={Adjust=False, Closed=False, LoftEnds=0, LoftSimp=0, LoftType=2, Rebuild=10, Refit=0.01})
preview = CustomPreview(Geometry=loft, Material=material)
vdisex = VectorDisplayEx(Point=cluster_2.pt_2, Vector=ln, Colour=cluster_4, Width="10")

# ---- group: Sidechains
sidechains = GhPythonScript(
    AA_name_list=filter_aa_properties.AA_name_list,
    atoms_name_list=filter_aa_properties.atoms_name_list,
    atoms_xyz_list=linear_interpolation.xyz_list)  # -> out, AA_name, start, end, atom_names, atom_xyz; inputs AA_name_list: list, atoms_name_list: list, atoms_xyz_list: list; same code as sidechains
subtract_7_first_aa_id_no = Subtract7FirstAAIDNo(I=domain, B=item, B_2=item)
sub_list = SubList(List=sidechains.AA_name, Domain=subtract_7_first_aa_id_no, Wrap=True)  # -> List, Index
cluster_5 = Cluster(tree=sidechains.start, domain=subtract_7_first_aa_id_no)
cluster_6 = Cluster(tree=sidechains.end, domain=subtract_7_first_aa_id_no)
cluster_7 = Cluster(tree=sidechains.atom_names, domain=subtract_7_first_aa_id_no)
cluster_8 = Cluster(tree=sidechains.atom_xyz, domain=subtract_7_first_aa_id_no)
stream_gate = StreamGate(Stream=cluster_8, Gate=0)  # -> Target0, Target1

# ---- group: State Data / Filter xyz per slice
xyzpoints = Point(cluster_8)
treetolist = GhPythonScript(xyz=xyzpoints)  # -> xyz_list; inputs xyz: tree of Point3d
# ---------- treetolist: Python ----------
__author__ = "Flora"
__version__ = "2021.01.18"

import rhinoscriptsyntax as rs


#Created By piac
#from https://gist.github.com/piac/ef91ac83cb5ee92a1294
# written by Giulio Piacentino, giulio@mcneel.com
def tree_to_list(input, retrieve_base = lambda x: x[0]):
    """Returns a list representation of a Grasshopper DataTree"""
    def extend_at(path, index, simple_input, rest_list):
        target = path[index]
        if len(rest_list) <= target: rest_list.extend([None]*(target-len(rest_list)+1))
        if index == path.Length - 1:
            rest_list[target] = list(simple_input)
        else:
            if rest_list[target] is None: rest_list[target] = []
            extend_at(path, index+1, simple_input, rest_list[target])
    all = []
    for i in range(input.BranchCount):
        path = input.Path(i)
        extend_at(path, 0, input.Branch(path), all)
    return retrieve_base(all)

xyz_list=[]

xyz_list=tree_to_list(xyz)
# ---------- end treetolist ----------
selectionfromlists = GhPythonScript(Lists=treetolist, selection=series)  # -> slice_xyz; inputs Lists: list, selection: tree
# ---------- selectionfromlists: Python ----------
__author__ = "Flora"
__version__ = "2021.01.18"

import rhinoscriptsyntax as rs

slice_xyz=[]

for i in range(selection.BranchCount):
    subOutput=[]
    for ii in selection.Branch(i):
        number=int(ii)
        print(number)
        if number<len(Lists):
            subOutput.append(Lists[number])
    slice_xyz.append(subOutput)

#Created By piac
#from https://gist.github.com/piac/ef91ac83cb5ee92a1294
def list_to_tree(input, none_and_holes=True, source=[0]):
    """Transforms nestings of lists or tuples to a Grasshopper DataTree"""
    from Grasshopper import DataTree as Tree
    from Grasshopper.Kernel.Data import GH_Path as Path
    from System import Array
    def proc(input,tree,track):
        path = Path(Array[int](track))
        if len(input) == 0 and none_and_holes: tree.EnsurePath(path); return
        for i,item in enumerate(input):
            if hasattr(item, '__iter__'): #if list or tuple
                track.append(i); proc(item,tree,track); track.pop()
            else:
                if none_and_holes: tree.Insert(item,path,i)
                elif item is not None: tree.Add(item,path)
    if input is not None: t=Tree[object]();proc(input,t,source[:]);return t


#output=list_to_tree(output)
# ---------- end selectionfromlists ----------

# ---- group: State Data / Select Exposure
cull_pattern = CullPattern(List=state_reader.centre_3, CullPattern=equality.Equality)
number_slider_5 = Slider(6, range=0..7)
cull_pattern_2 = CullPattern(List=selectionfromlists, CullPattern=equality.Equality)
cull_pattern_3 = CullPattern(List=state_reader.uptake_3, CullPattern=equality.Equality)
ghpython_script_2 = GhPythonScript(Uptake=cull_pattern_3, ExposureID=exposure_id)  # -> out, uptake; inputs Uptake: tree
# ---------- ghpython_script_2: Python ----------
__author__ = "Flora"
__version__ = "2021.06.03"

import Grasshopper as gh
import rhinoscriptsyntax as rs


uptake = Uptake.Branch(ExposureID)
#print (x[0,0])
#for i in range(x.BranchCount):
#    print x.Branch(i)



#for i in range (len(x)):
#    None
    #print (x[i])
# ---------- end ghpython_script_2 ----------
explode_tree = ExplodeTree(Data=cull_pattern_2)  # -> _0000, _0001, _0002, _0003, _0004, _0005, _0006, _0007, Branch8, Branch9
explode_tree_2 = ExplodeTree(Data=cull_pattern)  # -> _0000, _0001, _0002, _0003, _0004, _0005, _0006, _0007, Branch8, Branch9

# ----
merge_6 = Merge(Data1=flatten(create_chart), Data2=flatten(create_slider_3), Data3=flatten(create_grid))
create_expander_3 = CreateExpander(UIElements=merge_6, Header="UI Controls", Open=True)

# ---- group: UI Sliders Window
# Set the toggle to the right to "True" to launch the window.
number_slider_6 = Slider(765, range=0..1000)
merge_7 = Merge(Data1=flatten(create_expander_3), Data2=flatten(create_expander), Data3=flatten(create_expander_2))
launch_window = LaunchWindow(
    Show=Toggle(False),
    Name="Control Window",
    Width=Slider(428, range=0..1000),
    Height=number_slider_6,
    ChildStatus=0,
    EnableHorizScroll=False)
add_elements = AddElements(Window=launch_window, Elements=flatten(merge_7), DoVLChecking=True)  # -> AddedElements, ElementNames

# ---- group: Constructs Backbone
# VISUALISATION Primary Structure
# Use this slider to control the size of the
# Amino Acid Spheres in the visualisation
# Use this slider to control the size of the
# Lines connecting the AA in the visualisation
panel_7 = Panel("""C
CA
N""")
size_of_main_chain_aa_2 = Slider(0.4, range=0..1)
find_aa_index = GhPythonScript(input=cluster_7, search=panel_7)  # -> output; inputs input: list, search: list
# ---------- find_aa_index: Python ----------
__author__ = "Flora"
__version__ = "2020.10.27"

import rhinoscriptsyntax as rs

output=[]

for i in range(len(input)):
    for j in range (len(search)):    
        if input[i] == search[j]: #.find(search)!=-1:
            #print (input[i])
            output.append(i)
# ---------- end find_aa_index ----------
find_aa_index_2 = GhPythonScript(input=cluster_7, search="CA")  # -> output; inputs input: list; same code as find_aa_index
find_aa_index_3 = GhPythonScript(input=cluster_7, search="N")  # -> output; inputs input: list; same code as find_aa_index
find_aa_index_4 = GhPythonScript(input=cluster_7, search="C")  # -> output; inputs input: list; same code as find_aa_index
list_item = ListItem(List=stream_gate.Target0, Index=find_aa_index, Wrap=True)  # -> flatten(Item)
list_item_2 = ListItem(List=stream_gate.Target0, Index=find_aa_index_2, Wrap=True)  # -> flatten(Item); disabled
list_item_3 = ListItem(List=stream_gate.Target0, Index=find_aa_index_3, Wrap=True)  # -> flatten(Item); disabled
list_item_4 = ListItem(List=stream_gate.Target0, Index=find_aa_index_4, Wrap=True)  # -> flatten(Item); disabled
polyline = PolyLine(Vertices=list_item, Closed=False)
list_item_5 = ListItem(List=list_item, Index=0, Wrap=True)
size_of_tube = Slider(0.18, range=0.01..1)
circle = Circle(Plane=list_item_5, Radius=size_of_tube)
cloud_display = CloudDisplay(Points=list_item_3, Colours=ColourSwatch(SwatchColor=RGB(21, 247, 0)), Size=size_of_main_chain_aa_2, SpriteType=0)  # disabled
cloud_display_2 = CloudDisplay(Points=list_item_2, Colours=ColourSwatch(SwatchColor=RGB(82, 209, 92)), Size=size_of_main_chain_aa_2, SpriteType=0)  # disabled
cloud_display_3 = CloudDisplay(Points=list_item_4, Colours=ColourSwatch(SwatchColor=RGB(21, 247, 0)), Size=size_of_main_chain_aa_2, SpriteType=0)  # disabled
sphere = Sphere(Base=list_item_4, Radius=value_listener_4.Values)
sphere_2 = Sphere(Base=list_item_2, Radius=value_listener_4.Values)
sphere_3 = Sphere(Base=list_item_3, Radius=value_listener_4.Values)
extrude_along = ExtrudeAlong(Base=circle, Curve=polyline)  # -> flatten(Extrusion)
hide_show_object_preview_4 = HideShowObjectPreview(Visible=Toggle(True), AllObjects_Object=[sphere_3, sphere_2, sphere])

# ----
data_recorder = DataRecorder(linear_interpolation.xyz_list, DataLimit=-10, RecordData=False)
python = GhPythonScript(x=data_recorder)  # -> out, a; inputs x: list
# ---------- python: Python ----------
__author__ = "froumpani"
__version__ = "2021.08.11"

import rhinoscriptsyntax as rs
print x
# ---------- end python ----------
panel_8 = Panel(sidechains.atom_xyz)
atom_names = Text(cluster_7)
aa_names = Text(sub_list.List)
point = Text(stream_gate.Target0)
ghpython_script_3 = GhPythonScript(domain=domain, list_AA=list_item_3)  # -> out, b; inputs domain: list, list_AA: list
# ---------- ghpython_script_3: Python ----------
__author__ = "Flora"
__version__ = "2021.03.02"

import rhinoscriptsyntax as rs

series=[]
b=0
for i in domain: 
    #print i
    a= i[1]-i[0]
    series.append(a+b)
    b=a
    print b



#b=[[0 for j in range(list_AA)] for i in range(domain)]
#print b
for i in range(len(domain)):
    print i
#    for AA in range(series[i]):
#        print "hi"
        #print series[i]
#        for j in list_AA: 
#            b.append(5)
# ---------- end ghpython_script_3 ----------

# ---- group: Constructs Sidechains
# VISUALISATION Primary Structure
line = Line(StartPoint=cluster_5, EndPoint=cluster_6)  # disabled
graft_tree = GraftTree(Tree=sub_list.List, IncludeEmptyLists=True, IncludeNullItems=True)  # disabled
cloud_display_4 = CloudDisplay(Points=cluster_8, Colours=RGB(255, 20, 147), Size=0.21, SpriteType=0)
merge_8 = Merge(Data1=graft_tree, Data2=line)
line_dimension = LineDimension(Line=line, Text="{0:0.00}", Size=0.2)
curve = Curve(line)

# ----
# 3D View
size_of_chain_lines = Slider(0.04, range=0.01..1)
curve_2 = Curve(curve)
mesh_sphere = MeshSphere(Base=PlaneXY(0, 0, 0), Radius=10, UCount=10, VCount=20)
circle_2 = Circle(Plane=curve_2, Radius=size_of_chain_lines)
extrude_along_2 = ExtrudeAlong(Base=circle_2, Curve=curve_2)  # -> flatten(Extrusion)
mesh = Mesh(sphere_3)
mesh_2 = Mesh(sphere_2)
mesh_3 = Mesh(sphere)
create_3d_view = Create3DView(
    MeshToDisplay=mesh_sphere,
    MeshColors=RGB(255, 0, 0),
    ViewWidth=Slider(685, range=0..1000),
    ViewHeight=Slider(331, range=0..1000))
mesh_join = MeshJoin(Meshes=mesh_2)
mesh_join_2 = MeshJoin(Meshes=extrude_along_2)
mesh_join_3 = MeshJoin(Meshes=mesh)
mesh_join_4 = MeshJoin(Meshes=mesh_3)
set_3d_view = Set3DView(_3DView=create_3d_view, MeshToDisplay=[mesh_join, mesh_join_3, mesh_join_4, mesh_join_2], MeshColors=merge)

# ---- group: 3DView Window
launch_window_2 = LaunchWindow(
    Show=Toggle(False),
    Name="Control Window",
    Width=Slider(727, range=0..1000),
    Height=Slider(427, range=0..1000),
    ChildStatus=0,
    EnableHorizScroll=False)
create_expander_4 = CreateExpander(UIElements=create_3d_view, Header="3D VIEW", Open=True)
add_elements_2 = AddElements(Window=launch_window_2, Elements=flatten(create_expander_4), DoVLChecking=True)  # -> AddedElements, ElementNames

# ---- group: Clashes
# CLASHES LJ
panel_9 = Panel("CA")
find_aa_index_5 = GhPythonScript(input=atom_names, search=panel_9)  # -> output; inputs input: list; same code as find_aa_index
list_item_6 = ListItem(List=point, Index=find_aa_index_5, Wrap=True)  # -> flatten(Item)
clashes = GhPythonScript(
    AA_name=aa_names,
    CA_xyz=list_item_6,
    clash_th=Slider(3.98, range=0..10),
    break_th=Slider(9.088, range=0..10),
    e=Slider(0.25, range=0..1),
    noise=Toggle(False))  # -> out, clash, breakbond; inputs AA_name: list, CA_xyz: list
# ---------- clashes: Python ----------
"""Module to calculate Energy and find Clashes of AA in pdb files in Proteins .
    Inputs:
        CA_xyz: list (str) of xyz cooridnates of CA
        clash_th: (float) clash threshhold
        break_th: (float) break threshold
        AA_name: list(str) of AA

    Output:
        clash: a list of AA coord of clashes
        breakbond: a list of AA coord of breaks"""

__author__ = "Flora"
__version__ = "2021.04.28"

import rhinoscriptsyntax as rs
import math 
import Grasshopper.Kernel as gh


def SplitCoordinates(xyz_str):
    """
    Function to split coord. str in float list
    xyz_str: (str) a list input of "x,y,z" coordinates
    """
    xyz = []
    for i in range (len(xyz_str)):
        x_,y_,z_ = xyz_str[i].split(",")
        xyz.append([float(x_),float(y_),float(z_)])
    return(xyz)

def CalcDistance(p1, p2):
    """
    Function to calculate distance in space between two points (p)
    p1, p2: (f) lists of coordinates for point1 and point2
    """
    print (p2)
    dist = math.sqrt((p2[0]-p1[0])**2 + (p2[1]-p1[1])**2 + (p2[2]-p1[2])**2)
    print (dist)
    return(dist)

def LennardJones (e, s, p1, p2):
    """
    Archetype model for simple yet realistic intermolecular interactions
    e: dispersion energy
    s: distance at which the particle-particle potential energy V is zero 
    (size of the particle) TODO: add list of molecules //usual s = 0.34nm
    p1,p2: centroid coordinates of two molecules
    
    V: potential energy
    """
    r = CalcDistance(p1,p2)
    V = 4*e*((s/r)**12 - (s/r)**6)
    return V


def CheckClash(xyz_str, xyz, thold, e):
    """
    Fuction to check for clashes by calculating minimum distance between each AA
    xyz_str: (str) list of xyz coordinates for gh output
    xyz: (f) a list of xyz coordinates
    
    thold: (f) minimum distance threshold for a clash between two AA
    
    id, c: list of unique index and coordinates of clashed AA
    """
    c, id = [], []
    error = 0
    for i in range (len(xyz)):
        for j in range (i+1, len(xyz)):
            V = LennardJones (e,thold,xyz[i],xyz[j]) #TODO: replace thold with s
            if (V > thold):
                c.append(xyz_str[i])
                c.append(xyz_str[j])
                id.append(str(i))
                id.append(str(j))
                error=1
    if (error == 1):
        ErrorGh("Clash: ", id[0])
    return(set(c), set(id))


def CheckBreak(xyz_str, xyz, thold):
    """
    Function to check for bond breaks by calculating max distance between each AA
    xyz_str: (str) list of xyz coordinates for gh output
    xyz: (f) list of xyz coordinates of AA
    thold: (f) maximum distance threshold for a break between two AA
    
    id, b: list of unique index and coordinates of break bond in AA
    """
    b, id = [], []
    error = 0
    for i in range (len(xyz)):
        if (i+1 < len(xyz)):
            dist = CalcDistance(xyz[i],xyz[i+1])
            if (dist > thold):
                b.append(xyz_str[i])
                id.append(str(i))
                error=1
    if (error == 1):
        ErrorGh("Break: ", id[0])
    return (set(b), set(id))

def ErrorGh(m, d) :
    """
    Produces Grasshopper(gh) error and breaks the module
    """
    e = gh.GH_RuntimeMessageLevel.Error
    ghenv.Component.AddRuntimeMessage(e, m + str(d))

if __name__ == "__main__": 
    xyz = SplitCoordinates(CA_xyz)
    clash, cls_id = CheckClash(CA_xyz, xyz, clash_th, e)
    breakbond, brk_id = CheckBreak(CA_xyz, xyz, break_th)
# ---------- end clashes ----------
panel_10 = Panel(clashes.breakbond)
sphere_4 = Sphere(Base=clashes.clash, Radius=1)

# ---- group: Rotation
# ROTATION
time = Slider(1, range=0..1)
multiplication = Multiplication(A=time, B=360)
radians = Radians(Degrees=multiplication)
rotate = Rotate(
    Geometry=stream_gate.Target0,
    Angle=radians,
    Plane=Plane(origin=(46.46911359, -5.747677381, 0), x=(1, 0, 0), y=(0, -1, 0)))  # -> Geometry, Transform

# ---- group: Secondary Structure
# SECONDARY STRUCTURE
number_slider_7 = Slider(4, range=0..10)
protein_ribbon = ProteinRibbon(
    location=PlaneXY(0, 0, 0),
    aapoints=rotate.Geometry,
    threshold_count=number_slider_7,
    threshold_angle_α_vs_β=Slider(1, range=0..2),
    alpha_helix_color=ColourSwatch(SwatchColor=RGB(49, 81, 224)),
    beta_sheet_color=ColourSwatch(SwatchColor=RGB(224, 210, 56)),
    loop_color=ColourSwatch(SwatchColor=RGB(50, 153, 76)))  # -> all_atom_points, amino_acid_residue_points, curve, ribbon

# ----
cluster_9 = Cluster_3(tree_2=sidechains.atom_xyz, aa_range=panel, tree=sidechains.atom_names)  # -> i, i_2, i_3; disabled
cloud_display_5 = CloudDisplay(
    Points=[cluster_9.i, cluster_9.i_2, cluster_9.i_3],
    Colours=ColourSwatch(SwatchColor=RGB(21, 255, 0)),
    Size=1,
    SpriteType=0)

# ---- group: State Data (continued)
exposures = Panel(create_set.Set)
listtotree_2 = GhPythonScript(Lists=explode_tree._0000)  # -> output; inputs Lists: list; same code as listtotree
uptake_to_speed = GhPythonScript(uptake=ghpython_script_2.uptake)  # -> out, tree; inputs uptake: tree
# ---------- uptake_to_speed: Python ----------
__author__ = "Flora"
__version__ = "2021.06.10"

import rhinoscriptsyntax as rs
import ghpythonlib.treehelpers as th

#uptake = Uptake.Branch(ExposureID)

parentspeed=[]

#print uptake.Branch(0)[0]
exposures= []

"""
subtracts uptake from previous uptake to get absolute uptake value. 
"""
l =th.tree_to_list(uptake)

#list = th.tree_to_list(uptake.Branch(0))
#print list

exposures.append(l[0][0][0])
for i in range(1,uptake.BranchCount):
    exp_ =[]
    for j in range(len(uptake.Branch(i))):
        exp = uptake.Branch(i)[j]-uptake.Branch(i-1)[j]
        exp_.append(exp)
    exposures.append(exp_)

tree = th.list_to_tree(exposures)


    
    #print len(uptake.Branch(i))

    #AAlength = len(uptake.Branch(i))
    #print (exposures)
    #absuptake=[]
    #absuptake.append(0)
    #for j in range(AAlength):
        
        #absuptake_= uptake.Branch(i)[j]-uptake.Branch(i-1)[j]
        #absuptake.append(absuptake_)
       # None
    #print absuptake[3]
    #print (exposures[0])

    #firstItems.append(branchList[0])
# ---------- end uptake_to_speed ----------
bounds = Bounds(Numbers=uptake_to_speed.tree)
path_mapper = PathMapper(listtotree_2, source="{A;B;C}", target="{A;B}")
panel_11 = Panel(listtotree_2)
remap_numbers = RemapNumbers(Value=uptake_to_speed.tree, Source=bounds, Target=Domain(0, 1))  # -> Mapped, Clipped
gradient = Gradient(LowerLimit=0, UpperLimit=1, Parameter=remap_numbers.Mapped, stops=[0: RGB(0, 128, 0), 1: RGB(255, 0, 0)])

# ---- group: State Data / slices viz
slice_no = Slider(10, range=0..190)
selecttreesecondbranchonly = GhPythonScript(tree=listtotree_2, selection=slice_no)  # -> tree_output; inputs tree: tree
# ---------- selecttreesecondbranchonly: Python ----------
__author__ = "Flora"
__version__ = "2021.01.18"

import rhinoscriptsyntax as rs

#Created By piac
#from https://gist.github.com/piac/ef91ac83cb5ee92a1294
def list_to_tree(input, none_and_holes=True, source=[0]):
    """Transforms nestings of lists or tuples to a Grasshopper DataTree"""
    from Grasshopper import DataTree as Tree
    from Grasshopper.Kernel.Data import GH_Path as Path
    from System import Array
    def proc(input,tree,track):
        path = Path(Array[int](track))
        if len(input) == 0 and none_and_holes: tree.EnsurePath(path); return
        for i,item in enumerate(input):
            if hasattr(item, '__iter__'): #if list or tuple
                track.append(i); proc(item,tree,track); track.pop()
            else:
                if none_and_holes: tree.Insert(item,path,i)
                elif item is not None: tree.Add(item,path)
    if input is not None: t=Tree[object]();proc(input,t,source[:]);return t

#Created By piac
#from https://gist.github.com/piac/ef91ac83cb5ee92a1294
# written by Giulio Piacentino, giulio@mcneel.com
def tree_to_list(input, retrieve_base = lambda x: x[0]):
    """Returns a list representation of a Grasshopper DataTree"""
    def extend_at(path, index, simple_input, rest_list):
        target = path[index]
        if len(rest_list) <= target: rest_list.extend([None]*(target-len(rest_list)+1))
        if index == path.Length - 1:
            rest_list[target] = list(simple_input)
        else:
            if rest_list[target] is None: rest_list[target] = []
            extend_at(path, index+1, simple_input, rest_list[target])
    all = []
    for i in range(input.BranchCount):
        path = input.Path(i)
        extend_at(path, 0, input.Branch(path), all)
    return retrieve_base(all)

#tree=tree


#path1=[]
#for i in range(tree.BranchCount):
#    
#    path = tree.Path(i)
#    if len(path)>1 and path[1]=
#    
#    #print(path[1,-1])
#    print(path)
#    print(path[2])
#    #extend_at(path, 1, input.Branch(path), path1)


tree_output=[]
for i in range(tree.BranchCount):
    path = tree.Path(i)
    
    #print(str(path[1]) +" "+str(int(selection)))
    
    if str(path[1])==str(int(selection)):
        print(path[1])
        subTree=[]
        print(i)
        for ii in tree.Branch(i):
            subTree.append(ii)

        tree_output.append(subTree)

tree_output=list_to_tree(tree_output)
# ---------- end selecttreesecondbranchonly ----------
multiplylist_2 = GhPythonScript(selection=slice_no, tree=selecttreesecondbranchonly, list=gradient)  # -> tree_output, multipliedList; inputs tree: tree, list: list
# ---------- multiplylist_2: Python ----------
__author__ = "Flora"
__version__ = "2021.01.18"

import rhinoscriptsyntax as rs

#Created By piac
#from https://gist.github.com/piac/ef91ac83cb5ee92a1294
def list_to_tree(input, none_and_holes=True, source=[0]):
    """Transforms nestings of lists or tuples to a Grasshopper DataTree"""
    from Grasshopper import DataTree as Tree
    from Grasshopper.Kernel.Data import GH_Path as Path
    from System import Array
    def proc(input,tree,track):
        path = Path(Array[int](track))
        if len(input) == 0 and none_and_holes: tree.EnsurePath(path); return
        for i,item in enumerate(input):
            if hasattr(item, '__iter__'): #if list or tuple
                track.append(i); proc(item,tree,track); track.pop()
            else:
                if none_and_holes: tree.Insert(item,path,i)
                elif item is not None: tree.Add(item,path)
    if input is not None: t=Tree[object]();proc(input,t,source[:]);return t

#Created By piac
#from https://gist.github.com/piac/ef91ac83cb5ee92a1294
# written by Giulio Piacentino, giulio@mcneel.com
def tree_to_list(input, retrieve_base = lambda x: x[0]):
    """Returns a list representation of a Grasshopper DataTree"""
    def extend_at(path, index, simple_input, rest_list):
        target = path[index]
        if len(rest_list) <= target: rest_list.extend([None]*(target-len(rest_list)+1))
        if index == path.Length - 1:
            rest_list[target] = list(simple_input)
        else:
            if rest_list[target] is None: rest_list[target] = []
            extend_at(path, index+1, simple_input, rest_list[target])
    all = []
    for i in range(input.BranchCount):
        path = input.Path(i)
        extend_at(path, 0, input.Branch(path), all)
    return retrieve_base(all)

#tree=tree


#path1=[]
#for i in range(tree.BranchCount):
#    
#    path = tree.Path(i)
#    if len(path)>1 and path[1]=
#    
#    #print(path[1,-1])
#    print(path)
#    print(path[2])
#    #extend_at(path, 1, input.Branch(path), path1)

multipliedList=[]
tree_output=[]
for i in range(tree.BranchCount):
    path = tree.Path(i)
    subList=[]
    subTree=[]
    print(i)
    for ii in tree.Branch(i):
        print(path)
        subList.append(list[int(selection)])
        subTree.append(ii)
    multipliedList.append(subList)
    tree_output.append(subTree)

tree_output=list_to_tree(tree_output)
multipliedList=list_to_tree(multipliedList)
# ---------- end multiplylist_2 ----------
cloud_display_6 = CloudDisplay(Points=multiplylist_2.tree_output, Colours=multiplylist_2.multipliedList, Size=0.8, SpriteType=0)

# ---- group: State Data / SelectTreeBranch
tree_statistics = TreeStatistics(Tree=listtotree_2)  # -> Paths, Length, Count
list_item_7 = ListItem(List=tree_statistics.Paths, Index=number_slider, Wrap=True)
tree_branch = TreeBranch(Tree=listtotree_2, Path=list_item_7, MaintainPaths=True)

# ---- group: State Data / To develop averages
multiplylist_3 = GhPythonScript(tree=listtotree_2, list=gradient)  # -> tree_output, multipliedList; inputs tree: tree, list: list
# ---------- multiplylist_3: Python ----------
__author__ = "Flora"
__version__ = "2021.01.18"

import rhinoscriptsyntax as rs

#Created By piac
#from https://gist.github.com/piac/ef91ac83cb5ee92a1294
def list_to_tree(input, none_and_holes=True, source=[0]):
    """Transforms nestings of lists or tuples to a Grasshopper DataTree"""
    from Grasshopper import DataTree as Tree
    from Grasshopper.Kernel.Data import GH_Path as Path
    from System import Array
    def proc(input,tree,track):
        path = Path(Array[int](track))
        if len(input) == 0 and none_and_holes: tree.EnsurePath(path); return
        for i,item in enumerate(input):
            if hasattr(item, '__iter__'): #if list or tuple
                track.append(i); proc(item,tree,track); track.pop()
            else:
                if none_and_holes: tree.Insert(item,path,i)
                elif item is not None: tree.Add(item,path)
    if input is not None: t=Tree[object]();proc(input,t,source[:]);return t

#Created By piac
#from https://gist.github.com/piac/ef91ac83cb5ee92a1294
# written by Giulio Piacentino, giulio@mcneel.com
def tree_to_list(input, retrieve_base = lambda x: x[0]):
    """Returns a list representation of a Grasshopper DataTree"""
    def extend_at(path, index, simple_input, rest_list):
        target = path[index]
        if len(rest_list) <= target: rest_list.extend([None]*(target-len(rest_list)+1))
        if index == path.Length - 1:
            rest_list[target] = list(simple_input)
        else:
            if rest_list[target] is None: rest_list[target] = []
            extend_at(path, index+1, simple_input, rest_list[target])
    all = []
    for i in range(input.BranchCount):
        path = input.Path(i)
        extend_at(path, 0, input.Branch(path), all)
    return retrieve_base(all)

#tree=tree


#path1=[]
#for i in range(tree.BranchCount):
#    
#    path = tree.Path(i)
#    if len(path)>1 and path[1]=
#    
#    #print(path[1,-1])
#    print(path)
#    print(path[2])
#    #extend_at(path, 1, input.Branch(path), path1)

multipliedList=[]
tree_output=[]
for i in range(tree.BranchCount):
    path = tree.Path(i)
    subList=[]
    subTree=[]
    print(i)
    for ii in tree.Branch(i):
        subList.append(list[path[1]])
        subTree.append(ii)
    multipliedList.append(subList)
    tree_output.append(subTree)

tree_output=list_to_tree(tree_output)
multipliedList=list_to_tree(multipliedList)
# ---------- end multiplylist_3 ----------
cloud_display_7 = CloudDisplay(Points=multiplylist_3.tree_output, Colours=multiplylist_3.multipliedList, Size=0.7, SpriteType=0)

# ---- group: State Data (continued)
panel_12 = Panel(tree_branch)

# ==== cluster StateReader
path = ClusterInput()
index = ClusterInput()
ghpython_script = GhPythonScript(path=path)  # -> out, contents
# ---------- ghpython_script: Python ----------
__author__ = "Flora"
__version__ = "2021.04.13"

import rhinoscriptsyntax as rs
contents = []
with open(path, 'r') as fp:
    #contents = fp.read()
    for cnt, line in enumerate(fp):
        contents.append(line)


fp.close()
# ---------- end ghpython_script ----------
num = Number(0)
cull_i = CullIndex(List=ghpython_script.contents, Indices=num, Wrap=True)
split = TextSplit(Text=cull_i, Separators=",")

state = ListItem(List=split, Index="8", Wrap=True)  # -> flatten(Item)
create_set = CreateSet(List=state)  # -> Set, Map
list_item = ListItem(List=create_set.Set, Index=index, Wrap=True)
find_aa_index = GhPythonScript(input=state, search=list_item)  # -> output; inputs input: list
# ---------- find_aa_index: Python ----------
__author__ = "Flora"
__version__ = "2020.10.27"

import rhinoscriptsyntax as rs

output=[]

for i in range(len(input)):
    if input[i] == search: #.find(search)!=-1:
        #print (input[i])
        output.append(i)
# ---------- end find_aa_index ----------
list_item_2 = ListItem(List=state, Index=find_aa_index, Wrap=True)  # -> flatten(Item)
states = Text(create_set.Set)
states_2 = ClusterOutput(states)

exposure = ListItem(List=split, Index="3", Wrap=True)  # -> flatten(Item)
list_item_3 = ListItem(List=exposure, Index=find_aa_index, Wrap=True)  # -> flatten(Item)
create_set_2 = CreateSet(List=list_item_3)  # -> Set, Map
exposures = Panel(create_set_2.Set)

end_aa = ListItem(List=split, Index="2", Wrap=True)  # -> flatten(Item)
start_aa = ListItem(List=split, Index="1", Wrap=True)  # -> flatten(Item)
centre = ListItem(List=split, Index="10", Wrap=True)  # -> flatten(Item)
exposure_2 = ListItem(List=split, Index="9", Wrap=True)  # -> flatten(Item)
uptake = ListItem(List=split, Index="12", Wrap=True)  # -> flatten(Item)
list_item_4 = ListItem(List=start_aa, Index=find_aa_index, Wrap=True)  # -> flatten(Item)
list_item_5 = ListItem(List=end_aa, Index=find_aa_index, Wrap=True)  # -> flatten(Item)
list_item_6 = ListItem(List=exposure_2, Index=find_aa_index, Wrap=True)  # -> flatten(Item)
list_item_7 = ListItem(List=centre, Index=find_aa_index, Wrap=True)  # -> flatten(Item)
list_item_8 = ListItem(List=uptake, Index=find_aa_index, Wrap=True)  # -> flatten(Item)

create_set_3 = CreateSet(List=list_item_6)  # -> Set, Map
list_length = ListLength(List=create_set_3.Set)
find_aa_index_2 = GhPythonScript(input=exposure_2, array_length=list_length, list=list_item_3, search=create_set_2.Set)  # -> filtered_list, badindex; inputs input: list, list: list, search: list
# ---------- find_aa_index_2: Python ----------
__author__ = "Flora"
__version__ = "2020.10.27"

import rhinoscriptsyntax as rs


"""searches for anomalies missed exposure values and stores the index of the
the slice that is not complete. 
"""

output=[]


doublearray = []
darrayid=[]

for i in range(len(search)):
    Matrix = []
    arrayid= []
    for j in range (len(list)):
        if  (list[j] == search[i]):
            Matrix.append(input[j])
            arrayid.append(j)
    doublearray.append(Matrix)
    darrayid.append(arrayid)

filtered_list = []

useless_index = []
for item in doublearray:
    if len(item) == array_length:
        filtered_list.append(item)
    else: useless_index.append(doublearray.index(item))


badindex=[]
for i in range(len(useless_index)):
    list_useless_ids = darrayid[useless_index[i]]
    #print (darrayid[useless_index[i]])
    for j in range (len(list_useless_ids)):
        badindex.append(list_useless_ids[j])

print badindex
        #one
        


if (useless_index): #(checks if list is empty)
    assert (len(doublearray[useless_index[0]]) != array_length)

for item in filtered_list:
    assert (len(item) == array_length)
# ---------- end find_aa_index_2 ----------
cull_index = CullIndex(List=list_item_7, Indices=find_aa_index_2.badindex, Wrap=True)
cull_index_2 = CullIndex(List=list_item_8, Indices=find_aa_index_2.badindex, Wrap=True)
cull_index_3 = CullIndex(List=list_item_6, Indices=find_aa_index_2.badindex, Wrap=True)
cull_index_4 = CullIndex(List=list_item_5, Indices=find_aa_index_2.badindex, Wrap=True)
cull_index_5 = CullIndex(List=list_item_4, Indices=find_aa_index_2.badindex, Wrap=True)
cull_index_6 = CullIndex(List=list_item_3, Indices=find_aa_index_2.badindex, Wrap=True)

exposure_3 = Number(cull_index_3)
uptake_2 = Number(cull_index_2)
centre_2 = Number(cull_index)
start_aa_2 = Number(cull_index_5)
end_aa_2 = Number(cull_index_4)
exposure_4 = ClusterOutput(exposure_3)
centre_3 = ClusterOutput(centre_2)
start_aa_3 = ClusterOutput(start_aa_2)
end_aa_3 = ClusterOutput(end_aa_2)
uptake_3 = ClusterOutput(uptake_2)

sequence = Text(cull_index_6)
sequence_2 = ClusterOutput(sequence)

# ==== cluster Cluster
tree = ClusterInput()
tree_statistics = TreeStatistics(Tree=tree)  # -> Paths, Length, Count
domain = ClusterInput()
sub_list = SubList(List=tree_statistics.Paths, Domain=domain, Wrap=True)  # -> List, Index
tree_branch = TreeBranch(Tree=tree, Path=sub_list.List, MaintainPaths=True)
branch = ClusterOutput(tree_branch)

# ==== cluster ProteinRibbon: visualizes the structure of a protein
path_to_pdb_file = ClusterInput()
location = ClusterInput()
threshold_count = ClusterInput()  # threshold count for # consequtive residues for seconary structure
threshold_angle_α_vs_β = ClusterInput()  # in radians
alpha_helix_color = ClusterInput()
beta_sheet_color = ClusterInput()
loop_color = ClusterInput()
path = FilePath(path_to_pdb_file)

# ---- group: parsing if PDB file
file = ReadFile(File=path, PerLineParse=True)
split = TextSplit(Text=file, Separators="A")
item = ListItem(List=split, Index=-1, Wrap=True)
trim = TextTrim(Text=item, Start=True, End=True)
split_2 = TextSplit(Text=trim, Separators=" ")
pdb = ImportPDB(File=path)  # -> Atoms, Bonds

# ---- group: parsing if PDB data
split_3 = TextSplit(Text=path, Separators="A")
item_2 = ListItem(List=split_3, Index=-1, Wrap=True)
trim_2 = TextTrim(Text=item_2, Start=True, End=True)
split_4 = TextSplit(Text=trim_2, Separators=" ")
num = Number(split_4)
clean = CleanTree(RemoveNulls=True, RemoveInvalid=True, RemoveEmpty=True, Tree=num)
item_3 = ListItem(List=clean, Index=1, Wrap=True)  # -> Item, Item1, Item2
pt = ConstructPoint(XCoordinate=item_3.Item, YCoordinate=item_3.Item1, ZCoordinate=item_3.Item2)  # -> flatten(Point)

# ---- group: is it a PDB file or PDB data?
null = NullItem(Item=file)  # -> NullFlags, InvalidFlags, Description
item_4 = ListItem(List=flatten(null.NullFlags), Index=0, Wrap=True)
filter = StreamFilter(Gate=item_4, Stream0=split_2, Stream1=split_4)
filter_2 = StreamFilter(Gate=item_4, Stream0=pdb.Atoms, Stream1=pt)

# ----
# Secondary structure creation via DSSP algorithm in Grasshopper. (Needs reviewing)
# Modified ALBA plug-in.
aapoints = ClusterInput()

# ---- group: reduce all atom points to AA residue points
item_5 = ListItem(List=filter, Index=0, Wrap=True)
int = Integer(item_5)
clean_2 = CleanTree(RemoveNulls=True, RemoveInvalid=True, RemoveEmpty=True, Tree=int)
subtraction = Subtraction(A=clean_2, B=1)
tstat = TreeStatistics(Tree=graft(filter_2))  # -> Paths, Length, Count
path_2 = ConstructPath(Indices=subtraction)  # -> flatten(Branch)
replace = ReplacePaths(Data=graft(filter_2), Search=tstat.Paths, Replace=path_2)
pt_2 = Point(aapoints)
item_6 = ListItem(List=pt_2, Index=0, Wrap=True)

# ---- group: create a polyline from the AA residue points and analize angles to find helixes
pline = PolyLine(Vertices=flatten(item_6), Closed=False)
disc = Discontinuity(Curve=pline, Level=1)  # -> Points, Parameters
eval = EvaluateCurve(Curve=pline, Parameter=disc.Parameters)  # -> Point, Tangent, Angle
ta = Number(threshold_angle_α_vs_β)
larger = LargerThan(FirstNumber=eval.Angle, SecondNumber=ta)  # -> LargerThan, OrEqualTo

# ---- group: domains of secondary structures
lng = ListLength(List=larger.LargerThan)
shift = ShiftList(List=larger.LargerThan, Shift=1, Wrap=True)
series = Series(Start=0, Step=1, Count=lng)
equals = Equality(FirstNumber=larger.LargerThan, SecondNumber=shift)  # -> Equality, Inequality
int_2 = Integer(series)
subtraction_2 = Subtraction(A=lng, B=1)
dispatch = Dispatch(List=int_2, DispatchPattern=equals.Equality)  # -> ListA, ListB
ins = InsertItems(List=dispatch.ListB, Item=subtraction_2, Indices=-1, Wrap=True)
ins_2 = InsertItems(List=ins, Item=0, Indices=0, Wrap=True)
consec = ConsecutiveDomains(Numbers=ins_2, Additive=False)

# ---- group: break ribbon into secondary structures / determine sizes of secondary structure to distinguish between 1) alpha helixes and beta sheets or 2) loops
dedomain = DeconstructDomain(Domain=consec)  # -> Start, End
subtraction_3 = Subtraction(A=dedomain.End, B=dedomain.Start)
tc = Number(threshold_count)
larger_2 = LargerThan(FirstNumber=subtraction_3, SecondNumber=tc)  # -> LargerThan, OrEqualTo

# ---- group: break ribbon into secondary structures / points divided into secondary structure
subset = SubList(List=flatten(item_6), Domain=consec, Wrap=True)  # -> List, Index

# ----
tweek_orientation = Slider(0, range=0..10)

# ---- group: seperate helixes from sheets / is this the domain of an alpha helix?
dedomain_2 = DeconstructDomain(Domain=consec)  # -> Start, End
dom = ConstructDomain(DomainStart=expr("x+1", dedomain_2.Start), DomainEnd=dedomain_2.End)
subset_2 = SubList(List=flatten(larger.LargerThan), Domain=dom, Wrap=True)  # -> List, Index
item_7 = ListItem(List=subset_2.List, Index=0, Wrap=True)

# ----
pln = Plane(location)

# ---- group: seperate helixes and sheets from loops
dispatch_2 = Dispatch(List=subset.List, DispatchPattern=graft(larger_2.LargerThan))  # -> ListA, ListB

# ---- group: seperate helixes from sheets
dispatch_3 = Dispatch(List=dispatch_2.ListA, DispatchPattern=item_7)  # -> ListA, ListB

# ----
loop_points = Point(dispatch_2.ListB)
alph_helix_points = Point(dispatch_3.ListA)
beta_sheet_points = Point(dispatch_3.ListB)

intcrv = Interpolate(Vertices=beta_sheet_points, Degree=3, Periodic=False, KnotStyle=1)  # -> Curve, Length, Domain
intcrv_2 = Interpolate(Vertices=alph_helix_points, Degree=3, Periodic=False, KnotStyle=1)  # -> Curve, Length, Domain
intcrv_3 = Interpolate(Vertices=loop_points, Degree=3, Periodic=False, KnotStyle=1)  # -> Curve, Length, Domain
merge = Merge(Data1=intcrv_2.Curve, Data2=intcrv.Curve, Data3=intcrv_3.Curve)  # -> simplify(Result)
curve = ClusterOutput(merge)

clean_3 = CleanTree(RemoveNulls=True, RemoveInvalid=True, RemoveEmpty=True, Tree=intcrv_3.Curve)  # -> simplify(Tree)

# ---- group: loops
pipe = Pipe(Curve=clean_3, Radius=Slider(0.24, range=0..1), Caps=2)  # -> simplify(Pipe)
L = Shader(loop_color)
preview = CustomPreview(Geometry=pipe, Shader=L)

# ---- group: script that hides all outputs
c_script = CSharpScript()  # -> out; inputs Trigger: tree
# ---------- c_script: C# ----------
    // No code needed here.
# ---------- c_script: C# additional code ----------
  /// <summary>
  /// This method will be called once every solution, before any calls to RunScript.
  /// </summary>
  public override void BeforeRunScript()
  {
    if (GrasshopperDocument == null)
      return;
    
    // Get the owner (if any) of this document.
    IGH_DocumentOwner owner = GrasshopperDocument.Owner;
    if (owner == null)
      return;

    // See if the object owning this document is a cluster.
    IGH_Component cluster = owner as IGH_Component;
    if (cluster == null)
      return;

    // Iterate over all outputs.
    foreach (IGH_Param param in cluster.Params.Output)
    {
      IGH_PreviewObject previewParameter = param as IGH_PreviewObject;
      if (previewParameter != null)
        previewParameter.Hidden = true;
    }
  }
# ---------- end c_script ----------

# ---- group: orient the protein with the first helix or sheet aligned to the Z axis, with the midddle AA residue at the origin, and the middle AA residue of the last helix or sheet on the X axis / determine orientation
dispatch_4 = Dispatch(List=subset.List, DispatchPattern=graft(larger_2.LargerThan))  # -> ListA, ListB
clean_4 = CleanTree(RemoveNulls=True, RemoveInvalid=True, RemoveEmpty=True, Tree=dispatch_4.ListA)
browse = BranchBrowser(T=clean_4, i=tweek_orientation)
item_8 = ListItem(List=flatten(browse), Index=-1, Wrap=True)

# ----
lng_2 = ListLength(List=browse)  # -> expr("x/2", Length)

# ---- group: orient the protein with the first helix or sheet aligned to the Z axis, with the midddle AA residue at the origin, and the middle AA residue of the last helix or sheet on the X axis / determine orientation (continued)
item_9 = ListItem(List=flatten(browse), Index=lng_2, Wrap=True)

# ----
vec2pt = Vector2Pt(PointA=item_9, PointB=item_8, Unitize=False)  # -> Vector, Length
pl = PlaneNormal(Origin=item_9, ZAxis=vec2pt.Vector)

# ---- group: orient the protein with the first helix or sheet aligned to the Z axis, with the midddle AA residue at the origin, and the middle AA residue of the last helix or sheet on the X axis / orient AA residues
orient = Orient(Geometry=subset.List, Source=pl, Target=pln)  # -> Geometry, Transform
simplify = SimplifyTree(Tree=orient.Geometry, Front=False)
amino_acid_residue_points = ClusterOutput(simplify)

# ---- group: orient the protein with the first helix or sheet aligned to the Z axis, with the midddle AA residue at the origin, and the middle AA residue of the last helix or sheet on the X axis / orient atoms
orient_2 = Orient(Geometry=pt_2, Source=pl, Target=pln)  # -> simplify(Geometry), Transform
all_atom_points = ClusterOutput(orient_2.Geometry)

# ---- group: beta sheets
clean_5 = CleanTree(RemoveNulls=True, RemoveInvalid=True, RemoveEmpty=True, Tree=intcrv.Curve)  # -> simplify(Tree)

curvepoint = PointOnCurve(clean_5, parameter=0.5)
shift_2 = ShiftList(List=flatten(curvepoint), Shift=1, Wrap=True)  # -> graft(List)
vec2pt_2 = Vector2Pt(PointA=curvepoint, PointB=shift_2, Unitize=False)  # -> Vector, Length
pframe = PerpFrame(Curve=clean_5, Parameter=Slider(0, range=0..0.01))
align = AlignPlane(Plane=pframe, Direction=vec2pt_2.Vector)  # -> Plane, Angle

len = Length(Curve=clean_5)
subtraction_4 = Subtraction(A=len, B=Slider(2, range=0..10))

rectangle = Rectangle(Plane=align.Plane, XSize=Domain(-1.25, 1.25), YSize=Domain(-0.25, 0.25), Radius=0.1)  # -> Rectangle, Length
subcrv = SubCurve(BaseCurve=clean_5, Domain=subtraction_4)
swp1 = Sweep1(Rail=subcrv, Sections=rectangle.Rectangle, Miter=1)  # -> simplify(Brep)
edges = BrepEdges(Brep=swp1)  # -> Naked, Interior, NonManifold
item_10 = ListItem(List=edges.Naked, Index=0, Wrap=True)
offset_out = OffsetOut(curve=item_10, distance_or_xylinus_config=Slider(0.4, range=0..1))
end = EndPoints(Curve=clean_5)  # -> Start, End
extr = ExtrudePoint(Base=offset_out, Point=end.End)  # -> simplify(Extrusion)
β = Shader(beta_sheet_color)
cap = CapHoles(Brep=simplify([swp1, extr]))
sunion = SolidUnion(Breps=cap)

preview_2 = CustomPreview(Geometry=sunion, Shader=β)

# ---- group: alpha helices
clean_6 = CleanTree(RemoveNulls=True, RemoveInvalid=True, RemoveEmpty=True, Tree=intcrv_2.Curve)  # -> simplify(Tree)
pframe_2 = PerpFrame(Curve=clean_6, Parameter=0)
rectangle_2 = Rectangle(Plane=pframe_2, XSize=Domain(-0.25, 0.25), YSize=Domain(-1.25, 1.25), Radius=0.2)  # -> Rectangle, Length
α = Shader(alpha_helix_color)

# ----
extrcrv = ExtrudeAlong(Base=rectangle_2.Rectangle, Curve=clean_6)
cap_2 = CapHoles(Brep=extrcrv)  # -> simplify(Brep)

# ---- group: alpha helices (continued)
preview_3 = CustomPreview(Geometry=cap_2, Shader=α)

# ----
entwine = Entwine(Branch00=cap_2, Branch01=sunion, Branch02=pipe, FlattenInputs=True)
geo = Geometry(entwine)
ribbon = ClusterOutput(geo)

# ==== cluster Cluster_2
panel = Panel("""0
1
2""")
ui_elements = ClusterInput()
create_grid = CreateGrid(
    UIElements=ui_elements,
    RowDefinitions=[Slider(37, range=0..1000), Slider(37, range=0..1000), Slider(53, range=0..400)],
    ColumnDefinitions=Slider(211, range=0..1000),
    ElementRow=panel,
    ElementRowSpan=1,
    ElementColumnSpan=1)
grid = ClusterOutput(create_grid)

# ==== cluster PDB_Reader
pdb_path = ClusterInput()

# ---- group: PDB Reader
# Component to read a PDB file
# and output each item seperately
pdb_path_2 = FilePath(pdb_path)
read_file_universal = GhPythonScript(path=pdb_path_2)  # -> out, contents
# ---------- read_file_universal: Python ----------
"""An alternative to "read file" gh component, for Mac.
    Inputs:
        path: path of file
    Output:
        contents: output file in txt"""

__author__ = "Flora"
__version__ = "2021.04.13"

import rhinoscriptsyntax as rs
contents = []

try:
    with open(path, 'r') as fp:
        #contents = fp.read()
        for cnt, line in enumerate(fp):
            contents.append(line)
except:
    e = gh.GH_RuntimeMessageLevel.Warning
    ghenv.Component.AddRuntimeMessage(e, "Grasshopper cannot read lines in file: try 'read file component'")

fp.close()
# ---------- end read_file_universal ----------
filter_dbd = GhPythonScript(PDB=read_file_universal.contents)  # -> P, TER
# ---------- filter_dbd: Python ----------
"""Script to clean PDB files.
    Inputs:
        x: The x script variable
        y: The y script variable
    Output:
        a: The a P variable"""

__author__ = "Flora"
__version__ = "2020.10.23"

import rhinoscriptsyntax as rs

PDB = PDB.replace("            ",",")
PDB = PDB.replace("           ",",")
PDB = PDB.replace("          ",",")
PDB = PDB.replace("         ",",")
PDB = PDB.replace("        ",",")
PDB = PDB.replace("       ",",")
PDB = PDB.replace("      ",",")
PDB = PDB.replace("     ",",")
PDB = PDB.replace("    ",",")
PDB = PDB.replace("   ",",")
PDB = PDB.replace("  ",",")
PDB = PDB.replace(" ",",")
#PDB = PDB.replace("TER,","")

if PDB.find("TER"):
    P = PDB
# ---------- end filter_dbd ----------
num = Number([-1, -2])
cull_i = CullIndex(List=filter_dbd.P, Indices=num, Wrap=True)
split = TextSplit(Text=cull_i, Separators=",")

# ---- group: AA_id
amino_acid_id = ListItem(List=split, Index="0", Wrap=True)  # -> flatten(Item)

# ---- group: PDB Reader / Atoms_XYZ
z = ListItem(List=split, Index="8", Wrap=True)  # -> flatten(Item)
y = ListItem(List=split, Index="7", Wrap=True)  # -> flatten(Item)
x = ListItem(List=split, Index="6", Wrap=True)  # -> flatten(Item)
num_2 = Number(z)
num_3 = Number(y)
num_4 = Number(x)
pt = ConstructPoint(XCoordinate=num_4, YCoordinate=num_3, ZCoordinate=num_2)

# ---- group: PDB Reader / Atoms_name
item = ListItem(List=split, Index="2", Wrap=True)  # -> flatten(Item)
atoms_name = Text(item)

# ---- group: PDB Reader / AA_name
item_2 = ListItem(List=split, Index="3", Wrap=True)  # -> flatten(Item)
aa_name = Text(item_2)

# ---- group: PDB Reader / Atoms_order
atom_order = ListItem(List=split, Index="1", Wrap=True)  # -> flatten(Item)
atom_id = Number(atom_order)

# ---- group: PDB Reader / AA_id
amino_acid_id_2 = ListItem(List=split, Index="5", Wrap=True)  # -> flatten(Item)
aa_id = Number(amino_acid_id_2)

# ----
amino_acid_id_3 = ListItem(List=split, Index="9", Wrap=True)  # -> flatten(Item)
atom = Text(amino_acid_id_3)
atom_2 = Text(amino_acid_id)
atoms_name_2 = ClusterOutput(atoms_name)
atom_id_2 = ClusterOutput(atom_id)
aa_name_2 = ClusterOutput(aa_name)
atom_3 = ClusterOutput(atom)
aa_id_2 = ClusterOutput(aa_id)
atom_4 = ClusterOutput(atom_2)
xyz_point = ClusterOutput(pt)

# ==== cluster Cluster_3
aa_range = ClusterInput()
aa_range_2 = Domain(aa_range)
tree = ClusterInput()
tree_2 = ClusterInput()
cluster = Cluster(tree=tree, domain=aa_range_2)
cluster_2 = Cluster(tree=tree_2, domain=aa_range_2)
find_aa_index = GhPythonScript(input=cluster, search="C")  # -> output; inputs input: list; same code as find_aa_index
find_aa_index_2 = GhPythonScript(input=cluster, search="CA")  # -> output; inputs input: list; same code as find_aa_index
find_aa_index_3 = GhPythonScript(input=cluster, search="N")  # -> output; inputs input: list; same code as find_aa_index
list_item = ListItem(List=cluster_2, Index=find_aa_index, Wrap=True)  # -> flatten(Item)
list_item_2 = ListItem(List=cluster_2, Index=find_aa_index_2, Wrap=True)  # -> flatten(Item)
list_item_3 = ListItem(List=cluster_2, Index=find_aa_index_3, Wrap=True)  # -> flatten(Item)
i = ClusterOutput(list_item)
i_2 = ClusterOutput(list_item_2)
i_3 = ClusterOutput(list_item_3)

# ==== cluster Cluster_4
atoms_name_list = ClusterInput()
aa_name_list = ClusterInput()
atoms_xyz_list = ClusterInput()
sidechains = GhPythonScript(AA_name_list=aa_name_list, atoms_name_list=atoms_name_list, atoms_xyz_list=atoms_xyz_list)  # -> out, AA_name, start, end, atom_names, atom_xyz; inputs AA_name_list: list, atoms_name_list: list, atoms_xyz_list: list
# ---------- sidechains: Python ----------
__author__ = "Flora"
__version__ = "2020.10.28"

"""
Provides a scripting component.
    Inputs:
        AA: Amino Acid id number (int list)
        AA_name: Amino Acid name (string list)
        xyz: coordinates in 3Dspace per atom (3d point rhino item)
        atoms: atom names (string list)
    Output:
        a: xyz coordinates for debug
        start: list of coordinates of all atoms per AA (for starting points of lines) 
        end: list of coordinates of all atoms per AA (for ending poins of lines)
"""


import rhinoscriptsyntax as rs


sidechains_dict = {
"GLN":{"A": ["C","C","CA","CA","CB","CG","CD","CD"],
    "B":["O","CA","N","CB","CG","CD","NE2","OE1"]},
"GLU":{"A": ["C","C","CA","CA","CB","CG","CD","CD"],
    "B":["O","CA","N","CB","CG","CD","OE2","OE1"]},
"LYS":{"A": ["C","C","CA","CA","CB","CG","CD","CE"],
    "B": ["O","CA","N","CB","CG","CD","CE","NZ"]},
"ARG":{"A":["C","C","CA","CA","CB","CG","CD","NE","CZ","CZ"],
    "B": ["O","CA","N","CB","CG","CD","NE","CZ","NH1","NH2"]},
"ILE":{"A": ["C","C","CA","CA","CB","CB","CG1"],
    "B": ["O","CA","N","CB","CG1","CG2","CD1"]},
"SER":{"A": ["C","C","CA","CA","CB"],
    "B": ["O","CA","N","CB","OG"]},
"VAL":{"A": ["C","C","CA","CA","CB","CB"],
    "B": ["O","CA","N","CB","CG2","CG1"]},
"HIS": {"A": ["C","C","CA","CA","CB","CG","CG","CD2","CE1","ND1"], 
    "B": ["O","CA","N","CB","CG","ND1","CD2","NE2","NE2","CE1"]},
"GLY":{"A":["C","C","CA"],
    "B": ["O","CA","N"]},
"LEU":{"A": ["C","C","CA","CA","CB","CG","CG"],
    "B": ["O","CA","N","CB","CG","CD1","CD2"]},
"ALA":{"A": ["C","C","CA","CA"],
    "B": ["O","CA","N","CB"]},
"ASN":{"A": ["C","C","CA","CA","CB","CG","CG"],
    "B": ["O","CA","N","CB","CG","OD1","ND2"]},
"THR":{"A": ["C","C","CA","CA","CB","CB"],
    "B": ["O","CA","N","CB","CG2","OG1"]},
"PRO":{"A": ["C","C","CA","CA","CB","CG","CD"],
    "B": ["O","CA","N","CB","CG","CD","N"]},
"ASP":{"A":["C","C","CA","CA","CB","CG","CG"],
    "B": ["O","CA","N","CB","CG","OD1","OD2"]},
"TYR":{"A": ["C","C","CA","CA","CB","CG","CG","CD1","CD2","CE1","CE2","CZ"],
    "B": ["O","CA","N","CB","CG","CD1","CD2","CE1","CE2","CZ","CZ","OH"]},
"PHE":{"A": ["C","C","CA","CA","CB","CG","CG","CD1","CD2","CE1","CE2"],
    "B": ["O","CA","N","CB","CG","CD1","CD2","CE1","CE2","CZ","CZ"]},
"TRP":{"A": ["C","C","CA","CA","CB","CG","CG","CD1","CD2","NE1","CD2","CE2","CE3","CZ3","CH2"], 
    "B": ["O","CA","N","CB","CG","CD2","CD1","NE1","CE2","CE2","CE3","CZ2","CZ3","CH2","CZ2"]},
}


AA_sublist=[]
amino_start =[]
amino_end=[]

atom_names=[]
atom_xyz=[]

def construct_sidechains_points():
    None  #TODO

def construct_sidechains(AA_name_list,atoms_name_list,atoms_xyz_list):

    for i in range (len(AA_name_list)): 
        amino_acid = sidechains_dict.get(AA_name_list[i])
        
        if(amino_acid != None): #if the amino acid exists in the pdb 
            AA_sublist.append(AA_name_list[i])
            
            A = amino_acid.get('A') #get the list of the first points of the AA
            B = amino_acid.get('B') #get the list of the second points of the AA
            atom_list = atoms_name_list[i]
            xyz_list = atoms_xyz_list[i]
            

            #fix beggining and end for lines
            start, end= sidechain(amino_acid,A,B,atom_list,xyz_list)
             
            amino_start.append(start)
            amino_end.append(end)
            
            atom_names.append(atom_list)
            atom_xyz.append(xyz_list)

        else: error = "Amino Acid doesnt exist"

def sidechain(amino_acid,A,B,atom_list,xyz_list):
    start, end=[],[]
    for x in range (len(A)):
        for y in range (len(atom_list)):  
            if (A[x]==atom_list[y]):
                start.append(xyz_list[y])
            if (B[x]==atom_list[y]):
                end.append(xyz_list[y])
    return (start,end)


#Created By piac
#from https://gist.github.com/piac/ef91ac83cb5ee92a1294
def list_to_tree(input, none_and_holes=True, source=[0]):
    """Transforms nestings of lists or tuples to a Grasshopper DataTree"""
    from Grasshopper import DataTree as Tree
    from Grasshopper.Kernel.Data import GH_Path as Path
    from System import Array
    def proc(input,tree,track):
        path = Path(Array[int](track))
        if len(input) == 0 and none_and_holes: tree.EnsurePath(path); return
        for i,item in enumerate(input):
            if hasattr(item, '__iter__'): #if list or tuple
                track.append(i); proc(item,tree,track); track.pop()
            else:
                if none_and_holes: tree.Insert(item,path,i)
                elif item is not None: tree.Add(item,path)
    if input is not None: t=Tree[object]();proc(input,t,source[:]);return t


#sidechain(atoms_xyz_list, amino_names, atoms_name_list)
construct_sidechains(AA_name_list,atoms_name_list,atoms_xyz_list)

atom_names=list_to_tree(atom_names)
atom_xyz=list_to_tree(atom_xyz)
AA_name=list_to_tree(AA_sublist)
start= list_to_tree(amino_start)
end=list_to_tree(amino_end)


#print (atoms_xyz_list)
# ---------- end sidechains ----------
domain = ClusterInput()
cluster = Cluster(tree=sidechains.start, domain=domain)
sub_list = SubList(List=sidechains.AA_name, Domain=domain, Wrap=True)  # -> List, Index
cluster_2 = Cluster(tree=sidechains.atom_names, domain=domain)
cluster_3 = Cluster(tree=sidechains.end, domain=domain)
cluster_4 = Cluster(tree=sidechains.atom_xyz, domain=domain)
stream_gate = StreamGate(Stream=cluster_4, Gate=0)  # -> Target0, Target1
search = ClusterInput()
find_aa_index = GhPythonScript(input=cluster_2, search=search)  # -> output; inputs input: list, search: list
# ---------- find_aa_index: Python ----------
__author__ = "Flora"
__version__ = "2020.10.27"

import rhinoscriptsyntax as rs

output=[]

for i in range(len(input)):
    for j in range(len(search)):
        if input[i] == search[j]: #.find(search)!=-1:
            output.append(i)
# ---------- end find_aa_index ----------
list_item = ListItem(List=stream_gate.Target0, Index=find_aa_index, Wrap=True)  # -> flatten(Item)
pt = Point(list_item)
pline = PolyLine(Vertices=pt, Closed=False)
pt_2 = ClusterOutput(pt)
pl = ClusterOutput(pline)

# ==== cluster Cluster_5
A = ClusterInput()
B = ClusterInput()
dist = Distance(PointA=A, PointB=B)
bounds = Bounds(Numbers=dist)
remap_numbers = RemapNumbers(Value=dist, Source=bounds, Target=Domain(0, 1))  # -> Mapped, Clipped
gradient = Gradient(
    LowerLimit=0,
    UpperLimit=1,
    Parameter=remap_numbers.Mapped,
    stops=[0: RGB(163, 137, 232), 0: RGB(0, 128, 0), 0.384: RGB(255, 255, 0), 1: RGB(255, 0, 0)])
colour = ClusterOutput(gradient)

# ==== cluster Subtract7FirstAAIDNo
I = ClusterInput()
B = ClusterInput()
B_2 = ClusterInput()
dedomain = DeconstructDomain(Domain=I)  # -> Start, End
subtraction = Subtraction(A=dedomain.Start, B=B)
subtraction_2 = Subtraction(A=dedomain.End, B=B_2)
dom = ConstructDomain(DomainStart=subtraction, DomainEnd=subtraction_2)
I_2 = ClusterOutput(dom)

# ==== cluster PDB_Exporter

# ---- group: PDB Reader
# Component to export a PDB file
# from a set of coordinates
pdb_path = ClusterInput()
atoms_id = ClusterInput()
xyz = ClusterInput()
pdb_path_2 = FilePath(pdb_path)
python = GhPythonScript(xyz=xyz, atoms_id=atoms_id)  # -> output, a; inputs xyz: list, atoms_id: list
# ---------- python: Python ----------
"""Module to get a list of transformed atoms coordinates and translate them to PDB
strings.
    Inputs:
        PDB_path: Path to the original PDB
        xyz: a list of the transformed coordinates of the atoms
        atoms_id: a list of the transformed atoms id
    Output:
        an tuple to fit PDB requirements such as: 
        ideal_tuple = ("     ","        ","        ","        ") """

__author__ = "froumpani"
__version__ = "2021.10.24"

import rhinoscriptsyntax as rs

def export_coordinates_to_PDB_tuple (xyz):
    """
    Function to convert coordinates to a readable PDB format
    xyz: double list of coordinates grouped by AA
    """

    #empty list to store the tuple to export as a grasshopper item
    xyz_ = []

    for i in range (len (xyz)):
        for j in range (len(xyz[i])):
            #exclude 'TER' item
            if (xyz[i][j]!= 'Ter'):
                #convert string tuple to float tuple
                xyz_tuple = eval(xyz[i][j])
                _tuple1=()
                # iterate tuple to convert to modified string suitable for 
                # PDB format
                for jj in range (len(xyz_tuple)):
                    fl_= float(xyz_tuple[jj])
                    round_tuple = format(fl_, '.3f')
                    space_ = 8-len(round_tuple)
                    space_tuple = space_*" " + str(round_tuple)
                    _tuple1 = _tuple1 + (space_tuple,)
                str_atoms_id = str(int(atoms_id[i][j]))
                space_id = 5-len(str_atoms_id)
                space_atoms_id = space_id*" "+str_atoms_id
                id_xyz_tuple = (space_atoms_id,) + _tuple1
                # store tuple to xyz_ array
                xyz_.append(id_xyz_tuple)
    return (xyz_)


output = export_coordinates_to_PDB_tuple (xyz)

#for x in range (len())
                
            #split_str = xyz[i][j].split (',')
            
            #xyz_.append(xyz[i][j])
#print (xyz_)


#for i in range (len (xyz)):
#    xyz_ = []
#    for j in range (len(xyz[i])):
#        if (xyz[i][j]!= 'Ter'):
#            xyz_tuple = eval(xyz[i][j])
#            id_int = int(atoms_id[i][j])
#            xyz_.append((id_int,)+xyz_tuple)
#    id_xyz.append(xyz_)

        
        #print (atoms_id[i][j], xyz[i][j])
# ---------- end python ----------
read_file_universal = GhPythonScript(path=pdb_path_2)  # -> out, contents; same code as read_file_universal
filter_dbd = GhPythonScript(PDB=read_file_universal.contents, xyz=python.output)  # -> P, output, TER; inputs PDB: list, xyz: list
#   port output: The a P variable
# ---------- filter_dbd: Python ----------
"""Provides a scripting component for exporting PDBs from a transformation.
    Inputs:
        PDB_path: Path to the original PDB
        xyz: a list of the transformed coordinates of the atoms
        atoms_id: a list of the transformed atoms id
    Output:
        Exported pdb"""

__author__ = "Flora"
__version__ = "2020.10.23"

import rhinoscriptsyntax as rs
import os.path

#print (PDB[0][27:54])
for x in xyz_:
    i=0
    for line in PDB:
        pdb_id = line[6:11]
        if (x[0]==pdb_id):
            PDB[i] = line.replace(line[30:54], x[1]+x[2]+x[3])
        #else:
        #    PDB[i] = line
        i+=1

output = PDB

#atom = PDB[0:6]
#id = PDB[6:11]
#null1= PDB[11:13]
#atom_name = PDB[13:16]
#AA_name = PDB[16:20]
#chain = PDB[20:22]
#AA_no = PDB[22:27]
#x= PDB[27:38]
#y= PDB[38:46]
#z= PDB[46:54]
#rest = PDB[54:]


#for i in range (len(xyz
#    if (xyz)


#PDB = PDB.replace("TER,","")

#if PDB.find("TER"):
#    P = PDB
# ---------- end filter_dbd ----------
python_2 = GhPythonScript(PDB=filter_dbd.output)  # -> out, a; inputs PDB: list
# ---------- python_2: Python ----------
__author__ = "froumpani"
__version__ = "2021.10.28"

import rhinoscriptsyntax as rs


def writefile (path, filename, PDB):

    file = open(path+filename, "wb")
    for line in PDB:
        file.write(line)
    file.close
# ---------- end python_2 ----------

# ==== cluster OffsetOut: Offset curves outward. Use for interior curves.
curve = ClusterInput()  # Curves to offset outwards.
distance_or_xylinus_config = ClusterInput()  # Distance to offset curve. If a config is input, the offset distance will be 1/2 the extrusion width.

# ---- group: if fed a config use 1/2 extrusion width, otherwise pass data
data = Data(distance_or_xylinus_config)
item = ListItem(List=data, Index=0, Wrap=True)
item_2 = ListItem(List=data, Index="3", Wrap=True)
box = Box(item)
division = Division(A=item_2, B=2)
null = NullItem(Item=box)  # -> NullFlags, InvalidFlags, Description
filter = StreamFilter(Gate=null.NullFlags, Stream0=division, Stream1=data)
distance = Number(filter)

# ---- group: interior
crv = Curve(curve)

# ----
number_slider = Slider(2, range=0..4)

# ---- group: run a test offset and check to see if it is bigger
D = Number(distance)
offset = Offset(Curve=crv, Distance=D, Plane=PlaneXY(0, 0, 0), Corners=number_slider)
trim = TrimTree(Tree=offset, Depth=1)
area = Area(Geometry=trim)  # -> Area, Centroid
area_2 = Area(Geometry=crv)  # -> Area, Centroid
larger = LargerThan(FirstNumber=area.Area, SecondNumber=area_2.Area)  # -> LargerThan, OrEqualTo

# ---- group: use test offset to determine the direction of the final offset
D_2 = Number(distance)
long = LongestList(ListA=larger.LargerThan, ListB=D_2, PaddingMode=2)  # -> ListA, ListB
neg = Negative(Value=long.ListB)
p_n_c = PickNChoose(Pattern=larger.LargerThan, Stream0=neg, Stream1=long.ListB)
offset_2 = Offset(Curve=crv, Distance=p_n_c, Plane=PlaneXY(0, 0, 0), Corners=number_slider)
trim_2 = TrimTree(Tree=offset_2, Depth=1)

# ---- group: double check and just ditch what isn't right
area_3 = Area(Geometry=trim_2)  # -> Area, Centroid
area_4 = Area(Geometry=crv)  # -> Area, Centroid
larger_2 = LargerThan(FirstNumber=area_3.Area, SecondNumber=area_4.Area)  # -> LargerThan, OrEqualTo
dispatch = Dispatch(List=trim_2, DispatchPattern=larger_2.LargerThan)  # -> ListA, ListB
crv_2 = Curve(dispatch.ListB)

# ---- group: double check and just ditch what isn't right / good interior offsets
crv_3 = Curve(dispatch.ListA)

# ----
offset_cruves = ClusterOutput(crv_3)

# ==== cluster BranchBrowser: allows you to scroll through the branchs of the tree sequentially using an integer instead of a path
T = ClusterInput()
i = ClusterInput()
tstat = TreeStatistics(Tree=T)  # -> Paths, Length, Count
item = ListItem(List=tstat.Paths, Index=i, Wrap=True)
branch = TreeBranch(Tree=T, Path=item, MaintainPaths=True)
B = ClusterOutput(branch)
