# Grasshopper definition back1.gh (Grasshopper 1.0.7)

panel = Panel("C:\Users\froumpani\OneDrive - The Alan Turing Institute\Turing\1.Projects\3.Protein_folding\outputs\")

# ---- group: PDB Reader
# Component to export a PDB file
# from a set of coordinates
pdb_path = FilePath()
atoms_id = Atoms_id()
xyz = Xyz()
pdb_path_2 = FilePath(pdb_path)
python = GhPythonScript(xyz=xyz, atoms_id=atoms_id)  # -> output, a; inputs xyz: list, atoms_id: list
# ---------- python: Python ----------
"""Module to get a list of transformed atoms coordinates and translate them to PDB
strings.
    Inputs:
        PDB_path: Path to the original PDB
        xyz: a list of the transformed coordinates of the atoms
        atoms_id: a list of the transformed atoms id
    Output:
        an tuple to fit PDB requirements such as: 
        ideal_tuple = ("     ","        ","        ","        ") """

__author__ = "froumpani"
__version__ = "2021.10.24"

import rhinoscriptsyntax as rs

def export_coordinates_to_PDB_tuple (xyz):
    """
    Function to convert coordinates to a readable PDB format
    xyz: double list of coordinates grouped by AA
    """

    #empty list to store the tuple to export as a grasshopper item
    xyz_ = []

    for i in range (len (xyz)):
        for j in range (len(xyz[i])):
            #exclude 'TER' item
            if (xyz[i][j]!= 'Ter'):
                #convert string tuple to float tuple
                xyz_tuple = eval(xyz[i][j])
                _tuple1=()
                # iterate tuple to convert to modified string suitable for 
                # PDB format
                for jj in range (len(xyz_tuple)):
                    fl_= float(xyz_tuple[jj])
                    round_tuple = format(fl_, '.3f')
                    space_ = 8-len(round_tuple)
                    space_tuple = space_*" " + str(round_tuple)
                    _tuple1 = _tuple1 + (space_tuple,)
                str_atoms_id = str(int(atoms_id[i][j]))
                space_id = 5-len(str_atoms_id)
                space_atoms_id = space_id*" "+str_atoms_id
                id_xyz_tuple = (space_atoms_id,) + _tuple1
                # store tuple to xyz_ array
                xyz_.append(id_xyz_tuple)
    return (xyz_)


output = export_coordinates_to_PDB_tuple (xyz)

#for x in range (len())
                
            #split_str = xyz[i][j].split (',')
            
            #xyz_.append(xyz[i][j])
#print (xyz_)


#for i in range (len (xyz)):
#    xyz_ = []
#    for j in range (len(xyz[i])):
#        if (xyz[i][j]!= 'Ter'):
#            xyz_tuple = eval(xyz[i][j])
#            id_int = int(atoms_id[i][j])
#            xyz_.append((id_int,)+xyz_tuple)
#    id_xyz.append(xyz_)

        
        #print (atoms_id[i][j], xyz[i][j])
# ---------- end python ----------
read_file_universal = GhPythonScript(path=pdb_path_2)  # -> out, contents
# ---------- read_file_universal: Python ----------
"""An alternative to "read file" gh component, for Mac.
    Inputs:
        path: path of file
    Output:
        contents: output file in txt"""

__author__ = "Flora"
__version__ = "2021.04.13"

import rhinoscriptsyntax as rs
contents = []

try:
    with open(path, 'r') as fp:
        #contents = fp.read()
        for cnt, line in enumerate(fp):
            contents.append(line)
except:
    e = gh.GH_RuntimeMessageLevel.Warning
    ghenv.Component.AddRuntimeMessage(e, "Grasshopper cannot read lines in file: try 'read file component'")

fp.close()
# ---------- end read_file_universal ----------
filter_dbd = GhPythonScript(PDB=read_file_universal.contents, xyz=python.output)  # -> P, output, TER; inputs PDB: list, xyz: list
#   port output: The a P variable
# ---------- filter_dbd: Python ----------
"""Provides a scripting component for exporting PDBs from a transformation.
    Inputs:
        PDB_path: Path to the original PDB
        xyz: a list of the transformed coordinates of the atoms
        atoms_id: a list of the transformed atoms id
    Output:
        Exported pdb"""

__author__ = "Flora"
__version__ = "2020.10.23"

import rhinoscriptsyntax as rs
import os.path

#print (PDB[0][27:54])
for x in xyz_:
    i=0
    for line in PDB:
        pdb_id = line[6:11]
        if (x[0]==pdb_id):
            PDB[i] = line.replace(line[30:54], x[1]+x[2]+x[3])
        #else:
        #    PDB[i] = line
        i+=1

output = PDB

#atom = PDB[0:6]
#id = PDB[6:11]
#null1= PDB[11:13]
#atom_name = PDB[13:16]
#AA_name = PDB[16:20]
#chain = PDB[20:22]
#AA_no = PDB[22:27]
#x= PDB[27:38]
#y= PDB[38:46]
#z= PDB[46:54]
#rest = PDB[54:]


#for i in range (len(xyz
#    if (xyz)


#PDB = PDB.replace("TER,","")

#if PDB.find("TER"):
#    P = PDB
# ---------- end filter_dbd ----------
python_2 = GhPythonScript(PDB=filter_dbd.output, export_path=panel)  # -> out, a; inputs PDB: list
# ---------- python_2: Python ----------
__author__ = "froumpani"
__version__ = "2021.10.28"

import rhinoscriptsyntax as rs
import Grasshopper as gh


test_text = 'Hello World! \n'

def writefile (path, file_name, PDB) :
    file = open(path+file_name, 'wb')
    for line in PDB:
        file.write(line)
    file.close()

writefile(export_path, 'file_1.pdb', PDB)
# ---------- end python_2 ----------
