# Grasshopper definition gh_loop_with_cli_joined_xyz.gh (Grasshopper 1.0.7)
# plug-ins: MetaHopper

input_params = GhPythonScript()  # -> out, initial_pdb, target_pdb, input_csv, experiment_id
# ---------- input_params: Python ----------
"""Provides a scripting component.
    Inputs:
    Output:
        input_pdb: Path to the input_pdb file
        input_csv: Path to the input_csv file
"""

__author__ = "a.smith"

import rhinoscriptsyntax as rs
from ConfigParser import RawConfigParser
from os import path


def read_gh_args_files():
    """
    Returns a tuple with paths to input_pdb, input_csv
    """
    config = RawConfigParser()
    print('config.options()')
    print(config.sections())
    print('done')

    # _config_fpath = path.join(path.dirname(path.realpath(__file__)), '_loop_params.cfg')
    _config_fpath = path.join(rs.DocumentPath(), '_loop_params.cfg')
    
    with open(_config_fpath, 'rb') as param_file:
        config.readfp(param_file)
        print(config.sections())

        initial_pdb = config.get('InputFiles', 'initial_pdb')
        target_pdb = config.get('InputFiles', 'target_pdb')
        input_csv = config.get('InputFiles', 'input_csv')
        experiment_id = config.get('InputFiles', 'experiment_id')

    return (initial_pdb, target_pdb, input_csv, experiment_id)

initial_pdb, target_pdb, input_csv, experiment_id = read_gh_args_files()
# ---------- end input_params ----------
panel = Panel(input_params.out)
panel_2 = Panel(input_params.initial_pdb)
panel_3 = Panel(input_params.target_pdb)
panel_4 = Panel(input_params.input_csv)
panel_5 = Panel(input_params.experiment_id)
# Doubleclick Me!
panel_6 = Panel(panel_2)
input_expid_test = Panel("0")

# ----
# PARSE PDB
# Inactive state
# PDB path
# Input Active (End) state
# PDB path
input_pdb_path = Panel(panel_3)
sticky_defs = GhPythonScript(in_folder="\RUN101\", PDB_path_AMP=input_pdb_path)  # -> out, project_path, state_path, AMP_path
# ---------- sticky_defs: Python ----------
__author__ = "froumpani"
__version__ = "2021.12.03"

import rhinoscriptsyntax as rs
import os
import scriptcontext as sc

file_name = ghenv.Component.OnPingDocument().FilePath
project_path = os.path.dirname(os.path.abspath(file_name))
state_path=project_path+in_folder

sc.sticky["project_path"] = project_path
sc.sticky["state_path"] = state_path
sc.sticky["AMP_path"] = PDB_path_AMP
sc.sticky["exp_id"] = 0

AMP_path = sc.sticky["AMP_path"]
# ---------- end sticky_defs ----------
initiator_node = GhPythonScript(starting_state=panel_6, state_path=sticky_defs.state_path, expid_test=input_expid_test)  # -> out, latest_file, exp_id
# ---------- initiator_node: Python ----------
__author__ = "froumpani"
__version__ = "2021.11.11"

import rhinoscriptsyntax as rs
import scriptcontext as sc
import glob
import os

#for testing : 
sc.sticky["state"] = "testing"

path = state_path #"C:\\Users\\froumpani\\OneDrive - The Alan Turing Institute\\Turing\\1.Projects\\3.Protein_folding\\climber-docker\\inputs\\"
file = "state.txt"

default_pdb_name = starting_state
exp_id = str(sc.sticky["exp_id"])
current_docker_folder_name = path + "GlyP_" + exp_id + "_GlyP_AMP_010step"

print (exp_id)
def writefile (path, filename):
    print ("writting file")
    print path+filename
    file = open(path+filename, "w")
    file.write("grasshopper running")
    file.close()

if(sc.sticky.has_key("state")==False):
    print ("None")

#initialization:
elif (sc.sticky["state"]=="start"):
    sc.sticky["exp_id"]=0
    latest_file = path+default_pdb_name
    writefile (path, file)

elif (sc.sticky["state"]=="docker finished"): 
    sc.sticky["exp_id"]= str(int(sc.sticky["exp_id"]) +1)
    current_docker_folder_name = "GlyP_G6P" + "_GlyP_" + exp_id + "_010step"
    list_of_files = glob.glob(path+ current_docker_folder_name + '\\*') # * means all if need specific format then *.csv
    latest_file = max(list_of_files, key=os.path.getctime)
    writefile (path, file)
    
elif (sc.sticky["state"]=="testing"):
    print ("testing")
    #current_docker_folder_name =  "file00030" + "_GlyP_" + folder_id_test + "_010step"
    #list_of_files = glob.glob(path +current_docker_folder_name + '\\*') # * means all if need specific format then *.csv
    #latest_file = max(list_of_files, key=os.path.getctime)
    latest_file = path+default_pdb_name
    sc.sticky["exp_id"]= expid_test
    writefile (path, file)
    print (sc.sticky["exp_id"])

print (sc.sticky["state"])
# ---------- end initiator_node ----------
pdb_reader = PDB_Reader(pdb_path=sticky_defs.AMP_path)  # -> atom_4, aa_id_2, aa_name_2, atom_id_2, xyz_point, atoms_name_2, atom_3
aa_range = Domain(Domain(0, 6798))
pdb_reader_2 = PDB_Reader(pdb_path=initiator_node.latest_file)  # -> atom_4, aa_id_2, aa_name_2, atom_id_2, xyz_point, atoms_name_2, atom_3
filter_aa_properties = GhPythonScript(
    AA_id=pdb_reader.aa_id_2,
    AA_name=pdb_reader.aa_name_2,
    atoms_xyz=pdb_reader.xyz_point,
    atoms_name=pdb_reader.atoms_name_2,
    mask=aa_range)  # -> out, AA_name_list, atoms_name_list, atoms_xyz_list; inputs AA_id: list of Int32, AA_name: list, atoms_xyz: list, atoms_name: list
#   port AA_id: Amino Acid names
# ---------- filter_aa_properties: Python ----------
__author__ = "Flora"
__version__ = "2020.10.28"

"""
This module reads PDB output lists and creates double lists of AA coordinates and 
properties per AA atom, masked by a domain, ready to be converted to trees.
eg. [['75.814,-34.543,47.16', '74.639,-34.529,48.079'...],[...]]
    Inputs:
        AA_id: Amino Acid id number (int list)
        AA_name: Amino Acid name (string list)
        atoms_xyz: coordinates in 3Dspace per atom (3d point rhino item)
        atoms_name: atom names (string list)
    Output:
        atoms_xyz_list/name: list of coordinates/names of all atoms per AA
        AA_name_list: list of unique AA names in order per AA 
"""

import rhinoscriptsyntax as rs


#TODO: seperate per protein ("TER") 

def ListAANames(AA_id, AA_name):
    """
    Creates a list of unique AA names
    AA_id: [] index of AA per atom
    AA_name: [] name of AA per atom
    
    AA_name_list: [] of uniqe AA names
    """
    counter=-1
    AA_name_list=[]
    for i in range (len(AA_id)):
        if AA_id[i]!=counter: #a new aminoacid
            AA_name_list.append(AA_name[i]) #stores name per chain of AA
            counter=AA_id[i]
    return (AA_name_list)


def ListAtomsperAA(AA_id, atoms_list):
    """
    Groups atoms in lists per AA 
    AA_id: [] index of AA per atom
    atoms_list: [] single list of atoms 
    
    list: [] grouped values in lists per AA
    """
    counter=-1
    list, sublist =[],[]

    for i in range (len(AA_id)):
        if AA_id[i]!=counter: #a new aminoacid
            if sublist != []:
                list.append(sublist) #store list of atoms per AA
            sublist=[]
            sublist.append(atoms_list[i])
            counter=AA_id[i]

        else: # existing aminoacid
            sublist.append(atoms_list[i])

    list.append(sublist)  #stores list of atoms of final AA
    return (list)


def Mask(mask, list):
    """
    Creates a sublist per domain  
    mask: gh domain (10:100)
    list: [] any list 
    
    list_masked: [] output sublist
    """
    list_masked = list [int(mask[0]):int(mask[1])]
    return (list_masked)


if __name__ == "__main__": 
    if (mask!= None) :
        AA_name_list= Mask(mask, ListAANames(AA_id, AA_name))
        atoms_xyz_list=Mask(mask,ListAtomsperAA(AA_id, atoms_xyz))
        atoms_name_list=Mask(mask,ListAtomsperAA(AA_id, atoms_name))
        
    else: 
        AA_name_list= ListAANames(AA_id, AA_name)
        atoms_xyz_list=ListAtomsperAA(AA_id, atoms_xyz)
        atoms_name_list=ListAtomsperAA(AA_id, atoms_name)
# ---------- end filter_aa_properties ----------
filter_aa_properties_2 = GhPythonScript(
    AA_id=pdb_reader_2.aa_id_2,
    AA_name=pdb_reader_2.aa_name_2,
    atoms_id=pdb_reader_2.atom_id_2,
    atoms_xyz=pdb_reader_2.xyz_point,
    atoms_name=pdb_reader_2.atoms_name_2,
    mask=aa_range)  # -> out, AA_name_list, atoms_id_list, AA_ID_list, atoms_name_list, atoms_xyz_list; inputs AA_id: list of Int32, AA_name: list, atoms_id: list, atoms_xyz: list, atoms_name: list
#   port AA_id: Amino Acid names
# ---------- filter_aa_properties_2: Python ----------
__author__ = "Flora"
__version__ = "2020.10.28"

"""
This module reads PDB output lists and creates double lists of AA coordinates and 
properties per AA atom, masked by a domain, ready to be converted to trees.
eg. [['75.814,-34.543,47.16', '74.639,-34.529,48.079'...],[...]]
    Inputs:
        AA_id: Amino Acid id number (int list)
        AA_name: Amino Acid name (string list)
        atoms_xyz: coordinates in 3Dspace per atom (3d point rhino item)
        atoms_name: atom names (string list)
    Output:
        atoms_xyz_list/name: list of coordinates/names of all atoms per AA
        AA_name_list: list of unique AA names in order per AA 
"""

import rhinoscriptsyntax as rs


#TODO: seperate per protein ("TER") 

def ListAANames(AA_id, AA_name):
    """
    Creates a list of unique AA names
    AA_id: [] index of AA per atom
    AA_name: [] name of AA per atom
    
    AA_name_list: [] of uniqe AA names
    """
    counter=-1
    AA_name_list=[]
    for i in range (len(AA_id)):
        if AA_id[i]!=counter: #a new aminoacid
            AA_name_list.append(AA_name[i]) #stores name per chain of AA
            counter=AA_id[i]
    return (AA_name_list)


def ListAtomsperAA(AA_id, atoms_list):
    """
    Groups atoms in lists per AA 
    AA_id: [] index of AA per atom
    atoms_list: [] single list of atoms 
    
    list: [] grouped values in lists per AA
    """
    counter=-1
    list, sublist =[],[]

    for i in range (len(AA_id)):
        if AA_id[i]!=counter: #a new aminoacid
            if sublist != []:
                list.append(sublist) #store list of atoms per AA
            sublist=[]
            sublist.append(atoms_list[i])
            counter=AA_id[i]

        else: # existing aminoacid
            sublist.append(atoms_list[i])

    list.append(sublist)  #stores list of atoms of final AA
    return (list)


def Mask(mask, list):
    """
    Creates a sublist per domain  
    mask: gh domain (10:100)
    list: [] any list 
     !=
    list_masked: [] output sublist
    """
    list_masked = list [int(mask[0]):int(mask[1])]
    return (list_masked)



if __name__ == "__main__": 

    if (mask!= None) :
        AA_name_list= Mask(mask, ListAANames(AA_id, AA_name))
        AA_ID_list=Mask(mask, ListAANames(AA_id, AA_id))
        atoms_xyz_list=Mask(mask,ListAtomsperAA(AA_id, atoms_xyz))
        atoms_name_list=Mask(mask,ListAtomsperAA(AA_id, atoms_name))
        atoms_id_list=Mask(mask,ListAtomsperAA(AA_id, atoms_id))
        print AA_name_list
        
    elif (mask== None): 
        AA_name_list= ListAANames(AA_id, AA_name)
        atoms_xyz_list=ListAtomsperAA(AA_id, atoms_xyz)
        atoms_name_list=ListAtomsperAA(AA_id, atoms_name)
# ---------- end filter_aa_properties_2 ----------

panel_7 = Panel(initiator_node.exp_id)
pdb_path = FilePath("C:\Users\Flora\OneDrive - The Alan Turing Institute\Turing\3.Protein_folding\1.Data\GlyP_AMP.pdb")

start = EnableDisableObject(Enabled=Toggle(True), AllObjects_Object=timer)
runner = GhPythonScript()  # -> output
# ---------- runner: Python ----------
__author__ = "froumpani"
__version__ = "2021.11.11"

import rhinoscriptsyntax as rs
import scriptcontext as sc
import random

if(sc.sticky.has_key("state")==False):
    sc.sticky["state"]="GrasshopperRunning"
elif(sc.sticky["state"]=="GrasshopperRunning"):
    sc.sticky["state"]="DockerRunning"
elif(sc.sticky["state"]=="DockerRunning"):
    sc.sticky["state"]="GrasshopperRunning"
output=sc.sticky["state"]
# ---------- end runner ----------
timer = GhPythonScript()  # -> run, output; disabled
# ---------- timer: Python ----------
__author__ = "froumpani"
__version__ = "2021.11.11"

import rhinoscriptsyntax as rs
import scriptcontext as sc
import random
import time

state_path = sc.sticky["state_path"]
path=state_path +"state.txt"

#find component to loop
def findComponent(name):
    Component = ghenv.Component
    GhDef = None
    if Component:
        GhDef = Component.OnPingDocument()
    objects=[]
    object=None
    for o in range(len(GhDef.Objects)):
        if GhDef.Objects[o].NickName==name:
            #print(GhDef.Objects[o].NickName)
            object=(GhDef.Objects[o])
        if(object!=None):
            objects.append(object)
    if(objects!=[]):
        return(objects[0])
    else:
        return(None)

if(sc.sticky.has_key("time")==False):
    sc.sticky["time"]=0
else:
    try:
        f = open(path,"r")
        lines = f.readlines()

        if(lines[0]=="docker running"):
            run="docker running"
        elif(lines[0]=="docker finished"):
            run="docker finished"
        elif (lines[0]=="grasshopper running"):
            run="grasshopper running"
        elif (lines[0]=="grasshopper finished"):
            run="grasshopper finished"
        elif (lines[0]=="start"):
            run="start"
        elif (lines[0]=="testing"):
            run="testing"
        sc.sticky["time"]=sc.sticky["time"]+1
        time.sleep(0.1)
    except:
        None
output=sc.sticky["time"]
print (run)
sc.sticky["state"]=run
findComponent("Timer").ExpireSolution(True)
# ---------- end timer ----------
panel_8 = Panel(timer.output)
panel_9 = Panel(runner)
panel_10 = Panel(timer.run)
final = GhPythonScript(input=panel_10)  # -> output, exp_id
# ---------- final: Python ----------
__author__ = "froumpani"
__version__ = "2021.11.11"

import rhinoscriptsyntax as rs
import random
import scriptcontext as sc

if input == "docker finished":
    Component = ghenv.Component
    GhDef = None
    if Component:
        GhDef = Component.OnPingDocument()
    objects=[]
    for o in range(len(GhDef.Objects)):
        if GhDef.Objects[o].NickName=="Initiator_node":
            print(GhDef.Objects[o].NickName)
            object=(GhDef.Objects[o])
            objects.append(object)
    #print(objects[0])
    objects[0].ExpireSolution(True)

if input == "start":
    sc.sticky["exp_id"]=0
    Component = ghenv.Component
    GhDef = None
    if Component:
        GhDef = Component.OnPingDocument()
    objects=[]
    for o in range(len(GhDef.Objects)):
        if GhDef.Objects[o].NickName=="Initiator_node":
            print(GhDef.Objects[o].NickName)
            object=(GhDef.Objects[o])
            objects.append(object)
    #print(objects[0])
    objects[0].ExpireSolution(True)
    

if input == "testing":
    Component = ghenv.Component
    GhDef = None
    if Component:
        GhDef = Component.OnPingDocument()
    objects=[]
    for o in range(len(GhDef.Objects)):
        if GhDef.Objects[o].NickName=="Initiator_node":
            print(GhDef.Objects[o].NickName)
            object=(GhDef.Objects[o])
            objects.append(object)
    #print(objects[0])
    objects[0].ExpireSolution(True)
# ---------- end final ----------

# ---- group: PDB exporter
enable_disable_object = EnableDisableObject(Enabled=Toggle(True))
pdb_exporter = PDB_Exporter(pdb_path="C:\Users\Flora\OneDrive - The Alan Turing Institute\Turing\3.Protein_folding\1.Data\GlyP_AMP.pdb")  # disabled

# ---- group: State Data
# PARSE DATA
# Input State data
# path (csv)
# Input experiment ID
input_experiment_id = Panel(panel_5)
panel_11 = Panel(panel_4)
state_reader = StateReader(path=panel_11, index=input_experiment_id)  # -> states_2, start_aa_3, end_aa_3, uptake_3, centre_3, exposure_4, sequence_2
list_of_experiments = Panel(state_reader.states_2)
number_slider = Slider(56, range=0..1000)

# ---- group: State Data / Slices (AA ID series) creation using start AA and End AA of slice ID
subtraction = Subtraction(A=state_reader.end_aa_3, B=state_reader.start_aa_3)
addition = Addition(A=subtraction, B=1)
series = Series(Start=state_reader.start_aa_3, Step=1, Count=addition)

# ---- group: State Data / Seperates list per Exposure
create_set = CreateSet(List=state_reader.exposure_4)  # -> Set, Map
equality = Equality(FirstNumber=graft(create_set.Set), SecondNumber=state_reader.exposure_4)  # -> Equality, Inequality

# ---- group: Interpolator
# INTERPOLATOR
xyz_tree = GhPythonScript(xyz=filter_aa_properties.atoms_xyz_list)  # -> out, x_list, y_list, z_list; inputs xyz: list
# ---------- xyz_tree: Python ----------
__author__ = "Flora"
__version__ = "2020.10.28"

"""
Provides a scripting component.
    Inputs:
        AA: Amino Acid id number (int list)
        AA_name: Amino Acid name (string list)
        xyz: coordinates in 3Dspace per atom (3d point rhino item)
        atoms: atom names (string list)
    Output:
        a: xyz coordinates for debug
        start: list of coordinates of all atoms per AA (for starting points of lines) 
        end: list of coordinates of all atoms per AA (for ending poins of lines)
"""


import rhinoscriptsyntax as rs


x_list,y_list,z_list=[],[],[]

def create_xyz_list():

    for i in range (len(xyz)):
        x1,y1,z1=[],[],[]
        for j in range (len(xyz[i])):
            if (xyz[i][j]!=None):
                xyz_str= str(xyz[i][j])
                x,y,z= xyz_str.split(",")
                x1.append(x)
                y1.append(y)
                z1.append(z)
            else:
                x1.append("None")
        x_list.append(x1)
        y_list.append(y1)
        z_list.append(z1)

create_xyz_list()
# ---------- end xyz_tree ----------
xyz_tree_2 = GhPythonScript(xyz=filter_aa_properties_2.atoms_xyz_list)  # -> out, x_list, y_list, z_list; inputs xyz: list
# ---------- xyz_tree_2: Python ----------
__author__ = "Flora"
__version__ = "2020.10.28"

"""
This componment gets the x,y,z list and creates seperate x,y,z, lists per AA 
atom.
    Inputs:
        AA: Amino Acid id number (int list)
        AA_name: Amino Acid name (string list)
        xyz: coordinates in 3Dspace per atom (3d point rhino item)
        atoms: atom names (string list)
    Output:
        a: xyz coordinates for debug
        start: list of coordinates of all atoms per AA (for starting points of lines) 
        end: list of coordinates of all atoms per AA (for ending poins of lines)
"""


import rhinoscriptsyntax as rs


x_list,y_list,z_list=[],[],[]

def create_xyz_list():

    for i in range (len(xyz)):
        x1,y1,z1=[],[],[]
        for j in range (len(xyz[i])):
            if (xyz[i][j]!=None):
                xyz_str= str(xyz[i][j])
                x,y,z= xyz_str.split(",")
                x1.append(x)
                y1.append(y)
                z1.append(z)
            else:
                x1.append("Ter")
                y1.append("Ter")
                z1.append("Ter")
        x_list.append(x1)
        y_list.append(y1)
        z_list.append(z1)


create_xyz_list()
# ---------- end xyz_tree_2 ----------
exposure_id = Slider(0, range=0..30)
ghpython_script = GhPythonScript(x=exposure_id)  # -> out, a
# ---------- ghpython_script: Python ----------
__author__ = "Flora"
__version__ = "2021.06.02"

import rhinoscriptsyntax as rs

if (x==0.0):
    a=0

if (x==0.1):
    a=50
    
if (x==0.2):
    a=150
    
if (x==0.3):
    a=250
    
if (x==0.4):
    a=350

if (x==0.5):
    a=500

if (x==0.6):
    a=1000

if (x==0.7):
    a=5000
    
if (x==0.8):
    a=10000

if (x==0.9):
    a=15000
# ---------- end ghpython_script ----------
number = Number(ghpython_script.a)
linear_interpolation = GhPythonScript(
    x1=xyz_tree_2.x_list,
    x2=xyz_tree.x_list,
    y1=xyz_tree_2.y_list,
    y2=xyz_tree.y_list,
    z1=xyz_tree_2.z_list,
    z2=xyz_tree.z_list,
    exposures=create_set.Set,
    a=Slider(0.5, range=0..1))  # -> out, xyz_list; inputs x1: list, x2: list, y1: list, y2: list, z1: list, z2: list, exposures: list
# ---------- linear_interpolation: Python ----------
"""Simple Linear Interpolator.
    Inputs:
        x: The x script variable
        y: The y script variable
        z: The z script variable
    Output:
        xyz_list: new xyz coordinates"""

__author__ = "Flora"
__version__ = "2020.11.12"

import rhinoscriptsyntax as rs
import math as mth
import scriptcontext as sc

exp_id = sc.sticky["exp_id"]

exposures_norm = [exp/max(exposures) for exp in exposures]
exposures_norm_log = [mth.log(exp+1)/mth.log(max(exposures)+1) for exp in exposures]



exp_id = int(exp_id)
x,y,z=[],[],[]
#x=p*(x2-x1)+x1

splits = []

print (len(x1))
for i in range(len(x1)):
    xyz_temp=[]
    for j in range (len(x1[i])):
        print x1[i][j]
        if x1[i][j]!= "Ter":
            x1f= float(x1[i][j])+a
            x2f= float(x2[i][j])+a
            x_new=exposures_norm[exp_id]*(x2f-x1f)+x1f

            y1f= float(y1[i][j])
            y2f= float(y2[i][j])
            y_new=exposures_norm[exp_id]*(y2f-y1f)+y1f
            
            z1f= float(z1[i][j])
            z2f= float(z2[i][j])
            z_new=exposures_norm[exp_id]*(z2f-z1f)+z1f
            
            xyz_temp.append("%s,%s,%s" %(x_new,y_new,z_new))
        else:
            xyz_temp.append("Ter")
        print x1[i][j]
    x.append(xyz_temp)

#Originally Created By piac
#from https://gist.github.com/piac/ef91ac83cb5ee92a1294
#NOTE: for later use
def list_to_tree(input, none_and_holes=True, source=[0]):
    """Transforms nestings of lists or tuples to a Grasshopper DataTree"""
    from Grasshopper import DataTree as Tree
    from Grasshopper.Kernel.Data import GH_Path as Path
    from System import Array
    def proc(input,tree,track):
        path = Path(Array[int](track))
        if len(input) == 0 and none_and_holes: tree.EnsurePath(path); return
        for i,item in enumerate(input):
            if hasattr(item, '__iter__'): #if list or tuple
                track.append(i); proc(item,tree,track); track.pop()
            else:
                if none_and_holes: tree.Insert(item,path,i)
                elif item is not None: tree.Add(item,path)
    if input is not None: t=Tree[object]();proc(input,t,source[:]);return t

xyz_list=x

#list_to_tree(x)
# ---------- end linear_interpolation ----------

# ---- group: State Data / Filter xyz per slice
xyzpoints = Point(linear_interpolation.xyz_list)
treetolist = GhPythonScript(xyz=xyzpoints)  # -> xyz_list; inputs xyz: tree of Point3d
# ---------- treetolist: Python ----------
__author__ = "Flora"
__version__ = "2021.01.18"

import rhinoscriptsyntax as rs


#Created By piac
#from https://gist.github.com/piac/ef91ac83cb5ee92a1294
# written by Giulio Piacentino, giulio@mcneel.com
def tree_to_list(input, retrieve_base = lambda x: x[0]):
    """Returns a list representation of a Grasshopper DataTree"""
    def extend_at(path, index, simple_input, rest_list):
        target = path[index]
        if len(rest_list) <= target: rest_list.extend([None]*(target-len(rest_list)+1))
        if index == path.Length - 1:
            rest_list[target] = list(simple_input)
        else:
            if rest_list[target] is None: rest_list[target] = []
            extend_at(path, index+1, simple_input, rest_list[target])
    all = []
    for i in range(input.BranchCount):
        path = input.Path(i)
        extend_at(path, 0, input.Branch(path), all)
    return retrieve_base(all)

xyz_list=[]

xyz_list=tree_to_list(xyz)
# ---------- end treetolist ----------
selectionfromlists = GhPythonScript(Lists=linear_interpolation.xyz_list, selection=series)  # -> slice_xyz; inputs Lists: list, selection: tree
# ---------- selectionfromlists: Python ----------
__author__ = "Flora"
__version__ = "2021.01.18"

import rhinoscriptsyntax as rs

slice_xyz=[]

for i in range(selection.BranchCount):
    subOutput=[]
    for ii in selection.Branch(i):
        number=int(ii)
        print(number)
        if number<len(Lists):
            subOutput.append(Lists[number])
    slice_xyz.append(subOutput)

#Created By piac
#from https://gist.github.com/piac/ef91ac83cb5ee92a1294
def list_to_tree(input, none_and_holes=True, source=[0]):
    """Transforms nestings of lists or tuples to a Grasshopper DataTree"""
    from Grasshopper import DataTree as Tree
    from Grasshopper.Kernel.Data import GH_Path as Path
    from System import Array
    def proc(input,tree,track):
        path = Path(Array[int](track))
        if len(input) == 0 and none_and_holes: tree.EnsurePath(path); return
        for i,item in enumerate(input):
            if hasattr(item, '__iter__'): #if list or tuple
                track.append(i); proc(item,tree,track); track.pop()
            else:
                if none_and_holes: tree.Insert(item,path,i)
                elif item is not None: tree.Add(item,path)
    if input is not None: t=Tree[object]();proc(input,t,source[:]);return t


#output=list_to_tree(output)
# ---------- end selectionfromlists ----------

# ---- group: State Data / Select Exposure
cull_pattern = CullPattern(List=state_reader.uptake_3, CullPattern=equality.Equality)
number_slider_2 = Slider(6, range=0..7)
cull_pattern_2 = CullPattern(List=selectionfromlists, CullPattern=equality.Equality)
cull_pattern_3 = CullPattern(List=state_reader.centre_3, CullPattern=equality.Equality)
ghpython_script_2 = GhPythonScript(Uptake=cull_pattern)  # -> out, uptake; inputs Uptake: tree
# ---------- ghpython_script_2: Python ----------
__author__ = "Flora"
__version__ = "2021.06.03"

import Grasshopper as gh
import rhinoscriptsyntax as rs
import scriptcontext as sc

ExposureID = int(sc.sticky["exp_id"])
uptake = Uptake.Branch(ExposureID)
#print (x[0,0])
#for i in range(x.BranchCount):
#    print x.Branch(i)



#for i in range (len(x)):
#    None
    #print (x[i])
# ---------- end ghpython_script_2 ----------
explode_tree = ExplodeTree(Data=cull_pattern_3)  # -> Branch0, Branch1, Branch2, Branch3, Branch4, Branch5, Branch6, Branch7, Branch8, Branch9
explode_tree_2 = ExplodeTree(Data=cull_pattern_2)  # -> Branch0, Branch1, Branch2, Branch3, Branch4, Branch5, Branch6, Branch7, Branch8, Branch9

# ---- group: PDB exporter
cluster = PDB_Exporter(pdb_path=pdb_path, xyz=linear_interpolation.xyz_list, atoms_id=filter_aa_properties_2.atoms_id_list)

# ---- group: State Data (continued)
exposures = Panel(create_set.Set)
uptake_to_speed = GhPythonScript(uptake=ghpython_script_2.uptake)  # -> out, tree; inputs uptake: tree
# ---------- uptake_to_speed: Python ----------
__author__ = "Flora"
__version__ = "2021.06.10"

import rhinoscriptsyntax as rs
import ghpythonlib.treehelpers as th

#uptake = Uptake.Branch(ExposureID)

parentspeed=[]

#print uptake.Branch(0)[0]
exposures= []

"""
subtracts uptake from previous uptake to get absolute uptake value. 
"""
l =th.tree_to_list(uptake)

#list = th.tree_to_list(uptake.Branch(0))
#print list

exposures.append(l[0][0][0])
for i in range(1,uptake.BranchCount):
    exp_ =[]
    for j in range(len(uptake.Branch(i))):
        exp = uptake.Branch(i)[j]-uptake.Branch(i-1)[j]
        exp_.append(exp)
    exposures.append(exp_)

tree = th.list_to_tree(exposures)


    
    #print len(uptake.Branch(i))

    #AAlength = len(uptake.Branch(i))
    #print (exposures)
    #absuptake=[]
    #absuptake.append(0)
    #for j in range(AAlength):
        
        #absuptake_= uptake.Branch(i)[j]-uptake.Branch(i-1)[j]
        #absuptake.append(absuptake_)
       # None
    #print absuptake[3]
    #print (exposures[0])

    #firstItems.append(branchList[0])
# ---------- end uptake_to_speed ----------
bounds = Bounds(Numbers=uptake_to_speed.tree)
listtotree = GhPythonScript(Lists=explode_tree_2.Branch0)  # -> output; inputs Lists: list
# ---------- listtotree: Python ----------
__author__ = "Flora"
__version__ = "2021.01.18"

import rhinoscriptsyntax as rs



#Created By piac
#from https://gist.github.com/piac/ef91ac83cb5ee92a1294
def list_to_tree(input, none_and_holes=True, source=[0]):
    """Transforms nestings of lists or tuples to a Grasshopper DataTree"""
    from Grasshopper import DataTree as Tree
    from Grasshopper.Kernel.Data import GH_Path as Path
    from System import Array
    def proc(input,tree,track):
        path = Path(Array[int](track))
        if len(input) == 0 and none_and_holes: tree.EnsurePath(path); return
        for i,item in enumerate(input):
            if hasattr(item, '__iter__'): #if list or tuple
                track.append(i); proc(item,tree,track); track.pop()
            else:
                if none_and_holes: tree.Insert(item,path,i)
                elif item is not None: tree.Add(item,path)
    if input is not None: t=Tree[object]();proc(input,t,source[:]);return t

output=list_to_tree(Lists)
# ---------- end listtotree ----------
remap_numbers = RemapNumbers(Value=uptake_to_speed.tree, Source=bounds, Target=Domain(0, 1))  # -> Mapped, Clipped
panel_12 = Panel(listtotree)
path_mapper = PathMapper(listtotree, source="{A;B;C}", target="{A;B}")
gradient = Gradient(LowerLimit=0, UpperLimit=1, Parameter=remap_numbers.Mapped, stops=[0: RGB(0, 128, 0), 1: RGB(255, 0, 0)])

# ---- group: State Data / slices viz
slice_no = Slider(10, range=0..190)
selecttreesecondbranchonly = GhPythonScript(tree=listtotree, selection=slice_no)  # -> tree_output; inputs tree: tree
# ---------- selecttreesecondbranchonly: Python ----------
__author__ = "Flora"
__version__ = "2021.01.18"

import rhinoscriptsyntax as rs

#Created By piac
#from https://gist.github.com/piac/ef91ac83cb5ee92a1294
def list_to_tree(input, none_and_holes=True, source=[0]):
    """Transforms nestings of lists or tuples to a Grasshopper DataTree"""
    from Grasshopper import DataTree as Tree
    from Grasshopper.Kernel.Data import GH_Path as Path
    from System import Array
    def proc(input,tree,track):
        path = Path(Array[int](track))
        if len(input) == 0 and none_and_holes: tree.EnsurePath(path); return
        for i,item in enumerate(input):
            if hasattr(item, '__iter__'): #if list or tuple
                track.append(i); proc(item,tree,track); track.pop()
            else:
                if none_and_holes: tree.Insert(item,path,i)
                elif item is not None: tree.Add(item,path)
    if input is not None: t=Tree[object]();proc(input,t,source[:]);return t

#Created By piac
#from https://gist.github.com/piac/ef91ac83cb5ee92a1294
# written by Giulio Piacentino, giulio@mcneel.com
def tree_to_list(input, retrieve_base = lambda x: x[0]):
    """Returns a list representation of a Grasshopper DataTree"""
    def extend_at(path, index, simple_input, rest_list):
        target = path[index]
        if len(rest_list) <= target: rest_list.extend([None]*(target-len(rest_list)+1))
        if index == path.Length - 1:
            rest_list[target] = list(simple_input)
        else:
            if rest_list[target] is None: rest_list[target] = []
            extend_at(path, index+1, simple_input, rest_list[target])
    all = []
    for i in range(input.BranchCount):
        path = input.Path(i)
        extend_at(path, 0, input.Branch(path), all)
    return retrieve_base(all)

#tree=tree


#path1=[]
#for i in range(tree.BranchCount):
#    
#    path = tree.Path(i)
#    if len(path)>1 and path[1]=
#    
#    #print(path[1,-1])
#    print(path)
#    print(path[2])
#    #extend_at(path, 1, input.Branch(path), path1)


tree_output=[]
for i in range(tree.BranchCount):
    path = tree.Path(i)
    
    #print(str(path[1]) +" "+str(int(selection)))
    
    if str(path[1])==str(int(selection)):
        print(path[1])
        subTree=[]
        print(i)
        for ii in tree.Branch(i):
            subTree.append(ii)

        tree_output.append(subTree)

tree_output=list_to_tree(tree_output)
# ---------- end selecttreesecondbranchonly ----------
multiplylist = GhPythonScript(selection=slice_no, tree=selecttreesecondbranchonly, list=gradient)  # -> tree_output, multipliedList; inputs tree: tree, list: list
# ---------- multiplylist: Python ----------
__author__ = "Flora"
__version__ = "2021.01.18"

import rhinoscriptsyntax as rs

#Created By piac
#from https://gist.github.com/piac/ef91ac83cb5ee92a1294
def list_to_tree(input, none_and_holes=True, source=[0]):
    """Transforms nestings of lists or tuples to a Grasshopper DataTree"""
    from Grasshopper import DataTree as Tree
    from Grasshopper.Kernel.Data import GH_Path as Path
    from System import Array
    def proc(input,tree,track):
        path = Path(Array[int](track))
        if len(input) == 0 and none_and_holes: tree.EnsurePath(path); return
        for i,item in enumerate(input):
            if hasattr(item, '__iter__'): #if list or tuple
                track.append(i); proc(item,tree,track); track.pop()
            else:
                if none_and_holes: tree.Insert(item,path,i)
                elif item is not None: tree.Add(item,path)
    if input is not None: t=Tree[object]();proc(input,t,source[:]);return t

#Created By piac
#from https://gist.github.com/piac/ef91ac83cb5ee92a1294
# written by Giulio Piacentino, giulio@mcneel.com
def tree_to_list(input, retrieve_base = lambda x: x[0]):
    """Returns a list representation of a Grasshopper DataTree"""
    def extend_at(path, index, simple_input, rest_list):
        target = path[index]
        if len(rest_list) <= target: rest_list.extend([None]*(target-len(rest_list)+1))
        if index == path.Length - 1:
            rest_list[target] = list(simple_input)
        else:
            if rest_list[target] is None: rest_list[target] = []
            extend_at(path, index+1, simple_input, rest_list[target])
    all = []
    for i in range(input.BranchCount):
        path = input.Path(i)
        extend_at(path, 0, input.Branch(path), all)
    return retrieve_base(all)

#tree=tree


#path1=[]
#for i in range(tree.BranchCount):
#    
#    path = tree.Path(i)
#    if len(path)>1 and path[1]=
#    
#    #print(path[1,-1])
#    print(path)
#    print(path[2])
#    #extend_at(path, 1, input.Branch(path), path1)

multipliedList=[]
tree_output=[]
for i in range(tree.BranchCount):
    path = tree.Path(i)
    subList=[]
    subTree=[]
    print(i)
    for ii in tree.Branch(i):
        print(path)
        subList.append(list[int(selection)])
        subTree.append(ii)
    multipliedList.append(subList)
    tree_output.append(subTree)

tree_output=list_to_tree(tree_output)
multipliedList=list_to_tree(multipliedList)
# ---------- end multiplylist ----------
cloud_display = CloudDisplay(Points=multiplylist.tree_output, Colours=multiplylist.multipliedList, Size=0.8, SpriteType=0)

# ---- group: State Data / SelectTreeBranch
tree_statistics = TreeStatistics(Tree=listtotree)  # -> Paths, Length, Count
list_item = ListItem(List=tree_statistics.Paths, Index=number_slider, Wrap=True)
tree_branch = TreeBranch(Tree=listtotree, Path=list_item, MaintainPaths=True)

# ---- group: State Data / To develop averages
multiplylist_2 = GhPythonScript(tree=listtotree, list=gradient)  # -> tree_output, multipliedList; inputs tree: tree, list: list
# ---------- multiplylist_2: Python ----------
__author__ = "Flora"
__version__ = "2021.01.18"

import rhinoscriptsyntax as rs

#Created By piac
#from https://gist.github.com/piac/ef91ac83cb5ee92a1294
def list_to_tree(input, none_and_holes=True, source=[0]):
    """Transforms nestings of lists or tuples to a Grasshopper DataTree"""
    from Grasshopper import DataTree as Tree
    from Grasshopper.Kernel.Data import GH_Path as Path
    from System import Array
    def proc(input,tree,track):
        path = Path(Array[int](track))
        if len(input) == 0 and none_and_holes: tree.EnsurePath(path); return
        for i,item in enumerate(input):
            if hasattr(item, '__iter__'): #if list or tuple
                track.append(i); proc(item,tree,track); track.pop()
            else:
                if none_and_holes: tree.Insert(item,path,i)
                elif item is not None: tree.Add(item,path)
    if input is not None: t=Tree[object]();proc(input,t,source[:]);return t

#Created By piac
#from https://gist.github.com/piac/ef91ac83cb5ee92a1294
# written by Giulio Piacentino, giulio@mcneel.com
def tree_to_list(input, retrieve_base = lambda x: x[0]):
    """Returns a list representation of a Grasshopper DataTree"""
    def extend_at(path, index, simple_input, rest_list):
        target = path[index]
        if len(rest_list) <= target: rest_list.extend([None]*(target-len(rest_list)+1))
        if index == path.Length - 1:
            rest_list[target] = list(simple_input)
        else:
            if rest_list[target] is None: rest_list[target] = []
            extend_at(path, index+1, simple_input, rest_list[target])
    all = []
    for i in range(input.BranchCount):
        path = input.Path(i)
        extend_at(path, 0, input.Branch(path), all)
    return retrieve_base(all)

#tree=tree


#path1=[]
#for i in range(tree.BranchCount):
#    
#    path = tree.Path(i)
#    if len(path)>1 and path[1]=
#    
#    #print(path[1,-1])
#    print(path)
#    print(path[2])
#    #extend_at(path, 1, input.Branch(path), path1)

multipliedList=[]
tree_output=[]
for i in range(tree.BranchCount):
    path = tree.Path(i)
    subList=[]
    subTree=[]
    print(i)
    for ii in tree.Branch(i):
        subList.append(list[path[1]])
        subTree.append(ii)
    multipliedList.append(subList)
    tree_output.append(subTree)

tree_output=list_to_tree(tree_output)
multipliedList=list_to_tree(multipliedList)
# ---------- end multiplylist_2 ----------
cloud_display_2 = CloudDisplay(Points=multiplylist_2.tree_output, Colours=multiplylist_2.multipliedList, Size=0.7, SpriteType=0)

# ---- group: State Data (continued)
panel_13 = Panel(tree_branch)

# ==== cluster PDB_Exporter
pdb_path = ClusterInput()

# ---- group: PDB Reader
# Component to export a PDB file
# from a set of coordinates
xyz = ClusterInput()
atoms_id = ClusterInput()
pdb_path_2 = FilePath(pdb_path)
read_file_universal = GhPythonScript(m_path=pdb_path_2)  # -> out, contents
# ---------- read_file_universal: Python ----------
"""An alternative to "read file" gh component, for Mac.
    Inputs:
        path: path of file
    Output:
        contents: output file in txt"""

__author__ = "Flora"
__version__ = "2021.04.13"

import rhinoscriptsyntax as rs
import Grasshopper.Kernel as gh
import scriptcontext as sc

contents = []

path = sc.sticky["AMP_path"]
m_path = 1

try:
    with open(path, 'r') as fp:
        #contents = fp.read()
        for cnt, line in enumerate(fp):
            contents.append(line)
except:
    e = gh.GH_RuntimeMessageLevel.Warning
    ghenv.Component.AddRuntimeMessage(e, "Grasshopper cannot read lines in file: try 'read file component'")

fp.close()
# ---------- end read_file_universal ----------
python = GhPythonScript(xyz=xyz, atoms_id=atoms_id)  # -> output, a; inputs xyz: list, atoms_id: list
# ---------- python: Python ----------
"""Module to get a list of transformed atoms coordinates and translate them to PDB
strings.
    Inputs:
        PDB_path: Path to the original PDB
        xyz: a list of the transformed coordinates of the atoms
        atoms_id: a list of the transformed atoms id
    Output:
        an tuple to fit PDB requirements such as: 
        ideal_tuple = ("     ","        ","        ","        ") """

__author__ = "froumpani"
__version__ = "2021.10.24"

import rhinoscriptsyntax as rs

def export_coordinates_to_PDB_tuple (xyz):
    """
    Function to convert coordinates to a readable PDB format
    xyz: double list of coordinates grouped by AA
    """

    #empty list to store the tuple to export as a grasshopper item
    xyz_ = []

    for i in range (len (xyz)):
        for j in range (len(xyz[i])):
            #exclude 'TER' item
            if (xyz[i][j]!= 'Ter'):
                #convert string tuple to float tuple
                xyz_tuple = eval(xyz[i][j])
                _tuple1=()
                # iterate tuple to convert to modified string suitable for 
                # PDB format
                for jj in range (len(xyz_tuple)):
                    fl_= float(xyz_tuple[jj])
                    round_tuple = format(fl_, '.3f')
                    space_ = 8-len(round_tuple)
                    space_tuple = space_*" " + str(round_tuple)
                    _tuple1 = _tuple1 + (space_tuple,)
                str_atoms_id = str(int(atoms_id[i][j]))
                space_id = 5-len(str_atoms_id)
                space_atoms_id = space_id*" "+str_atoms_id
                id_xyz_tuple = (space_atoms_id,) + _tuple1
                # store tuple to xyz_ array
                xyz_.append(id_xyz_tuple)
    return (xyz_)

if (xyz!=[]):
    output = export_coordinates_to_PDB_tuple (xyz)

#for x in range (len())
                
            #split_str = xyz[i][j].split (',')
            
            #xyz_.append(xyz[i][j])
#print (xyz_)


#for i in range (len (xyz)):
#    xyz_ = []
#    for j in range (len(xyz[i])):
#        if (xyz[i][j]!= 'Ter'):
#            xyz_tuple = eval(xyz[i][j])
#            id_int = int(atoms_id[i][j])
#            xyz_.append((id_int,)+xyz_tuple)
#    id_xyz.append(xyz_)

        
        #print (atoms_id[i][j], xyz[i][j])
# ---------- end python ----------
filter_dbd = GhPythonScript(PDB=read_file_universal.contents, xyz=python.output)  # -> P, output, TER; inputs PDB: list, xyz: list
#   port output: The a P variable
# ---------- filter_dbd: Python ----------
"""Provides a scripting component for exporting PDBs from a transformation.
    Inputs:
        PDB_path: Path to the original PDB
        xyz: a list of the transformed coordinates of the atoms
        atoms_id: a list of the transformed atoms id
    Output:
        Exported pdb"""

__author__ = "Flora"
__version__ = "2020.10.23"

import rhinoscriptsyntax as rs
import os.path

#print (PDB[0][27:54])
for x in xyz_:
    i=0
    for line in PDB:
        pdb_id = line[6:11]
        if (x[0]==pdb_id):
            PDB[i] = line.replace(line[30:54], x[1]+x[2]+x[3])
        #else:
        #    PDB[i] = line
        i+=1

output = PDB

#atom = PDB[0:6]
#id = PDB[6:11]
#null1= PDB[11:13]
#atom_name = PDB[13:16]
#AA_name = PDB[16:20]
#chain = PDB[20:22]
#AA_no = PDB[22:27]
#x= PDB[27:38]
#y= PDB[38:46]
#z= PDB[46:54]
#rest = PDB[54:]


#for i in range (len(xyz
#    if (xyz)


#PDB = PDB.replace("TER,","")

#if PDB.find("TER"):
#    P = PDB
# ---------- end filter_dbd ----------
exportpdb = GhPythonScript(PDB=filter_dbd.output)  # -> out, a; inputs PDB: list
# ---------- exportpdb: Python ----------
__author__ = "froumpani"
__version__ = "2021.10.28"

import rhinoscriptsyntax as rs
import scriptcontext as sc
import Grasshopper.Kernel as gh

outputs_path = sc.sticky["state_path"]
exp_id = str(sc.sticky["exp_id"])

state_path=outputs_path+"state.txt"
 

file_name = "GlyP_" + exp_id +".pdb"

def writefile_PDB (path, filename, PDB):
    try:
        file = open(path+filename, "wb")
        for line in PDB:
            file.write(line)
        file.close()
    except:
        print ("error creating outputs folder")

def writefile_state (path):

    file = open(path, "w")
    file.write("grasshopper finished")
    file.close()

if (PDB!=[]):
    writefile_PDB (outputs_path, file_name, PDB)
    #writefile_state(state_path)
    a = "go"

else :     
    e = gh.GH_RuntimeMessageLevel.Error
    ghenv.Component.AddRuntimeMessage(e, "Empty PDB")
# ---------- end exportpdb ----------

# ----
writestate = GhPythonScript(a=exportpdb.a)  # -> out, a
# ---------- writestate: Python ----------
__author__ = "froumpani"
__version__ = "2021.11.11"

import rhinoscriptsyntax as rs
import scriptcontext as sc#
import Grasshopper.Kernel as gh

state_path = sc.sticky["state_path"]
path=state_path+"state.txt"
 

def writefile (path):

    file = open(path, "w")
    file.write("grasshopper finished")
    file.close()

if a != None:
    writefile(path)
    
else: 
    e = gh.GH_RuntimeMessageLevel.Error
    ghenv.Component.AddRuntimeMessage(e, "Empty PDB")
# ---------- end writestate ----------
out = ClusterOutput(writestate.out)

# ==== cluster StateReader
path = ClusterInput()
index = ClusterInput()
ghpython_script = GhPythonScript(path=path)  # -> out, contents
# ---------- ghpython_script: Python ----------
__author__ = "Flora"
__version__ = "2021.04.13"

import rhinoscriptsyntax as rs
contents = []
with open(path, 'r') as fp:
    #contents = fp.read()
    for cnt, line in enumerate(fp):
        contents.append(line)


fp.close()
# ---------- end ghpython_script ----------
num = Number(0)
cull_i = CullIndex(List=ghpython_script.contents, Indices=num, Wrap=True)
split = TextSplit(Text=cull_i, Separators=",")

state = ListItem(List=split, Index="8", Wrap=True)  # -> flatten(Item)
create_set = CreateSet(List=state)  # -> Set, Map
list_item = ListItem(List=create_set.Set, Index=index, Wrap=True)
find_aa_index = GhPythonScript(input=state, search=list_item)  # -> output; inputs input: list
# ---------- find_aa_index: Python ----------
__author__ = "Flora"
__version__ = "2020.10.27"

import rhinoscriptsyntax as rs

output=[]

for i in range(len(input)):
    if input[i] == search: #.find(search)!=-1:
        #print (input[i])
        output.append(i)
# ---------- end find_aa_index ----------
list_item_2 = ListItem(List=state, Index=find_aa_index, Wrap=True)  # -> flatten(Item)
states = Text(create_set.Set)
states_2 = ClusterOutput(states)

exposure = ListItem(List=split, Index="3", Wrap=True)  # -> flatten(Item)
list_item_3 = ListItem(List=exposure, Index=find_aa_index, Wrap=True)  # -> flatten(Item)
create_set_2 = CreateSet(List=list_item_3)  # -> Set, Map
exposures = Panel(create_set_2.Set)

end_aa = ListItem(List=split, Index="2", Wrap=True)  # -> flatten(Item)
start_aa = ListItem(List=split, Index="1", Wrap=True)  # -> flatten(Item)
centre = ListItem(List=split, Index="10", Wrap=True)  # -> flatten(Item)
exposure_2 = ListItem(List=split, Index="9", Wrap=True)  # -> flatten(Item)
uptake = ListItem(List=split, Index="12", Wrap=True)  # -> flatten(Item)
list_item_4 = ListItem(List=start_aa, Index=find_aa_index, Wrap=True)  # -> flatten(Item)
list_item_5 = ListItem(List=end_aa, Index=find_aa_index, Wrap=True)  # -> flatten(Item)
list_item_6 = ListItem(List=exposure_2, Index=find_aa_index, Wrap=True)  # -> flatten(Item)
list_item_7 = ListItem(List=centre, Index=find_aa_index, Wrap=True)  # -> flatten(Item)
list_item_8 = ListItem(List=uptake, Index=find_aa_index, Wrap=True)  # -> flatten(Item)

create_set_3 = CreateSet(List=list_item_6)  # -> Set, Map
list_length = ListLength(List=create_set_3.Set)
find_aa_index_2 = GhPythonScript(input=exposure_2, array_length=list_length, list=list_item_3, search=create_set_2.Set)  # -> filtered_list, badindex; inputs input: list, list: list, search: list
# ---------- find_aa_index_2: Python ----------
__author__ = "Flora"
__version__ = "2020.10.27"

import rhinoscriptsyntax as rs


"""searches for anomalies missed exposure values and stores the index of the
the slice that is not complete. 
"""

output=[]


doublearray = []
darrayid=[]

for i in range(len(search)):
    Matrix = []
    arrayid= []
    for j in range (len(list)):
        if  (list[j] == search[i]):
            Matrix.append(input[j])
            arrayid.append(j)
    doublearray.append(Matrix)
    darrayid.append(arrayid)

filtered_list = []

useless_index = []
for item in doublearray:
    if len(item) == array_length:
        filtered_list.append(item)
    else: useless_index.append(doublearray.index(item))


badindex=[]
for i in range(len(useless_index)):
    list_useless_ids = darrayid[useless_index[i]]
    #print (darrayid[useless_index[i]])
    for j in range (len(list_useless_ids)):
        badindex.append(list_useless_ids[j])

print badindex
        #one
        


if (useless_index): #(checks if list is empty)
    assert (len(doublearray[useless_index[0]]) != array_length)

for item in filtered_list:
    assert (len(item) == array_length)
# ---------- end find_aa_index_2 ----------
cull_index = CullIndex(List=list_item_7, Indices=find_aa_index_2.badindex, Wrap=True)
cull_index_2 = CullIndex(List=list_item_8, Indices=find_aa_index_2.badindex, Wrap=True)
cull_index_3 = CullIndex(List=list_item_6, Indices=find_aa_index_2.badindex, Wrap=True)
cull_index_4 = CullIndex(List=list_item_5, Indices=find_aa_index_2.badindex, Wrap=True)
cull_index_5 = CullIndex(List=list_item_4, Indices=find_aa_index_2.badindex, Wrap=True)
cull_index_6 = CullIndex(List=list_item_3, Indices=find_aa_index_2.badindex, Wrap=True)

exposure_3 = Number(cull_index_3)
uptake_2 = Number(cull_index_2)
centre_2 = Number(cull_index)
start_aa_2 = Number(cull_index_5)
end_aa_2 = Number(cull_index_4)
exposure_4 = ClusterOutput(exposure_3)
centre_3 = ClusterOutput(centre_2)
start_aa_3 = ClusterOutput(start_aa_2)
end_aa_3 = ClusterOutput(end_aa_2)
uptake_3 = ClusterOutput(uptake_2)

sequence = Text(cull_index_6)
sequence_2 = ClusterOutput(sequence)

# ==== cluster PDB_Reader
pdb_path = ClusterInput()

# ---- group: PDB Reader
# Component to read a PDB file
# and output each item seperately
pdb_path_2 = FilePath(pdb_path)
read_file_universal = GhPythonScript(path=pdb_path_2)  # -> out, contents
# ---------- read_file_universal: Python ----------
"""An alternative to "read file" gh component, for Mac.
    Inputs:
        path: path of file
    Output:
        contents: output file in txt"""

__author__ = "Flora"
__version__ = "2021.04.13"

import rhinoscriptsyntax as rs
contents = []

try:
    with open(path, 'r') as fp:
        #contents = fp.read()
        for cnt, line in enumerate(fp):
            contents.append(line)
except:
    e = gh.GH_RuntimeMessageLevel.Warning
    ghenv.Component.AddRuntimeMessage(e, "Grasshopper cannot read lines in file: try 'read file component'")

fp.close()
# ---------- end read_file_universal ----------
filter_dbd = GhPythonScript(PDB=read_file_universal.contents)  # -> P, TER
# ---------- filter_dbd: Python ----------
"""Script to clean PDB files.
    Inputs:
        x: The x script variable
        y: The y script variable
    Output:
        a: The a P variable"""

__author__ = "Flora"
__version__ = "2020.10.23"

import rhinoscriptsyntax as rs

PDB = PDB.replace("            ",",")
PDB = PDB.replace("           ",",")
PDB = PDB.replace("          ",",")
PDB = PDB.replace("         ",",")
PDB = PDB.replace("        ",",")
PDB = PDB.replace("       ",",")
PDB = PDB.replace("      ",",")
PDB = PDB.replace("     ",",")
PDB = PDB.replace("    ",",")
PDB = PDB.replace("   ",",")
PDB = PDB.replace("  ",",")
PDB = PDB.replace(" ",",")
#PDB = PDB.replace("TER,","")

if PDB.find("TER"):
    P = PDB
# ---------- end filter_dbd ----------
num = Number([-1, -2])
cull_i = CullIndex(List=filter_dbd.P, Indices=num, Wrap=True)
split = TextSplit(Text=cull_i, Separators=",")

# ---- group: AA_id
amino_acid_id = ListItem(List=split, Index="0", Wrap=True)  # -> flatten(Item)

# ---- group: PDB Reader / Atoms_XYZ
z = ListItem(List=split, Index="8", Wrap=True)  # -> flatten(Item)
y = ListItem(List=split, Index="7", Wrap=True)  # -> flatten(Item)
x = ListItem(List=split, Index="6", Wrap=True)  # -> flatten(Item)
num_2 = Number(z)
num_3 = Number(y)
num_4 = Number(x)
pt = ConstructPoint(XCoordinate=num_4, YCoordinate=num_3, ZCoordinate=num_2)

# ---- group: PDB Reader / Atoms_name
item = ListItem(List=split, Index="2", Wrap=True)  # -> flatten(Item)
atoms_name = Text(item)

# ---- group: PDB Reader / AA_name
item_2 = ListItem(List=split, Index="3", Wrap=True)  # -> flatten(Item)
aa_name = Text(item_2)

# ---- group: PDB Reader / Atoms_order
atom_order = ListItem(List=split, Index="1", Wrap=True)  # -> flatten(Item)
atom_id = Number(atom_order)

# ---- group: PDB Reader / AA_id
amino_acid_id_2 = ListItem(List=split, Index="5", Wrap=True)  # -> flatten(Item)
aa_id = Number(amino_acid_id_2)

# ----
amino_acid_id_3 = ListItem(List=split, Index="9", Wrap=True)  # -> flatten(Item)
atom = Text(amino_acid_id_3)
atom_2 = Text(amino_acid_id)
atoms_name_2 = ClusterOutput(atoms_name)
atom_id_2 = ClusterOutput(atom_id)
aa_name_2 = ClusterOutput(aa_name)
atom_3 = ClusterOutput(atom)
aa_id_2 = ClusterOutput(aa_id)
atom_4 = ClusterOutput(atom_2)
xyz_point = ClusterOutput(pt)
