# Grasshopper definition dssp_test.gh (Grasshopper 1.0.7)
# Copyright: Use it.  Mod it.  Share it. Just please give credit and kepp this party going.
# Copyright: Use it.  Mod it.  Share it. Just please give credit and keep this party going.

panel = Panel("C:\Users\Flora\OneDrive - The Alan Turing Institute\Turing\1.Projects\3.Protein_folding\1.Data\GlyP_AMP.pdb")
location = Location()
path_to_pdb_file = PathToPDBFile()
threshold_count = ThresholdCount()  # threshold count for # consequtive residues for seconary structure
threshold_angle_α_vs_β = ThresholdAngleΑVsΒ()  # in radians
alpha_helix_color = AlphaHelixColor()
beta_sheet_color = BetaSheetColor()
loop_color = LoopColor()
path = FilePath(panel)

# ---- group: parsing if PDB file
file = ReadFile(File=path, PerLineParse=True)
split = TextSplit(Text=file, Separators="A")
item = ListItem(List=split, Index=-1, Wrap=True)
trim = TextTrim(Text=item, Start=True, End=True)
split_2 = TextSplit(Text=trim, Separators=" ")
pdb = ImportPDB(File=path)  # -> Atoms, Bonds

# ---- group: parsing if PDB data
split_3 = TextSplit(Text=path, Separators="A")
item_2 = ListItem(List=split_3, Index=-1, Wrap=True)
trim_2 = TextTrim(Text=item_2, Start=True, End=True)
split_4 = TextSplit(Text=trim_2, Separators=" ")
num = Number(split_4)
clean = CleanTree(RemoveNulls=True, RemoveInvalid=True, RemoveEmpty=True, Tree=num)
item_3 = ListItem(List=clean, Index=1, Wrap=True)  # -> Item, Item1, Item2
pt = ConstructPoint(XCoordinate=item_3.Item, YCoordinate=item_3.Item1, ZCoordinate=item_3.Item2)  # -> flatten(Point)

# ---- group: is it a PDB file or PDB data?
null = NullItem(Item=file)  # -> NullFlags, InvalidFlags, Description
item_4 = ListItem(List=flatten(null.NullFlags), Index=0, Wrap=True)
filter = StreamFilter(Gate=item_4, Stream0=split_2, Stream1=split_4)
filter_2 = StreamFilter(Gate=item_4, Stream0=pdb.Atoms, Stream1=pt)

# ---- group: reduce all atom points to AA residue points
item_5 = ListItem(List=filter, Index=0, Wrap=True)
int = Integer(item_5)
clean_2 = CleanTree(RemoveNulls=True, RemoveInvalid=True, RemoveEmpty=True, Tree=int)
subtraction = Subtraction(A=clean_2, B=1)
tstat = TreeStatistics(Tree=graft(filter_2))  # -> Paths, Length, Count
path_2 = ConstructPath(Indices=subtraction)  # -> flatten(Branch)
replace = ReplacePaths(Data=graft(filter_2), Search=tstat.Paths, Replace=path_2)
pt_2 = Point(replace)
item_6 = ListItem(List=pt_2, Index=0, Wrap=True)

# ----
panel_2 = Panel(replace)
panel_3 = Panel(item_6)

# ---- group: create a polyline from the AA residue points and analize angles to find helixes
pline = PolyLine(Vertices=flatten(item_6), Closed=False)
disc = Discontinuity(Curve=pline, Level=1)  # -> Points, Parameters
eval = EvaluateCurve(Curve=pline, Parameter=disc.Parameters)  # -> Point, Tangent, Angle
ta = Number(threshold_angle_α_vs_β)
larger = LargerThan(FirstNumber=eval.Angle, SecondNumber=ta)  # -> LargerThan, OrEqualTo

# ---- group: domains of secondary structures
lng = ListLength(List=larger.LargerThan)
shift = ShiftList(List=larger.LargerThan, Shift=1, Wrap=True)
series = Series(Start=0, Step=1, Count=lng)
equals = Equality(FirstNumber=larger.LargerThan, SecondNumber=shift)  # -> Equality, Inequality
int_2 = Integer(series)
subtraction_2 = Subtraction(A=lng, B=1)
dispatch = Dispatch(List=int_2, DispatchPattern=equals.Equality)  # -> ListA, ListB
ins = InsertItems(List=dispatch.ListB, Item=subtraction_2, Indices=-1, Wrap=True)
ins_2 = InsertItems(List=ins, Item=0, Indices=0, Wrap=True)
consec = ConsecutiveDomains(Numbers=ins_2, Additive=False)

# ---- group: break ribbon into secondary structures / determine sizes of secondary structure to distinguish between 1) alpha helixes and beta sheets or 2) loops
dedomain = DeconstructDomain(Domain=consec)  # -> Start, End
subtraction_3 = Subtraction(A=dedomain.End, B=dedomain.Start)
tc = Number(threshold_count)
larger_2 = LargerThan(FirstNumber=subtraction_3, SecondNumber=tc)  # -> LargerThan, OrEqualTo

# ---- group: break ribbon into secondary structures / points divided into secondary structure
subset = SubList(List=flatten(item_6), Domain=consec, Wrap=True)  # -> List, Index

# ----
tweek_orientation = Slider(0, range=0..10)

# ---- group: seperate helixes from sheets / is this the domain of an alpha helix?
dedomain_2 = DeconstructDomain(Domain=consec)  # -> Start, End
dom = ConstructDomain(DomainStart=expr("x+1", dedomain_2.Start), DomainEnd=dedomain_2.End)
subset_2 = SubList(List=flatten(larger.LargerThan), Domain=dom, Wrap=True)  # -> List, Index
item_7 = ListItem(List=subset_2.List, Index=0, Wrap=True)

# ----
pln = Plane(location)

# ---- group: seperate helixes and sheets from loops
dispatch_2 = Dispatch(List=subset.List, DispatchPattern=graft(larger_2.LargerThan))  # -> ListA, ListB

# ---- group: seperate helixes from sheets
dispatch_3 = Dispatch(List=dispatch_2.ListA, DispatchPattern=item_7)  # -> ListA, ListB

# ----
alph_helix_points = Point(dispatch_3.ListA)
beta_sheet_points = Point(dispatch_3.ListB)
loop_points = Point(dispatch_2.ListB)

intcrv = Interpolate(Vertices=beta_sheet_points, Degree=3, Periodic=False, KnotStyle=1)  # -> Curve, Length, Domain
intcrv_2 = Interpolate(Vertices=alph_helix_points, Degree=3, Periodic=False, KnotStyle=1)  # -> Curve, Length, Domain
intcrv_3 = Interpolate(Vertices=loop_points, Degree=3, Periodic=False, KnotStyle=1)  # -> Curve, Length, Domain
merge = Merge(Data1=intcrv_2.Curve, Data2=intcrv.Curve, Data3=intcrv_3.Curve)  # -> simplify(Result)
curve = Curve(merge)

clean_3 = CleanTree(RemoveNulls=True, RemoveInvalid=True, RemoveEmpty=True, Tree=intcrv_3.Curve)  # -> simplify(Tree)

# ---- group: loops
pipe = Pipe(Curve=clean_3, Radius=Slider(0.22, range=0..1), Caps=2)  # -> simplify(Pipe)
L = Shader(loop_color)
preview = CustomPreview(Geometry=pipe, Shader=L)

# ---- group: script that hides all outputs
c_script = CSharpScript()  # -> out; inputs Trigger: tree
# ---------- c_script: C# ----------
    // No code needed here.
# ---------- c_script: C# additional code ----------
  /// <summary>
  /// This method will be called once every solution, before any calls to RunScript.
  /// </summary>
  public override void BeforeRunScript()
  {
    if (GrasshopperDocument == null)
      return;
    
    // Get the owner (if any) of this document.
    IGH_DocumentOwner owner = GrasshopperDocument.Owner;
    if (owner == null)
      return;

    // See if the object owning this document is a cluster.
    IGH_Component cluster = owner as IGH_Component;
    if (cluster == null)
      return;

    // Iterate over all outputs.
    foreach (IGH_Param param in cluster.Params.Output)
    {
      IGH_PreviewObject previewParameter = param as IGH_PreviewObject;
      if (previewParameter != null)
        previewParameter.Hidden = true;
    }
  }
# ---------- end c_script ----------

# ---- group: orient the protein with the first helix or sheet aligned to the Z axis, with the midddle AA residue at the origin, and the middle AA residue of the last helix or sheet on the X axis / determine orientation
dispatch_4 = Dispatch(List=subset.List, DispatchPattern=graft(larger_2.LargerThan))  # -> ListA, ListB
clean_4 = CleanTree(RemoveNulls=True, RemoveInvalid=True, RemoveEmpty=True, Tree=dispatch_4.ListA)
browse = BranchBrowser(T=clean_4, i=tweek_orientation)
item_8 = ListItem(List=flatten(browse), Index=-1, Wrap=True)

# ----
lng_2 = ListLength(List=browse)  # -> expr("x/2", Length)

# ---- group: orient the protein with the first helix or sheet aligned to the Z axis, with the midddle AA residue at the origin, and the middle AA residue of the last helix or sheet on the X axis / determine orientation (continued)
item_9 = ListItem(List=flatten(browse), Index=lng_2, Wrap=True)

# ----
vec2pt = Vector2Pt(PointA=item_9, PointB=item_8, Unitize=False)  # -> Vector, Length
pl = PlaneNormal(Origin=item_9, ZAxis=vec2pt.Vector)

# ---- group: orient the protein with the first helix or sheet aligned to the Z axis, with the midddle AA residue at the origin, and the middle AA residue of the last helix or sheet on the X axis / orient AA residues
orient = Orient(Geometry=subset.List, Source=pl, Target=pln)  # -> Geometry, Transform
simplify = SimplifyTree(Tree=orient.Geometry, Front=False)
amino_acid_residue_points = AminoAcidResiduePoints(simplify)

# ---- group: orient the protein with the first helix or sheet aligned to the Z axis, with the midddle AA residue at the origin, and the middle AA residue of the last helix or sheet on the X axis / orient atoms
orient_2 = Orient(Geometry=pt_2, Source=pl, Target=pln)  # -> simplify(Geometry), Transform
all_atom_points = AllAtomPoints(orient_2.Geometry)

# ---- group: beta sheets
clean_5 = CleanTree(RemoveNulls=True, RemoveInvalid=True, RemoveEmpty=True, Tree=intcrv.Curve)  # -> simplify(Tree)

curvepoint = PointOnCurve(clean_5, parameter=0.5)
shift_2 = ShiftList(List=flatten(curvepoint), Shift=1, Wrap=True)  # -> graft(List)
vec2pt_2 = Vector2Pt(PointA=curvepoint, PointB=shift_2, Unitize=False)  # -> Vector, Length
pframe = PerpFrame(Curve=clean_5, Parameter=Slider(0, range=0..0.01))
align = AlignPlane(Plane=pframe, Direction=vec2pt_2.Vector)  # -> Plane, Angle

len = Length(Curve=clean_5)
subtraction_4 = Subtraction(A=len, B=Slider(2, range=0..10))

rectangle = Rectangle(Plane=align.Plane, XSize=Domain(-1.25, 1.25), YSize=Domain(-0.25, 0.25), Radius=0.1)  # -> Rectangle, Length
subcrv = SubCurve(BaseCurve=clean_5, Domain=subtraction_4)
swp1 = Sweep1(Rail=subcrv, Sections=rectangle.Rectangle, Miter=1)  # -> simplify(Brep)
edges = BrepEdges(Brep=swp1)  # -> Naked, Interior, NonManifold
item_10 = ListItem(List=edges.Naked, Index=0, Wrap=True)
offset_out = OffsetOut(curve=item_10, distance_or_xylinus_config=Slider(0.4, range=0..1))
end = EndPoints(Curve=clean_5)  # -> Start, End
extr = ExtrudePoint(Base=offset_out, Point=end.End)  # -> simplify(Extrusion)
β = Shader(beta_sheet_color)
cap = CapHoles(Brep=simplify([swp1, extr]))
sunion = SolidUnion(Breps=cap)

preview_2 = CustomPreview(Geometry=sunion, Shader=β)

# ---- group: alpha helices
clean_6 = CleanTree(RemoveNulls=True, RemoveInvalid=True, RemoveEmpty=True, Tree=intcrv_2.Curve)  # -> simplify(Tree)
pframe_2 = PerpFrame(Curve=clean_6, Parameter=0)
rectangle_2 = Rectangle(Plane=pframe_2, XSize=Domain(-0.25, 0.25), YSize=Domain(-1.25, 1.25), Radius=0.2)  # -> Rectangle, Length
α = Shader(alpha_helix_color)

# ----
extrcrv = ExtrudeAlong(Base=rectangle_2.Rectangle, Curve=clean_6)
cap_2 = CapHoles(Brep=extrcrv)  # -> simplify(Brep)

# ---- group: alpha helices (continued)
preview_3 = CustomPreview(Geometry=cap_2, Shader=α)

# ----
entwine = Entwine(Branch00=cap_2, Branch01=sunion, Branch02=pipe, FlattenInputs=True)
geo = Geometry(entwine)
ribbon = Ribbon(geo)

# ==== cluster BranchBrowser: allows you to scroll through the branchs of the tree sequentially using an integer instead of a path
T = ClusterInput()
i = ClusterInput()
tstat = TreeStatistics(Tree=T)  # -> Paths, Length, Count
item = ListItem(List=tstat.Paths, Index=i, Wrap=True)
branch = TreeBranch(Tree=T, Path=item, MaintainPaths=True)
B = ClusterOutput(branch)

# ==== cluster OffsetOut: Offset curves outward. Use for interior curves.
curve = ClusterInput()  # Curves to offset outwards.
distance_or_xylinus_config = ClusterInput()  # Distance to offset curve. If a config is input, the offset distance will be 1/2 the extrusion width.

# ---- group: if fed a config use 1/2 extrusion width, otherwise pass data
data = Data(distance_or_xylinus_config)
item = ListItem(List=data, Index=0, Wrap=True)
item_2 = ListItem(List=data, Index="3", Wrap=True)
box = Box(item)
division = Division(A=item_2, B=2)
null = NullItem(Item=box)  # -> NullFlags, InvalidFlags, Description
filter = StreamFilter(Gate=null.NullFlags, Stream0=division, Stream1=data)
distance = Number(filter)

# ---- group: interior
crv = Curve(curve)

# ----
number_slider = Slider(2, range=0..4)

# ---- group: run a test offset and check to see if it is bigger
D = Number(distance)
offset = Offset(Curve=crv, Distance=D, Plane=PlaneXY(0, 0, 0), Corners=number_slider)
trim = TrimTree(Tree=offset, Depth=1)
area = Area(Geometry=trim)  # -> Area, Centroid
area_2 = Area(Geometry=crv)  # -> Area, Centroid
larger = LargerThan(FirstNumber=area.Area, SecondNumber=area_2.Area)  # -> LargerThan, OrEqualTo

# ---- group: use test offset to determine the direction of the final offset
D_2 = Number(distance)
long = LongestList(ListA=larger.LargerThan, ListB=D_2, PaddingMode=2)  # -> ListA, ListB
neg = Negative(Value=long.ListB)
p_n_c = PickNChoose(Pattern=larger.LargerThan, Stream0=neg, Stream1=long.ListB)
offset_2 = Offset(Curve=crv, Distance=p_n_c, Plane=PlaneXY(0, 0, 0), Corners=number_slider)
trim_2 = TrimTree(Tree=offset_2, Depth=1)

# ---- group: double check and just ditch what isn't right
area_3 = Area(Geometry=trim_2)  # -> Area, Centroid
area_4 = Area(Geometry=crv)  # -> Area, Centroid
larger_2 = LargerThan(FirstNumber=area_3.Area, SecondNumber=area_4.Area)  # -> LargerThan, OrEqualTo
dispatch = Dispatch(List=trim_2, DispatchPattern=larger_2.LargerThan)  # -> ListA, ListB
crv_2 = Curve(dispatch.ListB)

# ---- group: double check and just ditch what isn't right / good interior offsets
crv_3 = Curve(dispatch.ListA)

# ----
offset_cruves = ClusterOutput(crv_3)
