# Grasshopper definition pdb_exporter.gh (Grasshopper 1.0.7)

pdb_path = FilePath()

# ---- group: PDB Reader
# Component to read a PDB file
# and output each item seperately
pdb_path_2 = FilePath(pdb_path)
read_file_universal = GhPythonScript(path=pdb_path_2)  # -> out, contents
# ---------- read_file_universal: Python ----------
"""An alternative to "read file" gh component, for Mac.
    Inputs:
        path: path of file
    Output:
        contents: output file in txt"""

__author__ = "Flora"
__version__ = "2021.04.13"

import rhinoscriptsyntax as rs
contents = []

try:
    with open(path, 'r') as fp:
        #contents = fp.read()
        for cnt, line in enumerate(fp):
            contents.append(line)
except:
    e = gh.GH_RuntimeMessageLevel.Warning
    ghenv.Component.AddRuntimeMessage(e, "Grasshopper cannot read lines in file: try 'read file component'")

fp.close()
# ---------- end read_file_universal ----------
filter_dbd = GhPythonScript(PDB=read_file_universal.contents)  # -> P, TER
# ---------- filter_dbd: Python ----------
"""Script to clean PDB files.
    Inputs:
        x: The x script variable
        y: The y script variable
    Output:
        a: The a P variable"""

__author__ = "Flora"
__version__ = "2020.10.23"

import rhinoscriptsyntax as rs

PDB = PDB.replace("            ",",")
PDB = PDB.replace("           ",",")
PDB = PDB.replace("          ",",")
PDB = PDB.replace("         ",",")
PDB = PDB.replace("        ",",")
PDB = PDB.replace("       ",",")
PDB = PDB.replace("      ",",")
PDB = PDB.replace("     ",",")
PDB = PDB.replace("    ",",")
PDB = PDB.replace("   ",",")
PDB = PDB.replace("  ",",")
PDB = PDB.replace(" ",",")
#PDB = PDB.replace("TER,","")

if PDB.find("TER"):
    P = PDB
# ---------- end filter_dbd ----------
num = Number([-1, -2])
cull_i = CullIndex(List=filter_dbd.P, Indices=num, Wrap=True)
split = TextSplit(Text=cull_i, Separators=",")

# ----
filter_dbd_2 = GhPythonScript(PDB=read_file_universal.contents)  # -> P, TER
# ---------- filter_dbd_2: Python ----------
"""Script to clean PDB files.
    Inputs:
        x: The x script variable
        y: The y script variable
    Output:
        a: The a P variable"""

__author__ = "Flora"
__version__ = "2020.10.23"

import rhinoscriptsyntax as rs


atom = PDB[0:6]
id = PDB[6:11]
null1= PDB[11:13]
atom_name = PDB[13:16]
AA_name = PDB[16:20]
chain = PDB[20:22]
AA_no = PDB[22:27]
x= PDB[27:38]
y= PDB[38:48]

print (x)

#PDB = PDB.replace("TER,","")

#if PDB.find("TER"):
#    P = PDB
# ---------- end filter_dbd_2 ----------

# ---- group: AA_id
amino_acid_id = ListItem(List=split, Index="0", Wrap=True)  # -> flatten(Item)

# ---- group: PDB Reader / Atoms_XYZ
z = ListItem(List=split, Index="8", Wrap=True)  # -> flatten(Item)
y = ListItem(List=split, Index="7", Wrap=True)  # -> flatten(Item)
x = ListItem(List=split, Index="6", Wrap=True)  # -> flatten(Item)
num_2 = Number(z)
num_3 = Number(y)
num_4 = Number(x)
pt = ConstructPoint(XCoordinate=num_4, YCoordinate=num_3, ZCoordinate=num_2)

# ---- group: PDB Reader / Atoms_name
item = ListItem(List=split, Index="2", Wrap=True)  # -> flatten(Item)
atoms_name = Text(item)

# ---- group: PDB Reader / AA_name
item_2 = ListItem(List=split, Index="3", Wrap=True)  # -> flatten(Item)
aa_name = Text(item_2)

# ---- group: PDB Reader / Atoms_order
atom_order = ListItem(List=split, Index="1", Wrap=True)  # -> flatten(Item)
atom_order_2 = Number(atom_order)

# ---- group: PDB Reader / AA_id
amino_acid_id_2 = ListItem(List=split, Index="5", Wrap=True)  # -> flatten(Item)
aa_id = Number(amino_acid_id_2)

# ----
amino_acid_id_3 = ListItem(List=split, Index="9", Wrap=True)  # -> flatten(Item)
atom = Text(amino_acid_id_3)
atom_2 = Text(amino_acid_id)
atoms_name_2 = Text(atoms_name)
atom_order_3 = Number(atom_order_2)
aa_name_2 = Text(aa_name)
atom_3 = Text(atom)
aa_id_2 = Number(aa_id)
atom_4 = Text(atom_2)
xyz_point = Point(pt)
