# Grasshopper definition pdb_reader2.gh (Grasshopper 1.0.7)
# Copyright: Use it.  Mod it.  Share it. Just please give credit and keep this party going.
# Copyright: Use it.  Mod it.  Share it. Just please give credit and kepp this party going.
# plug-ins: Human UI, Human

# ---- group: AMP activated state / PDB reader
path = FilePath("C:\Users\Flora\OneDrive - The Alan Turing Institute\Turing\3.Protein_folding\1.Data\GlyP_AMP.pdb")
file = ReadFile(File=path, PerLineParse=True)
pdb_open = PDBOpen(protein_data_base_file=path, index=0)  # -> protein_data_selected, protein_data_all
filter_dbd = GhPythonScript(input=file)  # -> output
# ---------- filter_dbd: Python ----------
__author__ = "Flora"
__version__ = "2020.10.23"

import rhinoscriptsyntax as rs

input = input.replace("            ",",")
input = input.replace("           ",",")
input = input.replace("          ",",")
input = input.replace("         ",",")
input = input.replace("        ",",")
input = input.replace("       ",",")
input = input.replace("      ",",")
input = input.replace("     ",",")
input = input.replace("    ",",")
input = input.replace("   ",",")
input = input.replace("  ",",")
input = input.replace(" ",",")
input = input.replace("TER,","")
output = input
# ---------- end filter_dbd ----------
num = Number([-1, -2])
cull_i = CullIndex(List=filter_dbd, Indices=num, Wrap=True)
split = TextSplit(Text=cull_i, Separators=",")

# ----
panel = Panel(filter_dbd)

# ---- group: deactivated state / PDB reader
path_2 = FilePath("C:\Users\Flora\OneDrive - The Alan Turing Institute\Turing\3.Protein_folding\1.Data\GlyP_G6P.pdb")
file_2 = ReadFile(File=path_2, PerLineParse=True)
pdb_open_2 = PDBOpen(protein_data_base_file=path_2, index=0)  # -> protein_data_selected, protein_data_all
filter_dbd_2 = GhPythonScript(input=file_2)  # -> output
# ---------- filter_dbd_2: Python ----------
__author__ = "Flora"
__version__ = "2020.10.23"

import rhinoscriptsyntax as rs

input = input.replace("            ",",")
input = input.replace("           ",",")
input = input.replace("          ",",")
input = input.replace("         ",",")
input = input.replace("        ",",")
input = input.replace("       ",",")
input = input.replace("      ",",")
input = input.replace("     ",",")
input = input.replace("    ",",")
input = input.replace("   ",",")
input = input.replace("  ",",")
input = input.replace(" ",",")
output = input
# ---------- end filter_dbd_2 ----------
num_2 = Number([-1, -2])
cull_i_2 = CullIndex(List=filter_dbd_2, Indices=num_2, Wrap=True)
split_2 = TextSplit(Text=cull_i_2, Separators=",")

# ---- group: Parse csv
path_3 = FilePath("C:\Users\Flora\OneDrive - The Alan Turing Institute\Turing\3.Protein_folding\1.Data\State_data_all.csv")
state_data = ReadFile(File=path_3, PerLineParse=True)
num_3 = Number(0)
cull_i_3 = CullIndex(List=state_data, Indices=num_3, Wrap=True)
split_3 = TextSplit(Text=cull_i_3, Separators=",")

# ----
z = Slider(9, range=0..10)
z_2 = Slider(10, range=0..10)
z_3 = Slider(2, range=0..10)
z_4 = Slider(1, range=0..10)
end_aa = ListItem(List=split_3, Index=z_3, Wrap=True)  # -> flatten(Item)
start_aa = ListItem(List=split_3, Index=z_4, Wrap=True)  # -> flatten(Item)
centre = ListItem(List=split_3, Index=z_2, Wrap=True)  # -> flatten(Item)
panel_2 = Panel(centre)
exposure = ListItem(List=split_3, Index=z, Wrap=True)  # -> flatten(Item)

# ---- group: AMP activated state / Atoms_XYZ
z_5 = Slider(8, range=0..10)
y = Slider(7, range=0..10)
x = Slider(6, range=0..20)
z_6 = ListItem(List=split, Index=z_5, Wrap=True)  # -> flatten(Item)
y_2 = ListItem(List=split, Index=y, Wrap=True)  # -> flatten(Item)
x_2 = ListItem(List=split, Index=x, Wrap=True)  # -> flatten(Item)
num_4 = Number(x_2)
num_5 = Number(z_6)
num_6 = Number(y_2)
pt = ConstructPoint(XCoordinate=num_4, YCoordinate=num_6, ZCoordinate=num_5)

# ---- group: AMP activated state / Atoms_name
item = ListItem(List=split, Index=Slider(2, range=0..10), Wrap=True)  # -> flatten(Item)
panel_3 = Panel(item)

# ----
panel_4 = Panel(start_aa)

# ---- group: deactivated state / Atoms_XYZ
z_7 = Slider(8, range=0..10)
y_3 = Slider(7, range=0..10)
x_3 = Slider(6, range=0..20)
z_8 = ListItem(List=split_2, Index=z_7, Wrap=True)  # -> flatten(Item)
y_4 = ListItem(List=split_2, Index=y_3, Wrap=True)  # -> flatten(Item)
x_4 = ListItem(List=split_2, Index=x_3, Wrap=True)  # -> flatten(Item)
num_7 = Number(x_4)
num_8 = Number(z_8)
num_9 = Number(y_4)
pt_2 = ConstructPoint(XCoordinate=num_7, YCoordinate=num_9, ZCoordinate=num_8)

# ---- group: deactivated state / Atoms_name
item_2 = ListItem(List=split_2, Index=Slider(2, range=0..10), Wrap=True)  # -> flatten(Item)
panel_5 = Panel(item_2)

# ---- group: AMP activated state / AA_name
item_3 = ListItem(List=split, Index=Slider(3, range=0..10), Wrap=True)  # -> flatten(Item)
panel_6 = Panel(item_3)

# ---- group: AMP activated state / Atoms_order
z_9 = Slider(1, range=0..10)
atom_order = ListItem(List=split, Index=z_9, Wrap=True)  # -> flatten(Item)
num_10 = Number(atom_order)

# ---- group: deactivated state / AA_name
item_4 = ListItem(List=split_2, Index=Slider(3, range=0..10), Wrap=True)  # -> flatten(Item)
panel_7 = Panel(item_4)

# ---- group: deactivated state / Atoms_order
z_10 = Slider(1, range=0..10)
atom_order_2 = ListItem(List=split_2, Index=z_10, Wrap=True)  # -> flatten(Item)
num_11 = Number(atom_order_2)

# ---- group: deactivated state / AA_number
amino_acid = ListItem(List=split_2, Index=Slider(5, range=0..10), Wrap=True)  # -> flatten(Item)
num_12 = Number(amino_acid)

# ---- group: AMP activated state / AA_number
amino_acid_2 = ListItem(List=split, Index=Slider(5, range=0..10), Wrap=True)  # -> flatten(Item)
num_13 = Number(amino_acid_2)

# ----
num_14 = Number(exposure)
num_15 = Number(centre)
num_16 = Number(start_aa)
num_17 = Number(end_aa)
python = GhPythonScript(From=Slider(0, range=0..10), To=Slider(7, range=0..10))  # -> out, a
# ---------- python: Python ----------
__author__ = "Flora"
__version__ = "2021.01.18"

import rhinoscriptsyntax as rs


a = str(From) +" To "+ str(To)
print (a)
# ---------- end python ----------
tree = GhPythonScript(index=Slider(7, range=0..10))  # -> out, tree; inputs L: list
# ---------- tree: Python ----------
__author__ = "Flora"
__version__ = "2020.10.28"

"""
Takes a llist and turns it into a tree per fixed no of elements.
    Inputs:
        L: list of elements 
        index: no of elements per tree
        
    Output:
        tree: output tree

"""


import rhinoscriptsyntax as rs



for i in L 


#Created By piac
#from https://gist.github.com/piac/ef91ac83cb5ee92a1294
def list_to_tree(input, none_and_holes=True, source=[0]):
    """Transforms nestings of lists or tuples to a Grasshopper DataTree"""
    from Grasshopper import DataTree as Tree
    from Grasshopper.Kernel.Data import GH_Path as Path
    from System import Array
    def proc(input,tree,track):
        path = Path(Array[int](track))
        if len(input) == 0 and none_and_holes: tree.EnsurePath(path); return
        for i,item in enumerate(input):
            if hasattr(item, '__iter__'): #if list or tuple
                track.append(i); proc(item,tree,track); track.pop()
            else:
                if none_and_holes: tree.Insert(item,path,i)
                elif item is not None: tree.Add(item,path)
    if input is not None: t=Tree[object]();proc(input,t,source[:]);return t


xyz=list_to_tree(L)



#print (atoms_xyz_list)
# ---------- end tree ----------
merge = Merge()
subset = SubList(List=centre, Domain=python.a, Wrap=True)  # -> List, Index
subset_2 = SubList(List=num_17, Domain=python.a, Wrap=True)  # -> List, Index
subset_3 = SubList(List=num_16, Domain=python.a, Wrap=True)  # -> List, Index
entwine = Entwine(FlattenInputs=True)
panel_8 = Panel(subset_2.List)
panel_9 = Panel(subset.List)
panel_10 = Panel(subset_3.List)
filter_aminoacid_properties = GhPythonScript(AA=num_12, AA_name=item_4, xyz=pt_2, atoms=item_2)  # -> out, atoms_xyz_list, atoms_name_list, amino_list; inputs AA: list of Int32, AA_name: list, xyz: list, atoms: list
#   port AA: Amino Acid names
# ---------- filter_aminoacid_properties: Python ----------
__author__ = "Flora"
__version__ = "2020.10.28"

"""
Provides a scripting component.
    Inputs:
        AA: Amino Acid id number (int list)
        AA_name: Amino Acid name (string list)
        xyz: coordinates in 3Dspace per atom (3d point rhino item)
        atoms: atom names (string list)
    Output:
        a: xyz coordinates for debug
        start: list of coordinates of all atoms per AA (for starting points of lines) 
        end: list of coordinates of all atoms per AA (for ending poins of lines)
"""


import rhinoscriptsyntax as rs

counter=-1

amino_list=[]

atom_xyz_list=[]
atom_name_list=[]
atoms_name_list=[]
atoms_xyz_list=[]



# store list of atoms per aminoacid
for i in range (len(xyz)):
    if AA[i]!=counter: #a new aminoacid
        if atom_xyz_list != []:
            atoms_xyz_list.append(atom_xyz_list) #store list of atoms per AA
            atoms_name_list.append(atom_name_list)
        counter=AA[i]
        atom_xyz_list=[]
        atom_name_list=[]
        atom_xyz_list.append(xyz[i])
        atom_name_list.append(atoms[i])

        amino_list.append(AA_name[i]) #stores name per chain of AA
    else: # existing aminoacid
        atom_xyz_list.append(xyz[i])
        atom_name_list.append(atoms[i])

atoms_xyz_list.append(atom_xyz_list) #store list of atoms of final AA
atoms_name_list.append(atom_name_list)#store list of atoms names of final AA
# ---------- end filter_aminoacid_properties ----------
filter_aminoacid_properties_2 = GhPythonScript(AA=num_13, AA_name=item_3, xyz=pt, atoms=item)  # -> out, atoms_xyz_list, atoms_name_list, amino_list; inputs AA: list of Int32, AA_name: list, xyz: list, atoms: list
#   port AA: Amino Acid names
# ---------- filter_aminoacid_properties_2: Python ----------
__author__ = "Flora"
__version__ = "2020.10.28"

"""
This script stores lists of the AA coordinates and properties per AA atom.
eg. [['75.814,-34.543,47.16', '74.639,-34.529,48.079'...],[...]]
    Inputs:
        AA: Amino Acid id number (int list)
        AA_name: Amino Acid name (string list)
        xyz: coordinates in 3Dspace per atom (3d point rhino item)
        atoms: atom names (string list)
    Output:
        a: xyz coordinates for debug
        start: list of coordinates of all atoms per AA (for starting points 
        of lines)
        end: list of coordinates of all atoms per AA (for ending poins of lines)
"""


import rhinoscriptsyntax as rs

counter=-1

amino_list=[]

atom_xyz_list=[]
atom_name_list=[]
atoms_name_list=[]
atoms_xyz_list=[]

x,y,z=[],[],[]

#TODO: seperate per protein ("TER") 

# store list of atoms per aminoacid
for i in range (len(xyz)):
    if AA[i]!=counter: #a new aminoacid
        if atom_xyz_list != []:
            atoms_xyz_list.append(atom_xyz_list) #store list of atoms per AA
            atoms_name_list.append(atom_name_list)
        counter=AA[i]
        atom_xyz_list=[]
        atom_name_list=[]
        atom_xyz_list.append(xyz[i])
        atom_name_list.append(atoms[i])

        amino_list.append(AA_name[i]) #stores name per chain of AA
    else: # existing aminoacid
        atom_xyz_list.append(xyz[i])
        atom_name_list.append(atoms[i])

atoms_xyz_list.append(atom_xyz_list) #store list of atoms of final AA
atoms_name_list.append(atom_name_list)#store list of atoms names of final AA
# ---------- end filter_aminoacid_properties_2 ----------
python_2 = GhPythonScript(From=panel_10, To=panel_8)  # -> out, a; same code as python

subtraction = Subtraction(A=num_17, B=num_16)
addition = Addition(A=subtraction, B=1)
series = Series(Start=num_16, Step=1, Count=addition)

panel_11 = Panel(python_2.out)
xyz_tree = GhPythonScript(xyz=filter_aminoacid_properties_2.atoms_xyz_list)  # -> out, x_list, y_list, z_list; inputs xyz: list
# ---------- xyz_tree: Python ----------
__author__ = "Flora"
__version__ = "2020.10.28"

"""
This componment gets the x,y,z list and creates seperate x,y,z, lists per AA 
atom.
    Inputs:
        AA: Amino Acid id number (int list)
        AA_name: Amino Acid name (string list)
        xyz: coordinates in 3Dspace per atom (3d point rhino item)
        atoms: atom names (string list)
    Output:
        a: xyz coordinates for debug
        start: list of coordinates of all atoms per AA (for starting points of lines) 
        end: list of coordinates of all atoms per AA (for ending poins of lines)
"""


import rhinoscriptsyntax as rs


x_list,y_list,z_list=[],[],[]

def create_xyz_list():

    for i in range (len(xyz)):
        x1,y1,z1=[],[],[]
        for j in range (len(xyz[i])):
            if (xyz[i][j]!=None):
                xyz_str= str(xyz[i][j])
                x,y,z= xyz_str.split(",")
                x1.append(x)
                y1.append(y)
                z1.append(z)
            else:
                x1.append("Ter")
                y1.append("Ter")
                z1.append("Ter")
        x_list.append(x1)
        y_list.append(y1)
        z_list.append(z1)


create_xyz_list()
# ---------- end xyz_tree ----------
xyz_tree_2 = GhPythonScript(xyz=filter_aminoacid_properties.atoms_xyz_list)  # -> out, x_list, y_list, z_list; inputs xyz: list
# ---------- xyz_tree_2: Python ----------
__author__ = "Flora"
__version__ = "2020.10.28"

"""
Provides a scripting component.
    Inputs:
        AA: Amino Acid id number (int list)
        AA_name: Amino Acid name (string list)
        xyz: coordinates in 3Dspace per atom (3d point rhino item)
        atoms: atom names (string list)
    Output:
        a: xyz coordinates for debug
        start: list of coordinates of all atoms per AA (for starting points of lines) 
        end: list of coordinates of all atoms per AA (for ending poins of lines)
"""


import rhinoscriptsyntax as rs


x_list,y_list,z_list=[],[],[]

def create_xyz_list():

    for i in range (len(xyz)):
        x1,y1,z1=[],[],[]
        for j in range (len(xyz[i])):
            if (xyz[i][j]!=None):
                xyz_str= str(xyz[i][j])
                x,y,z= xyz_str.split(",")
                x1.append(x)
                y1.append(y)
                z1.append(z)
            else:
                x1.append("None")
        x_list.append(x1)
        y_list.append(y1)
        z_list.append(z1)

create_xyz_list()
# ---------- end xyz_tree_2 ----------
xyz_tree_3 = GhPythonScript(xyz=filter_aminoacid_properties_2.atoms_xyz_list)  # -> out, xyz; inputs xyz: list
# ---------- xyz_tree_3: Python ----------
__author__ = "Flora"
__version__ = "2020.10.28"

"""
Provides a scripting component.
    Inputs:
        AA: Amino Acid id number (int list)
        AA_name: Amino Acid name (string list)
        xyz: coordinates in 3Dspace per atom (3d point rhino item)
        atoms: atom names (string list)
    Output:
        a: xyz coordinates for debug
        start: list of coordinates of all atoms per AA (for starting points of lines) 
        end: list of coordinates of all atoms per AA (for ending poins of lines)
"""


import rhinoscriptsyntax as rs



#Created By piac
#from https://gist.github.com/piac/ef91ac83cb5ee92a1294
def list_to_tree(input, none_and_holes=True, source=[0]):
    """Transforms nestings of lists or tuples to a Grasshopper DataTree"""
    from Grasshopper import DataTree as Tree
    from Grasshopper.Kernel.Data import GH_Path as Path
    from System import Array
    def proc(input,tree,track):
        path = Path(Array[int](track))
        if len(input) == 0 and none_and_holes: tree.EnsurePath(path); return
        for i,item in enumerate(input):
            if hasattr(item, '__iter__'): #if list or tuple
                track.append(i); proc(item,tree,track); track.pop()
            else:
                if none_and_holes: tree.Insert(item,path,i)
                elif item is not None: tree.Add(item,path)
    if input is not None: t=Tree[object]();proc(input,t,source[:]);return t


xyz=list_to_tree(xyz)



#print (atoms_xyz_list)
# ---------- end xyz_tree_3 ----------
panel_12 = Panel(num_14)

linear_interpolation = GhPythonScript(
    x1=xyz_tree.x_list,
    x2=xyz_tree_2.x_list,
    y1=xyz_tree.y_list,
    y2=xyz_tree_2.y_list,
    z1=xyz_tree.z_list,
    z2=xyz_tree_2.z_list,
    p=Slider(0.5, range=0..1))  # -> out, x; inputs x1: list, x2: list, y1: list, y2: list, z1: list, z2: list
# ---------- linear_interpolation: Python ----------
__author__ = "Flora"
__version__ = "2020.11.12"

import rhinoscriptsyntax as rs

x,y,z=[],[],[]
#x=p*(x2-x1)+x1
for i in range(len(x1)):
    xyz_temp=[]
    for j in range (len(x1[i])):
        if x1[i][j]!= "Ter":
            x1f= float(x1[i][j])
            x2f= float(x2[i][j])
            x_new=p*(x2f-x1f)+x1f

            y1f= float(y1[i][j])
            y2f= float(y2[i][j])
            y_new=p*(y2f-y1f)+y1f
            
            z1f= float(z1[i][j])
            z2f= float(z2[i][j])
            z_new=p*(z2f-z1f)+z1f
            
            xyz_temp.append("%s,%s,%s" %(x_new,y_new,z_new))
        else:
            x.append("Ter")
    x.append(xyz_temp)
# ---------- end linear_interpolation ----------

cset = CreateSet(List=panel_12)  # -> Set, Map
md_slider = MDSlider(
    SliderMode=0,
    slider_value=Point(0.367315525, 0.3217071905, 0.5),
    x_domain=Domain(0, 100),
    y_domain=Domain(0, 100),
    z_domain=Domain(0, 1))
cloud = CloudDisplay(Colours=RGB(255, 20, 147), Size=0.5, SpriteType=0)  # disabled
panel_13 = Panel(cset.Set)
equals = Equality(FirstNumber=graft(cset.Set), SecondNumber=panel_12)  # -> Equality, Inequality

# ---- group: UI
slider = CreateSlider(Slider=Slider(10, range=0..10), ShowBounds=False, ShowTicks=False, ShowTooltip=False, ShowValLabel=True, showLabel=True)
launchwin = LaunchWindow(
    Show=Toggle(False),
    Name="Control Window",
    Width=Slider(800, range=0..1000),
    Height=Slider(600, range=0..1000),
    ChildStatus=0,
    EnableHorizScroll=False)
addelems = AddElements(Window=launchwin, Elements=flatten(slider), DoVLChecking=True)  # -> AddedElements, ElementNames

# ----
sidechains_to_trees = GhPythonScript(
    AA_slider=Slider(146, range=0..835),
    atoms_xyz_list=linear_interpolation.x,
    atoms_name_list=filter_aminoacid_properties_2.atoms_name_list,
    amino_list=filter_aminoacid_properties_2.amino_list)  # -> out, atoms, AA_name, start, end, atom_names, atom_xyz; inputs AA_slider: Int32, atoms_xyz_list: list, atoms_name_list: list, amino_list: list
# ---------- sidechains_to_trees: Python ----------
__author__ = "Flora"
__version__ = "2020.10.28"

"""
Provides a scripting component.
    Inputs:
        AA: Amino Acid id number (int list)
        AA_name: Amino Acid name (string list)
        xyz: coordinates in 3Dspace per atom (3d point rhino item)
        atoms: atom names (string list)
    Output:
        a: xyz coordinates for debug
        start: list of coordinates of all atoms per AA (for starting points of lines) 
        end: list of coordinates of all atoms per AA (for ending poins of lines)
"""


import rhinoscriptsyntax as rs


sidechains_dict = {
"GLN":{"A": ["C","C","CA","CA","CB","CG","CD","CD"],
    "B":["O","CA","N","CB","CG","CD","NE2","OE1"]},
"GLU":{"A": ["C","C","CA","CA","CB","CG","CD","CD"],
    "B":["O","CA","N","CB","CG","CD","OE2","OE1"]},
"LYS":{"A": ["C","C","CA","CA","CB","CG","CD","CE"],
    "B": ["O","CA","N","CB","CG","CD","CE","NZ"]},
"ARG":{"A":["C","C","CA","CA","CB","CG","CD","NE","CZ","CZ"],
    "B": ["O","CA","N","CB","CG","CD","NE","CZ","NH1","NH2"]},
"ILE":{"A": ["C","C","CA","CA","CB","CB","CG1"],
    "B": ["O","CA","N","CB","CG1","CG2","CD1"]},
"SER":{"A": ["C","C","CA","CA","CB"],
    "B": ["O","CA","N","CB","OG"]},
"VAL":{"A": ["C","C","CA","CA","CB","CB"],
    "B": ["O","CA","N","CB","CG2","CG1"]},
"HIS": {"A": ["C","C","CA","CA","CB","CG","CG","CD2","CE1","ND1"], 
    "B": ["O","CA","N","CB","CG","ND1","CD2","NE2","NE2","CE1"]},
"GLY":{"A":["C","C","CA"],
    "B": ["O","CA","N"]},
"LEU":{"A": ["C","C","CA","CA","CB","CG","CG"],
    "B": ["O","CA","N","CB","CG","CD1","CD2"]},
"ALA":{"A": ["C","C","CA","CA"],
    "B": ["O","CA","N","CB"]},
"ASN":{"A": ["C","C","CA","CA","CB","CG","CG"],
    "B": ["O","CA","N","CB","CG","OD1","ND2"]},
"THR":{"A": ["C","C","CA","CA","CB","CB"],
    "B": ["O","CA","N","CB","CG2","OG1"]},
"PRO":{"A": ["C","C","CA","CA","CB","CG","CD"],
    "B": ["O","CA","N","CB","CG","CD","N"]},
"ASP":{"A":["C","C","CA","CA","CB","CG","CG"],
    "B": ["O","CA","N","CB","CG","OD1","OD2"]},
"TYR":{"A": ["C","C","CA","CA","CB","CG","CG","CD1","CD2","CE1","CE2","CZ"],
    "B": ["O","CA","N","CB","CG","CD1","CD2","CE1","CE2","CZ","CZ","OH"]},
"PHE":{"A": ["C","C","CA","CA","CB","CG","CG","CD1","CD2","CE1","CE2"],
    "B": ["O","CA","N","CB","CG","CD1","CD2","CE1","CE2","CZ","CZ"]},
"TRP":{"A": ["C","C","CA","CA","CB","CG","CG","CD1","CD2","NE1","CD2","CE2","CE3","CZ3","CH2"], 
    "B": ["O","CA","N","CB","CG","CD2","CD1","NE1","CE2","CE2","CE3","CZ2","CZ3","CH2","CZ2"]},
}



amino_start =[]
amino_end=[]

atom_names=[]
atom_xyz=[]
AA_sublist=[]



def construct_sidechains_points():
    None

def construct_sidechains(amino_list,atoms_name_list,atoms_xyz_list):

    for i in range (AA_slider): # (len(amino_list))
        amino_acid = sidechains_dict.get(amino_list[i])
        
        if(amino_acid != None): #if the amino acid exists in the pdb exists in the current dictionary
            AA_sublist.append(amino_list[i])
            
            A = amino_acid.get('A') #get the list of the first points of the AA
            B = amino_acid.get('B') #get the list of the second points of the AA
            atom_list = atoms_name_list[i]
            xyz_list = atoms_xyz_list[i]
            

            #fix beggining and end for lines
            start, end= sidechain(amino_acid,A,B,atom_list,xyz_list)
             
            amino_start.append(start)
            amino_end.append(end)
            
            atom_names.append(atom_list)
            atom_xyz.append(xyz_list)

        else: error = "Amino Acid doesnt exist"

def sidechain(amino_acid,A,B,atom_list,xyz_list):
    start, end=[],[]
    for x in range (len(A)):
        for y in range (len(atom_list)):  #atom_list to change with slider
            if (A[x]==atom_list[y]):
                start.append(xyz_list[y])
            if (B[x]==atom_list[y]):
                end.append(xyz_list[y])
    return (start,end)


#Created By piac
#from https://gist.github.com/piac/ef91ac83cb5ee92a1294
def list_to_tree(input, none_and_holes=True, source=[0]):
    """Transforms nestings of lists or tuples to a Grasshopper DataTree"""
    from Grasshopper import DataTree as Tree
    from Grasshopper.Kernel.Data import GH_Path as Path
    from System import Array
    def proc(input,tree,track):
        path = Path(Array[int](track))
        if len(input) == 0 and none_and_holes: tree.EnsurePath(path); return
        for i,item in enumerate(input):
            if hasattr(item, '__iter__'): #if list or tuple
                track.append(i); proc(item,tree,track); track.pop()
            else:
                if none_and_holes: tree.Insert(item,path,i)
                elif item is not None: tree.Add(item,path)
    if input is not None: t=Tree[object]();proc(input,t,source[:]);return t

#print (atoms_xyz_list)
#sidechain(atoms_xyz_list, amino_names, atoms_name_list)
construct_sidechains(amino_list,atoms_name_list,atoms_xyz_list)
atoms= list_to_tree(atom_xyz)

atom_names=list_to_tree(atom_names)
atom_xyz=list_to_tree(atom_xyz)
AA_name=list_to_tree(AA_sublist)
start= list_to_tree(amino_start)
end=list_to_tree(amino_end)

print (AA_sublist)
#print (atoms_xyz_list)
# ---------- end sidechains_to_trees ----------
pt_3 = Point(sidechains_to_trees.start)
converttopythonlists = GhPythonScript(data=pt_3)  # -> output; inputs data: tree of Point3d
# ---------- converttopythonlists: Python ----------
__author__ = "Flora"
__version__ = "2021.01.18"

import rhinoscriptsyntax as rs

#Created By piac
#from https://gist.github.com/piac/ef91ac83cb5ee92a1294
def list_to_tree(input, none_and_holes=True, source=[0]):
    """Transforms nestings of lists or tuples to a Grasshopper DataTree"""
    from Grasshopper import DataTree as Tree
    from Grasshopper.Kernel.Data import GH_Path as Path
    from System import Array
    def proc(input,tree,track):
        path = Path(Array[int](track))
        if len(input) == 0 and none_and_holes: tree.EnsurePath(path); return
        for i,item in enumerate(input):
            if hasattr(item, '__iter__'): #if list or tuple
                track.append(i); proc(item,tree,track); track.pop()
            else:
                if none_and_holes: tree.Insert(item,path,i)
                elif item is not None: tree.Add(item,path)
    if input is not None: t=Tree[object]();proc(input,t,source[:]);return t
    
#Created By piac
#from https://gist.github.com/piac/ef91ac83cb5ee92a1294
# written by Giulio Piacentino, giulio@mcneel.com
def tree_to_list(input, retrieve_base = lambda x: x[0]):
    """Returns a list representation of a Grasshopper DataTree"""
    def extend_at(path, index, simple_input, rest_list):
        target = path[index]
        if len(rest_list) <= target: rest_list.extend([None]*(target-len(rest_list)+1))
        if index == path.Length - 1:
            rest_list[target] = list(simple_input)
        else:
            if rest_list[target] is None: rest_list[target] = []
            extend_at(path, index+1, simple_input, rest_list[target])
    all = []
    for i in range(input.BranchCount):
        path = input.Path(i)
        extend_at(path, 0, input.Branch(path), all)
    return retrieve_base(all)

output=[]

output=tree_to_list(data)
# ---------- end converttopythonlists ----------
selectionfromlists = GhPythonScript(Lists=converttopythonlists, selection=series)  # -> output; inputs Lists: list, selection: tree
# ---------- selectionfromlists: Python ----------
__author__ = "Flora"
__version__ = "2021.01.18"

import rhinoscriptsyntax as rs

output=[]

for i in range(selection.BranchCount):
    subOutput=[]
    for ii in selection.Branch(i):
        number=int(ii)
        print(number)
        if number<len(Lists):
            subOutput.append(Lists[number])
    output.append(subOutput)

#Created By piac
#from https://gist.github.com/piac/ef91ac83cb5ee92a1294
def list_to_tree(input, none_and_holes=True, source=[0]):
    """Transforms nestings of lists or tuples to a Grasshopper DataTree"""
    from Grasshopper import DataTree as Tree
    from Grasshopper.Kernel.Data import GH_Path as Path
    from System import Array
    def proc(input,tree,track):
        path = Path(Array[int](track))
        if len(input) == 0 and none_and_holes: tree.EnsurePath(path); return
        for i,item in enumerate(input):
            if hasattr(item, '__iter__'): #if list or tuple
                track.append(i); proc(item,tree,track); track.pop()
            else:
                if none_and_holes: tree.Insert(item,path,i)
                elif item is not None: tree.Add(item,path)
    if input is not None: t=Tree[object]();proc(input,t,source[:]);return t


#output=list_to_tree(output)
# ---------- end selectionfromlists ----------
panel_14 = Panel(sidechains_to_trees.AA_name)
decomposelist = GhPythonScript(Lists=selectionfromlists)  # -> output; inputs Lists: list
# ---------- decomposelist: Python ----------
__author__ = "Flora"
__version__ = "2021.01.18"

import rhinoscriptsyntax as rs



#Created By piac
#from https://gist.github.com/piac/ef91ac83cb5ee92a1294
def list_to_tree(input, none_and_holes=True, source=[0]):
    """Transforms nestings of lists or tuples to a Grasshopper DataTree"""
    from Grasshopper import DataTree as Tree
    from Grasshopper.Kernel.Data import GH_Path as Path
    from System import Array
    def proc(input,tree,track):
        path = Path(Array[int](track))
        if len(input) == 0 and none_and_holes: tree.EnsurePath(path); return
        for i,item in enumerate(input):
            if hasattr(item, '__iter__'): #if list or tuple
                track.append(i); proc(item,tree,track); track.pop()
            else:
                if none_and_holes: tree.Insert(item,path,i)
                elif item is not None: tree.Add(item,path)
    if input is not None: t=Tree[object]();proc(input,t,source[:]);return t

output=list_to_tree(Lists)
# ---------- end decomposelist ----------
panel_16 = Panel(decomposelist)
cull = CullPattern(List=selectionfromlists, CullPattern=equals.Equality)
cull_2 = CullPattern(List=num_15, CullPattern=equals.Equality)

# ---- group: Select Exposure
bang = ExplodeTree(Data=cull_2)  # -> Branch0, Branch1, Branch2, Branch3, Branch4, Branch5, Branch6, Branch7
bang_2 = ExplodeTree(Data=cull)  # -> Branch0, Branch1, Branch2, Branch3, Branch4, Branch5, Branch6, Branch7

# ----
panel_17 = Panel(bang.Branch0)
decomposelist_2 = GhPythonScript(Lists=bang_2.Branch0)  # -> output; inputs Lists: list; same code as decomposelist

# ---- group: Backbone
find_aa_index = GhPythonScript(input=sidechains_to_trees.atom_names, search="C")  # -> output; inputs input: list
# ---------- find_aa_index: Python ----------
__author__ = "Flora"
__version__ = "2020.10.27"

import rhinoscriptsyntax as rs

output=[]

for i in range(len(input)):
    if input[i] == search: #.find(search)!=-1:
        #print (input[i])
        output.append(i)
# ---------- end find_aa_index ----------
find_aa_index_2 = GhPythonScript(input=sidechains_to_trees.atom_names, search="N")  # -> output; inputs input: list; same code as find_aa_index
find_aa_index_3 = GhPythonScript(input=sidechains_to_trees.atom_names, search="CA")  # -> output; inputs input: list; same code as find_aa_index
item_5 = ListItem(List=sidechains_to_trees.atom_xyz, Index=find_aa_index_3, Wrap=True)  # -> flatten(Item)
item_6 = ListItem(List=sidechains_to_trees.atom_xyz, Index=find_aa_index_2, Wrap=True)  # -> flatten(Item)
item_7 = ListItem(List=sidechains_to_trees.atom_xyz, Index=find_aa_index, Wrap=True)  # -> flatten(Item)
cloud_2 = CloudDisplay(Points=item_5, Colours=ColourSwatch(SwatchColor=RGB(21, 247, 0)), Size=0.8, SpriteType=0)
cloud_3 = CloudDisplay(Points=item_7, Colours=ColourSwatch(SwatchColor=RGB(21, 247, 0)), Size=0.5, SpriteType=0)
cloud_4 = CloudDisplay(Points=item_6, Colours=ColourSwatch(SwatchColor=RGB(21, 247, 0)), Size=0.8, SpriteType=0)

# ----
graft = GraftTree(Tree=sidechains_to_trees.AA_name, IncludeEmptyLists=True, IncludeNullItems=True)
ln = Line(StartPoint=sidechains_to_trees.start, EndPoint=sidechains_to_trees.end)
path_mapper = PathMapper(decomposelist_2, source="{A;B;C}", target="{A;B}")
panel_18 = Panel(decomposelist_2)
panel_19 = Panel(pt_3)
merge_2 = Merge(Data1=graft, Data2=ln)
cloud_5 = CloudDisplay(Points=sidechains_to_trees.atoms, Colours=RGB(255, 20, 147), Size=0.21, SpriteType=0)
bnd = Bounds(Numbers=panel_17)
multiplylist = GhPythonScript(tree=decomposelist)  # -> tree, multipliedList; inputs tree: tree
# ---------- multiplylist: Python ----------
__author__ = "Flora"
__version__ = "2021.01.18"

import rhinoscriptsyntax as rs

for i in range(tree.BranchCount):
    #subList=[]
    print(i)
    #for ii in tree.Branch(i):
    #    subList.append(list[i])
    #multipliedList.append(subList)

#multipliedList=list_to_tree(multipliedList)
# ---------- end multiplylist ----------
remap = RemapNumbers(Value=panel_17, Source=bnd, Target=Domain(0, 1))  # -> Mapped, Clipped

pt_4 = Point(sidechains_to_trees.start)
tstat = TreeStatistics(Tree=pt_4)  # -> Paths, Length, Count
item_8 = ListItem(List=tstat.Paths, Index="{0;0}", Wrap=True)
branch = TreeBranch(Tree=pt_4, Path="{0;0}", MaintainPaths=True)

panel_21 = Panel(pt_4)
panel_22 = Panel(tstat.Paths)
gradient = Gradient(LowerLimit=0, UpperLimit=1, Parameter=remap.Mapped, stops=[0: RGB(0, 128, 0), 1: RGB(255, 0, 0)])
panel_23 = Panel(sidechains_to_trees.start)
panel_24 = Panel(branch)

# ---- group: SelectTreeBranch
tstat_2 = TreeStatistics(Tree=decomposelist_2)  # -> Paths, Length, Count
item_9 = ListItem(List=tstat_2.Paths, Index=Slider(73, range=0..1000), Wrap=True)
branch_2 = TreeBranch(Tree=decomposelist_2, Path=item_9, MaintainPaths=True)

# ---- group: Select Sequence AA
number_slider = Slider(12, range=0..190)

# ----
selecttreesecondbranchonly = GhPythonScript(tree=decomposelist_2, selection=number_slider)  # -> tree_output; inputs tree: tree
# ---------- selecttreesecondbranchonly: Python ----------
__author__ = "Flora"
__version__ = "2021.01.18"

import rhinoscriptsyntax as rs

#Created By piac
#from https://gist.github.com/piac/ef91ac83cb5ee92a1294
def list_to_tree(input, none_and_holes=True, source=[0]):
    """Transforms nestings of lists or tuples to a Grasshopper DataTree"""
    from Grasshopper import DataTree as Tree
    from Grasshopper.Kernel.Data import GH_Path as Path
    from System import Array
    def proc(input,tree,track):
        path = Path(Array[int](track))
        if len(input) == 0 and none_and_holes: tree.EnsurePath(path); return
        for i,item in enumerate(input):
            if hasattr(item, '__iter__'): #if list or tuple
                track.append(i); proc(item,tree,track); track.pop()
            else:
                if none_and_holes: tree.Insert(item,path,i)
                elif item is not None: tree.Add(item,path)
    if input is not None: t=Tree[object]();proc(input,t,source[:]);return t

#Created By piac
#from https://gist.github.com/piac/ef91ac83cb5ee92a1294
# written by Giulio Piacentino, giulio@mcneel.com
def tree_to_list(input, retrieve_base = lambda x: x[0]):
    """Returns a list representation of a Grasshopper DataTree"""
    def extend_at(path, index, simple_input, rest_list):
        target = path[index]
        if len(rest_list) <= target: rest_list.extend([None]*(target-len(rest_list)+1))
        if index == path.Length - 1:
            rest_list[target] = list(simple_input)
        else:
            if rest_list[target] is None: rest_list[target] = []
            extend_at(path, index+1, simple_input, rest_list[target])
    all = []
    for i in range(input.BranchCount):
        path = input.Path(i)
        extend_at(path, 0, input.Branch(path), all)
    return retrieve_base(all)

#tree=tree


#path1=[]
#for i in range(tree.BranchCount):
#    
#    path = tree.Path(i)
#    if len(path)>1 and path[1]=
#    
#    #print(path[1,-1])
#    print(path)
#    print(path[2])
#    #extend_at(path, 1, input.Branch(path), path1)


tree_output=[]
for i in range(tree.BranchCount):
    path = tree.Path(i)
    
    #print(str(path[1]) +" "+str(int(selection)))
    
    if str(path[1])==str(int(selection)):
        print(path[1])
        subTree=[]
        print(i)
        for ii in tree.Branch(i):
            subTree.append(ii)

        tree_output.append(subTree)

tree_output=list_to_tree(tree_output)
# ---------- end selecttreesecondbranchonly ----------

# ---- group: To develop averages
multiplylist_2 = GhPythonScript(tree=decomposelist_2, list=gradient)  # -> tree_output, multipliedList; inputs tree: tree, list: list; disabled
# ---------- multiplylist_2: Python ----------
__author__ = "Flora"
__version__ = "2021.01.18"

import rhinoscriptsyntax as rs

#Created By piac
#from https://gist.github.com/piac/ef91ac83cb5ee92a1294
def list_to_tree(input, none_and_holes=True, source=[0]):
    """Transforms nestings of lists or tuples to a Grasshopper DataTree"""
    from Grasshopper import DataTree as Tree
    from Grasshopper.Kernel.Data import GH_Path as Path
    from System import Array
    def proc(input,tree,track):
        path = Path(Array[int](track))
        if len(input) == 0 and none_and_holes: tree.EnsurePath(path); return
        for i,item in enumerate(input):
            if hasattr(item, '__iter__'): #if list or tuple
                track.append(i); proc(item,tree,track); track.pop()
            else:
                if none_and_holes: tree.Insert(item,path,i)
                elif item is not None: tree.Add(item,path)
    if input is not None: t=Tree[object]();proc(input,t,source[:]);return t

#Created By piac
#from https://gist.github.com/piac/ef91ac83cb5ee92a1294
# written by Giulio Piacentino, giulio@mcneel.com
def tree_to_list(input, retrieve_base = lambda x: x[0]):
    """Returns a list representation of a Grasshopper DataTree"""
    def extend_at(path, index, simple_input, rest_list):
        target = path[index]
        if len(rest_list) <= target: rest_list.extend([None]*(target-len(rest_list)+1))
        if index == path.Length - 1:
            rest_list[target] = list(simple_input)
        else:
            if rest_list[target] is None: rest_list[target] = []
            extend_at(path, index+1, simple_input, rest_list[target])
    all = []
    for i in range(input.BranchCount):
        path = input.Path(i)
        extend_at(path, 0, input.Branch(path), all)
    return retrieve_base(all)

#tree=tree


#path1=[]
#for i in range(tree.BranchCount):
#    
#    path = tree.Path(i)
#    if len(path)>1 and path[1]=
#    
#    #print(path[1,-1])
#    print(path)
#    print(path[2])
#    #extend_at(path, 1, input.Branch(path), path1)

multipliedList=[]
tree_output=[]
for i in range(tree.BranchCount):
    path = tree.Path(i)
    subList=[]
    subTree=[]
    print(i)
    for ii in tree.Branch(i):
        subList.append(list[path[1]])
        subTree.append(ii)
    multipliedList.append(subList)
    tree_output.append(subTree)

tree_output=list_to_tree(tree_output)
multipliedList=list_to_tree(multipliedList)
# ---------- end multiplylist_2 ----------
cloud_6 = CloudDisplay(Points=multiplylist_2.tree_output, Colours=multiplylist_2.multipliedList, Size=0.8, SpriteType=0)

# ----
multiplylist_3 = GhPythonScript(selection=number_slider, tree=selecttreesecondbranchonly, list=gradient)  # -> tree_output, multipliedList; inputs tree: tree, list: list
# ---------- multiplylist_3: Python ----------
__author__ = "Flora"
__version__ = "2021.01.18"

import rhinoscriptsyntax as rs

#Created By piac
#from https://gist.github.com/piac/ef91ac83cb5ee92a1294
def list_to_tree(input, none_and_holes=True, source=[0]):
    """Transforms nestings of lists or tuples to a Grasshopper DataTree"""
    from Grasshopper import DataTree as Tree
    from Grasshopper.Kernel.Data import GH_Path as Path
    from System import Array
    def proc(input,tree,track):
        path = Path(Array[int](track))
        if len(input) == 0 and none_and_holes: tree.EnsurePath(path); return
        for i,item in enumerate(input):
            if hasattr(item, '__iter__'): #if list or tuple
                track.append(i); proc(item,tree,track); track.pop()
            else:
                if none_and_holes: tree.Insert(item,path,i)
                elif item is not None: tree.Add(item,path)
    if input is not None: t=Tree[object]();proc(input,t,source[:]);return t

#Created By piac
#from https://gist.github.com/piac/ef91ac83cb5ee92a1294
# written by Giulio Piacentino, giulio@mcneel.com
def tree_to_list(input, retrieve_base = lambda x: x[0]):
    """Returns a list representation of a Grasshopper DataTree"""
    def extend_at(path, index, simple_input, rest_list):
        target = path[index]
        if len(rest_list) <= target: rest_list.extend([None]*(target-len(rest_list)+1))
        if index == path.Length - 1:
            rest_list[target] = list(simple_input)
        else:
            if rest_list[target] is None: rest_list[target] = []
            extend_at(path, index+1, simple_input, rest_list[target])
    all = []
    for i in range(input.BranchCount):
        path = input.Path(i)
        extend_at(path, 0, input.Branch(path), all)
    return retrieve_base(all)

#tree=tree


#path1=[]
#for i in range(tree.BranchCount):
#    
#    path = tree.Path(i)
#    if len(path)>1 and path[1]=
#    
#    #print(path[1,-1])
#    print(path)
#    print(path[2])
#    #extend_at(path, 1, input.Branch(path), path1)

multipliedList=[]
tree_output=[]
for i in range(tree.BranchCount):
    path = tree.Path(i)
    subList=[]
    subTree=[]
    print(i)
    for ii in tree.Branch(i):
        print(path)
        subList.append(list[int(selection)])
        subTree.append(ii)
    multipliedList.append(subList)
    tree_output.append(subTree)

tree_output=list_to_tree(tree_output)
multipliedList=list_to_tree(multipliedList)
# ---------- end multiplylist_3 ----------
panel_25 = Panel(branch_2)
cloud_7 = CloudDisplay(Points=multiplylist_3.tree_output, Colours=multiplylist_3.multipliedList, Size=0.8, SpriteType=0)
multiplylist_4 = GhPythonScript(tree=decomposelist_2, list=gradient)  # -> tree_output, multipliedList; inputs tree: tree, list: list; same code as multiplylist_2
tstat_3 = TreeStatistics(Tree=multiplylist_4.tree_output)  # -> Paths, Length, Count
tstat_4 = TreeStatistics(Tree=multiplylist_4.multipliedList)  # -> Paths, Length, Count
item_10 = ListItem(List=tstat_3.Paths, Index=Slider(0, range=0..1000), Wrap=True)
item_11 = ListItem(List=tstat_4.Paths, Index=Slider(0, range=0..1000), Wrap=True)
branch_3 = TreeBranch(Tree=multiplylist_4.tree_output, Path=item_10, MaintainPaths=True)
branch_4 = TreeBranch(Tree=multiplylist_4.multipliedList, Path=item_11, MaintainPaths=True)
panel_26 = Panel(branch_3)
cloud_8 = CloudDisplay(Points=branch_3, Colours=branch_4, Size=0.8, SpriteType=0)

# ---- group: PDB reader
path_4 = FilePath("C:\Users\Flora\OneDrive - The Alan Turing Institute\Turing\3.Protein_folding\1.Data\GlyP_G6P_2.pdb")
file_3 = ReadFile(File=path_4, PerLineParse=True)
remove_spaces = GhPythonScript(input=file_3)  # -> output; same code as filter_dbd_2
num_18 = Number([-1, -2])
cull_i_4 = CullIndex(List=remove_spaces, Indices=num_18, Wrap=True)
split_4 = TextSplit(Text=cull_i_4, Separators=",")
number_slider_2 = Slider(2, range=0..10)
swatch = ColourSwatch(SwatchColor=RGB(105, 32, 178))

# ---- group: ALBA
pln = Plane(PlaneXY(-0.3286946811, -0.09005441186, 0))
protein_ribbon = ProteinRibbon(
    location=pln,
    path_to_pdb_file=path_4,
    threshold_count=6,
    threshold_angle_α_vs_β=0.95,
    alpha_helix_color=RGB(24, 0, 242),
    beta_sheet_color=RGB(242, 210, 0),
    loop_color=RGB(110, 138, 107))  # -> flatten(all_atom_points), flatten(amino_acid_residue_points), flatten(curve), ribbon
crv = Curve(protein_ribbon.curve)
cloud_9 = CloudDisplay(Points=protein_ribbon.amino_acid_residue_points, Colours=RGB(255, 20, 147), Size=1, SpriteType=0)
pt_5 = Point(protein_ribbon.all_atom_points)
bnd_2 = Bounds(Numbers=protein_ribbon.all_atom_points)
remap_2 = RemapNumbers(Value=protein_ribbon.all_atom_points, Source=bnd_2, Target=Domain(0, 1))  # -> Mapped, Clipped
gradient_2 = Gradient(
    LowerLimit=0,
    UpperLimit=1,
    Parameter=remap_2.Mapped,
    stops=[0: RGB(65, 107, 105), 0: RGB(12, 226, 64), 0: RGB(166, 16, 169), 0.353: RGB(255, 130, 160), 0.719: RGB(220, 0, 40), 1: RGB(0, 255, 0)])

# ---- group: PDB reader / Atoms_XYZ
z_11 = Slider(8, range=0..10)
y_5 = Slider(7, range=0..10)
x_5 = Slider(6, range=0..20)
z_12 = ListItem(List=split_4, Index=z_11, Wrap=True)  # -> flatten(Item)
y_6 = ListItem(List=split_4, Index=y_5, Wrap=True)  # -> flatten(Item)
x_6 = ListItem(List=split_4, Index=x_5, Wrap=True)  # -> flatten(Item)
num_19 = Number(x_6)
num_20 = Number(z_12)
num_21 = Number(y_6)
pt_6 = ConstructPoint(XCoordinate=num_19, YCoordinate=num_21, ZCoordinate=num_20)

# ---- group: PDB reader / Atoms_name
item_12 = ListItem(List=split_4, Index=Slider(2, range=0..10), Wrap=True)  # -> flatten(Item)
panel_27 = Panel(item_12)

# ---- group: PDB reader / AA_name
item_13 = ListItem(List=split_4, Index=Slider(3, range=0..10), Wrap=True)  # -> flatten(Item)
panel_28 = Panel(item_13)

# ---- group: PDB reader / Atoms_order
z_13 = Slider(1, range=0..10)
atom_order_3 = ListItem(List=split_4, Index=z_13, Wrap=True)  # -> flatten(Item)
num_22 = Number(atom_order_3)

# ---- group: PDB reader / AA_number
amino_acid_3 = ListItem(List=split_4, Index=Slider(5, range=0..10), Wrap=True)  # -> flatten(Item)
num_23 = Number(amino_acid_3)

# ---- group: PDB reader / Backbone
find_aa_index_4 = GhPythonScript(input=item_12, search="ND1")  # -> output; inputs input: list
# ---------- find_aa_index_4: Python ----------
__author__ = "Flora"
__version__ = "2020.10.27"

import rhinoscriptsyntax as rs

output=[]

for i in range(len(input)):
    if input[i] == search: #.find(search)!=-1:
        print (input[i])
        output.append(i)
# ---------- end find_aa_index_4 ----------
find_aa_index_5 = GhPythonScript(input=item_12, search="CA")  # -> output; inputs input: list; same code as find_aa_index_4
find_aa_index_6 = GhPythonScript(input=item_12, search="N")  # -> output; inputs input: list; same code as find_aa_index
find_aa_index_7 = GhPythonScript(input=item_12, search="C")  # -> output; inputs input: list; same code as find_aa_index_4
item_14 = ListItem(List=pt_6, Index=find_aa_index_4, Wrap=True)
item_15 = ListItem(List=pt_6, Index=find_aa_index_6, Wrap=True)
item_16 = ListItem(List=pt_6, Index=find_aa_index_5, Wrap=True)
item_17 = ListItem(List=pt_6, Index=find_aa_index_7, Wrap=True)
cloud_10 = CloudDisplay(Points=item_16, Colours=ColourSwatch(SwatchColor=RGB(255, 0, 179)), Size=0.8, SpriteType=0)
cloud_11 = CloudDisplay(Points=item_17, Colours=ColourSwatch(SwatchColor=RGB(255, 0, 191)), Size=1, SpriteType=0)
cloud_12 = CloudDisplay(Points=item_14, Colours=ColourSwatch(SwatchColor=RGB(187, 0, 230)), Size=0.6, SpriteType=0)
cloud_13 = CloudDisplay(Points=item_15, Colours=ColourSwatch(SwatchColor=RGB(202, 0, 247)), Size=1, SpriteType=0)

# ---- group: PDB reader (continued)
bnd_3 = Bounds(Numbers=num_23)
remap_3 = RemapNumbers(Value=num_23, Source=bnd_3, Target=Domain(0, 1))  # -> Mapped, Clipped
python_3 = GhPythonScript(AA=num_23, AA_name=item_13, xyz=pt_6, atoms=item_12)  # -> out, a, b, wtf, start, end; inputs AA: list of Int32, AA_name: list, xyz: list, atoms: list
#   port AA: Amino Acid names
# ---------- python_3: Python ----------
__author__ = "Flora"
__version__ = "2020.10.28"

"""
Provides a scripting component.
    Inputs:
        AA: Amino Acid id number (int list)
        AA_name: Amino Acid name (string list)
        xyz: coordinates in 3Dspace per atom (3d point rhino item)
        atoms: atom names (string list)
    Output:
        a: xyz coordinates for debug
        start: list of coordinates of all atoms per AA (for starting points of lines) 
        end: list of coordinates of all atoms per AA (for ending poins of lines)
"""


import rhinoscriptsyntax as rs

counter=-1

amino_list=[]

atom_xyz_list=[]
atom_name_list=[]
atoms_name_list=[]
atoms_xyz_list=[]


sidechains_dict = {
"GLN":{"A": ["C","C","CA","CA","CB","CG","CD","CD"],
    "B":["O","CA","N","CB","CG","CD","NE2","OE1"]},
"GLU":{"A": ["C","C","CA","CA","CB","CG","CD","CD"],
    "B":["O","CA","N","CB","CG","CD","OE2","OE1"]},
"LYS":{"A": ["C","C","CA","CA","CB","CG","CD","CE"],
    "B": ["O","CA","N","CB","CG","CD","CE","NZ"]},
"ARG":{"A":["C","C","CA","CA","CB","CG","CD","NE","CZ","CZ"],
    "B": ["O","CA","N","CB","CG","CD","NE","CZ","NH1","NH2"]},
"ILE":{"A": ["C","C","CA","CA","CB","CB","CG1"],
    "B": ["O","CA","N","CB","CG1","CG2","CD1"]},
"SER":{"A": ["C","C","CA","CA","CB"],
    "B": ["O","CA","N","CB","OG"]},
"VAL":{"A": ["C","C","CA","CA","CB","CB"],
    "B": ["O","CA","N","CB","CG2","CG1"]},
"HIS": {"A": ["C","C","CA","CA","CB","CG","CG","CD2","CE1","ND1"], 
    "B": ["O","CA","N","CB","CG","ND1","CD2","NE2","NE2","CE1"]},
"GLY":{"A":["C","C","CA"],
    "B": ["O","CA","N"]},
"LEU":{"A": ["C","C","CA","CA","CB","CG","CG"],
    "B": ["O","CA","N","CB","CG","CD1","CD2"]},
"ALA":{"A": ["C","C","CA","CA"],
    "B": ["O","CA","N","CB"]},
"ASN":{"A": ["C","C","CA","CA","CB","CG","CG"],
    "B": ["O","CA","N","CB","CG","OD1","ND2"]},
"THR":{"A": ["C","C","CA","CA","CB","CB"],
    "B": ["O","CA","N","CB","CG2","OG1"]},
"PRO":{"A": ["C","C","CA","CA","CB","CG","CD"],
    "B": ["O","CA","N","CB","CG","CD","N"]},
"ASP":{"A":["C","C","CA","CA","CB","CG","CG"],
    "B": ["O","CA","N","CB","CG","OD1","OD2"]},
"TYR":{"A": ["C","C","CA","CA","CB","CG","CG","CD1","CD2","CE1","CE2","CZ"],
    "B": ["O","CA","N","CB","CG","CD1","CD2","CE1","CE2","CZ","CZ","OH"]},
"PHE":{"A": ["C","C","CA","CA","CB","CG","CG","CD1","CD2","CE1","CE2"],
    "B": ["O","CA","N","CB","CG","CD1","CD2","CE1","CE2","CZ","CZ"]},
"TRP":{"A": ["C","C","CA","CA","CB","CG","CG","CD1","CD2","NE1","CD2","CE2","CE3","CZ3","CH2"], 
    "B": ["O","CA","N","CB","CG","CD2","CD1","NE1","CE2","CE2","CE3","CZ2","CZ3","CH2","CZ2"]},
}


# store list of atoms per aminoacid
for i in range (len(AA)):
    if AA[i]!=counter: #a new aminoacid
        if atom_xyz_list != []:
            atoms_xyz_list.append(atom_xyz_list) #store list of atoms per AA
            atoms_name_list.append(atom_name_list)
        counter=AA[i]
        atom_xyz_list=[]
        atom_name_list=[]
        atom_xyz_list.append(xyz[i])
        atom_name_list.append(atoms[i])

        amino_list.append(AA_name[i]) #stores name per chain of AA
    else: # existing aminoacid
        atom_xyz_list.append(xyz[i])
        atom_name_list.append(atoms[i])

atoms_xyz_list.append(atom_xyz_list) #store list of atoms of final AA
atoms_name_list.append(atom_name_list)#store list of atoms names of final AA



amino_start =[]
amino_end=[]

def sidechain(amino_acid,A,B,atom_list,xyz_list):
    start, end=[],[]
    for x in range (len(A)):
        for y in range(len(atom_list)):
            if (A[x]==atom_list[y]):
                start.append(xyz_list[y])
            if (B[x]==atom_list[y]):
                end.append(xyz_list[y])
    return (start,end)

def construct_sidechains(amino_list,atoms_name_list,atoms_xyz_list):

    for i in range (len(amino_list)):
        amino_acid = sidechains_dict.get(amino_list[i])
        if(amino_acid != None): #if the amino acid exists in the pdb exists in the current dictionary
            A = amino_acid.get('A') #get the list of the first points of the AA
            B = amino_acid.get('B') #get the list of the second points of the AA
            atom_list = atoms_name_list[i]
            xyz_list = atoms_xyz_list[i]

            start, end= sidechain(amino_acid,A,B,atom_list,xyz_list)

            amino_start.append(start)
            amino_end.append(end)
        else: error = "Amino Acid doesnt exist"



#Created By piac
#from https://gist.github.com/piac/ef91ac83cb5ee92a1294
def list_to_tree(input, none_and_holes=True, source=[0]):
    """Transforms nestings of lists or tuples to a Grasshopper DataTree"""
    from Grasshopper import DataTree as Tree
    from Grasshopper.Kernel.Data import GH_Path as Path
    from System import Array
    def proc(input,tree,track):
        path = Path(Array[int](track))
        if len(input) == 0 and none_and_holes: tree.EnsurePath(path); return
        for i,item in enumerate(input):
            if hasattr(item, '__iter__'): #if list or tuple
                track.append(i); proc(item,tree,track); track.pop()
            else:
                if none_and_holes: tree.Insert(item,path,i)
                elif item is not None: tree.Add(item,path)
    if input is not None: t=Tree[object]();proc(input,t,source[:]);return t

#print (atoms_xyz_list)
#sidechain(atoms_xyz_list, amino_names, atoms_name_list)
construct_sidechains(amino_list,atoms_name_list,atoms_xyz_list)
a= list_to_tree(atoms_xyz_list)
b= amino_list

wtf= amino_list
start= list_to_tree(amino_start)
end=list_to_tree(amino_end)

#a= atoms_xyz_list
#print (atoms_xyz_list)
# ---------- end python_3 ----------
gradient_3 = Gradient(
    LowerLimit=0,
    UpperLimit=1,
    Parameter=remap_3.Mapped,
    stops=[0: RGB(65, 107, 105), 0: RGB(93, 179, 243), 0: RGB(89, 93, 181), 0: RGB(2, 143, 70), 0: RGB(229, 205, 60), 0: RGB(12, 226, 64), 0: RGB(166, 16, 169), 0: RGB(147, 105, 114), 0: RGB(79, 200, 187), 0: RGB(35, 238, 36)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])
ln_2 = Line(StartPoint=python_3.start, EndPoint=python_3.end)
graft_2 = GraftTree(Tree=python_3.b, IncludeEmptyLists=True, IncludeNullItems=True)
panel_29 = Panel(ln_2)
merge_3 = Merge(Data1=graft_2, Data2=ln_2)
cloud_14 = CloudDisplay(Points=pt_6, Colours=gradient_3, Size=0.2, SpriteType=0)
panel_30 = Panel(merge_3)
ln_3 = Line(StartPoint=item_17, EndPoint=item_16)
ln_4 = Line(StartPoint=item_15, EndPoint=item_16)
previewlw = CustomPreviewLineweights(Geometry=ln_4, Shader=swatch, Thickness=number_slider_2, Absolute=False)
previewlw_2 = CustomPreviewLineweights(Geometry=ln_3, Shader=swatch, Thickness=number_slider_2, Absolute=False)

# ----
cloud_15 = CloudDisplay(Points=pt_5, Colours=gradient_3, Size=0.5, SpriteType=0)

# ==== cluster PDBOpen: make the pdb info accessible
protein_data_base_file = ClusterInput()  # Input the path to a local PDB file, the URL of a PDB file online, or the ID or a PDB file in the RCSB database.
index = ClusterInput()  # If the PDB file has multiple proteins listed, you may choose one.

# ---- group: only one item may be passed
data = Data(protein_data_base_file)
item = ListItem(List=data, Index=0, Wrap=True)
path = FilePath(item)

# ---- group: detrmine if the passed info is a URL (2), a local file path (1) or a Protein ID
concat = Concatenate(FragmentA="http://www.rcsb.org/pdb/files/", FragmentB=path, FragmentC=".pdb")

tmatch = MatchText(Text=path, Pattern="*:*", Case=True)

tmatch_2 = MatchText(Text=path, RegEx="http://", Case=True)
addition = Addition(A=tmatch, B=tmatch_2)
filter = StreamFilter(Gate=addition, Stream0=concat, Stream2=path)
url = CSharpScript(url=filter, L=True)  # -> out, C; inputs url: String, L: Boolean
# ---------- url: C# ----------
    //turn caching on and off
    bool cache = true;

    if(url == "") return;

    //everything in here is cached unless a parameter changes or cache is off.
    if(cache == false || (cache == true && (url != pastURL || L != pastAsLines)))
    {
      Print("getting url");

      //cache the parameters
      pastURL = url;
      pastAsLines = L;

      //must have http to work with webclient.
      if( !url.StartsWith("http://"))
      {
        url = "http://" + url;
      }

      //open url and read to string.
      System.Net.WebClient Client = new System.Net.WebClient ();
      Stream strm = Client.OpenRead(url);
      StreamReader sr = new StreamReader(strm);

      //L = read individual lines.
      if(L)
      {
        List<string> dataList = new List<string>();
        string line;

        do
        {
          line = sr.ReadLine();
          dataList.Add(line);
        }
        while (line != null);

        C = dataList;

      } else //just read as a block
      {
        string dataString = "";
        string line;

        do
        {
          line = sr.ReadLine();
          dataString += line;
        }
        while (line != null);

        C = dataString;
      }

      strm.Close();
      sr.Close();

      pastResult = C;

    } else {//used cached result.
      C = pastResult;
    }
# ---------- url: C# additional code ----------
  string pastURL = "";
  bool pastAsLines = false;
  object pastResult = null;
# ---------- end url ----------

xor = GateXor(A=flatten(tmatch), B=flatten(tmatch_2))
filter_2 = StreamFilter(Gate=xor, Stream1=path)
file = ReadFile(File=filter_2, PerLineParse=True)

filter_3 = StreamFilter(Gate=addition, Stream0=url.C, Stream1=file, Stream2=url.C)

# ----
tmatch_3 = MatchText(Text=filter_3, RegEx="TER", Case=True)
mindex = MemberIndex(Set=tmatch_3, Member=True)  # -> Index, Count
shift = ShiftList(List=mindex.Index, Shift=1, Wrap=False)
dom = ConstructDomain(DomainStart=mindex.Index, DomainEnd=shift)
subset = SubList(List=filter_3, Domain=dom, Wrap=True)  # -> List, Index
tmatch_4 = MatchText(Text=subset.List, RegEx="ATOM", Case=True)
cull = CullPattern(List=subset.List, CullPattern=tmatch_4)
prune = PruneTree(Tree=cull, Minimum=100, Maximum=0)
tstat = TreeStatistics(Tree=prune)  # -> Paths, Length, Count
series = Series(Start=0, Step=1, Count=tstat.Count)
replace = ReplacePaths(Data=prune, Search=tstat.Paths, Replace=series)
browse = BranchBrowser(T=simplify(replace), i=index)
protein_data_selected = ClusterOutput(browse)
protein_data_all = ClusterOutput(replace)

# ==== cluster ProteinRibbon: visualizes the structure of a protein
location = ClusterInput()
path_to_pdb_file = ClusterInput()
threshold_count = ClusterInput()  # threshold count for # consequtive residues for seconary structure
threshold_angle_α_vs_β = ClusterInput()  # in radians
alpha_helix_color = ClusterInput()
beta_sheet_color = ClusterInput()
loop_color = ClusterInput()
path = FilePath(path_to_pdb_file)

# ---- group: parsing if PDB file
file = ReadFile(File=path, PerLineParse=True)
split = TextSplit(Text=file, Separators="A")
item = ListItem(List=split, Index=-1, Wrap=True)
trim = TextTrim(Text=item, Start=True, End=True)
split_2 = TextSplit(Text=trim, Separators=" ")
pdb = ImportPDB(File=path)  # -> Atoms, Bonds

# ---- group: parsing if PDB data
split_3 = TextSplit(Text=path, Separators="A")
item_2 = ListItem(List=split_3, Index=-1, Wrap=True)
trim_2 = TextTrim(Text=item_2, Start=True, End=True)
split_4 = TextSplit(Text=trim_2, Separators=" ")
num = Number(split_4)
clean = CleanTree(RemoveNulls=True, RemoveInvalid=True, RemoveEmpty=True, Tree=num)
item_3 = ListItem(List=clean, Index=1, Wrap=True)  # -> Item, Item1, Item2
pt = ConstructPoint(XCoordinate=item_3.Item, YCoordinate=item_3.Item1, ZCoordinate=item_3.Item2)  # -> flatten(Point)

# ---- group: is it a PDB file or PDB data?
null = NullItem(Item=file)  # -> NullFlags, InvalidFlags, Description
item_4 = ListItem(List=flatten(null.NullFlags), Index=0, Wrap=True)
filter = StreamFilter(Gate=item_4, Stream0=split_2, Stream1=split_4)
filter_2 = StreamFilter(Gate=item_4, Stream0=pdb.Atoms, Stream1=pt)

# ---- group: reduce all atom points to AA residue points
item_5 = ListItem(List=filter, Index=0, Wrap=True)
int = Integer(item_5)
clean_2 = CleanTree(RemoveNulls=True, RemoveInvalid=True, RemoveEmpty=True, Tree=int)
subtraction = Subtraction(A=clean_2, B=1)
tstat = TreeStatistics(Tree=graft(filter_2))  # -> Paths, Length, Count
path_2 = ConstructPath(Indices=subtraction)  # -> flatten(Branch)
replace = ReplacePaths(Data=graft(filter_2), Search=tstat.Paths, Replace=path_2)
pt_2 = Point(replace)
item_6 = ListItem(List=pt_2, Index=0, Wrap=True)

# ---- group: create a polyline from the AA residue points and analize angles to find helixes
pline = PolyLine(Vertices=flatten(item_6), Closed=False)
disc = Discontinuity(Curve=pline, Level=1)  # -> Points, Parameters
eval = EvaluateCurve(Curve=pline, Parameter=disc.Parameters)  # -> Point, Tangent, Angle
ta = Number(threshold_angle_α_vs_β)
larger = LargerThan(FirstNumber=eval.Angle, SecondNumber=ta)  # -> LargerThan, OrEqualTo

# ---- group: domains of secondary structures
lng = ListLength(List=larger.LargerThan)
shift = ShiftList(List=larger.LargerThan, Shift=1, Wrap=True)
series = Series(Start=0, Step=1, Count=lng)
equals = Equality(FirstNumber=larger.LargerThan, SecondNumber=shift)  # -> Equality, Inequality
int_2 = Integer(series)
subtraction_2 = Subtraction(A=lng, B=1)
dispatch = Dispatch(List=int_2, DispatchPattern=equals.Equality)  # -> ListA, ListB
ins = InsertItems(List=dispatch.ListB, Item=subtraction_2, Indices=-1, Wrap=True)
ins_2 = InsertItems(List=ins, Item=0, Indices=0, Wrap=True)
consec = ConsecutiveDomains(Numbers=ins_2, Additive=False)

# ---- group: break ribbon into secondary structures / determine sizes of secondary structure to distinguish between 1) alpha helixes and beta sheets or 2) loops
dedomain = DeconstructDomain(Domain=consec)  # -> Start, End
subtraction_3 = Subtraction(A=dedomain.End, B=dedomain.Start)
tc = Number(threshold_count)
larger_2 = LargerThan(FirstNumber=subtraction_3, SecondNumber=tc)  # -> LargerThan, OrEqualTo

# ---- group: break ribbon into secondary structures / points divided into secondary structure
subset = SubList(List=flatten(item_6), Domain=consec, Wrap=True)  # -> List, Index

# ----
tweek_orientation = Slider(0, range=0..10)

# ---- group: seperate helixes from sheets / is this the domain of an alpha helix?
dedomain_2 = DeconstructDomain(Domain=consec)  # -> Start, End
dom = ConstructDomain(DomainStart=expr("x+1", dedomain_2.Start), DomainEnd=dedomain_2.End)
subset_2 = SubList(List=flatten(larger.LargerThan), Domain=dom, Wrap=True)  # -> List, Index
item_7 = ListItem(List=subset_2.List, Index=0, Wrap=True)

# ----
pln = Plane(location)

# ---- group: script that hides all outputs
c_script = CSharpScript()  # -> out; inputs Trigger: tree
# ---------- c_script: C# ----------
    // No code needed here.
# ---------- c_script: C# additional code ----------
  /// <summary>
  /// This method will be called once every solution, before any calls to RunScript.
  /// </summary>
  public override void BeforeRunScript()
  {
    if (GrasshopperDocument == null)
      return;
    
    // Get the owner (if any) of this document.
    IGH_DocumentOwner owner = GrasshopperDocument.Owner;
    if (owner == null)
      return;

    // See if the object owning this document is a cluster.
    IGH_Component cluster = owner as IGH_Component;
    if (cluster == null)
      return;

    // Iterate over all outputs.
    foreach (IGH_Param param in cluster.Params.Output)
    {
      IGH_PreviewObject previewParameter = param as IGH_PreviewObject;
      if (previewParameter != null)
        previewParameter.Hidden = true;
    }
  }
# ---------- end c_script ----------

# ---- group: orient the protein with the first helix or sheet aligned to the Z axis, with the midddle AA residue at the origin, and the middle AA residue of the last helix or sheet on the X axis / determine orientation
dispatch_2 = Dispatch(List=subset.List, DispatchPattern=graft(larger_2.LargerThan))  # -> ListA, ListB
clean_3 = CleanTree(RemoveNulls=True, RemoveInvalid=True, RemoveEmpty=True, Tree=dispatch_2.ListA)
browse = BranchBrowser(T=clean_3, i=tweek_orientation)
item_8 = ListItem(List=flatten(browse), Index=-1, Wrap=True)

# ----
lng_2 = ListLength(List=browse)  # -> expr("x/2", Length)

# ---- group: orient the protein with the first helix or sheet aligned to the Z axis, with the midddle AA residue at the origin, and the middle AA residue of the last helix or sheet on the X axis / determine orientation (continued)
item_9 = ListItem(List=flatten(browse), Index=lng_2, Wrap=True)

# ----
vec2pt = Vector2Pt(PointA=item_9, PointB=item_8, Unitize=False)  # -> Vector, Length
pl = PlaneNormal(Origin=item_9, ZAxis=vec2pt.Vector)

# ---- group: orient the protein with the first helix or sheet aligned to the Z axis, with the midddle AA residue at the origin, and the middle AA residue of the last helix or sheet on the X axis / orient AA residues
orient = Orient(Geometry=subset.List, Source=pl, Target=pln)  # -> Geometry, Transform
simplify = SimplifyTree(Tree=orient.Geometry, Front=False)
amino_acid_residue_points = ClusterOutput(simplify)

# ---- group: seperate helixes and sheets from loops
dispatch_3 = Dispatch(List=orient.Geometry, DispatchPattern=graft(larger_2.LargerThan))  # -> ListA, ListB

# ---- group: orient the protein with the first helix or sheet aligned to the Z axis, with the midddle AA residue at the origin, and the middle AA residue of the last helix or sheet on the X axis / orient atoms
orient_2 = Orient(Geometry=pt_2, Source=pl, Target=pln)  # -> simplify(Geometry), Transform
all_atom_points = ClusterOutput(orient_2.Geometry)

# ---- group: seperate helixes from sheets
dispatch_4 = Dispatch(List=dispatch_3.ListA, DispatchPattern=item_7)  # -> ListA, ListB

# ----
beta_sheet_points = Point(dispatch_4.ListB)
alph_helix_points = Point(dispatch_4.ListA)
loop_points = Point(dispatch_3.ListB)

intcrv = Interpolate(Vertices=beta_sheet_points, Degree=3, Periodic=False, KnotStyle=1)  # -> Curve, Length, Domain
intcrv_2 = Interpolate(Vertices=alph_helix_points, Degree=3, Periodic=False, KnotStyle=1)  # -> Curve, Length, Domain
intcrv_3 = Interpolate(Vertices=loop_points, Degree=3, Periodic=False, KnotStyle=1)  # -> Curve, Length, Domain
merge = Merge(Data1=intcrv_2.Curve, Data2=intcrv.Curve, Data3=intcrv_3.Curve)  # -> simplify(Result)
curve = ClusterOutput(merge)

clean_4 = CleanTree(RemoveNulls=True, RemoveInvalid=True, RemoveEmpty=True, Tree=intcrv_3.Curve)  # -> simplify(Tree)

# ---- group: loops
pipe = Pipe(Curve=clean_4, Radius=Slider(0.22, range=0..1), Caps=2)  # -> simplify(Pipe)
L = Shader(loop_color)
preview = CustomPreview(Geometry=pipe, Shader=L)

# ---- group: beta sheets
clean_5 = CleanTree(RemoveNulls=True, RemoveInvalid=True, RemoveEmpty=True, Tree=intcrv.Curve)  # -> simplify(Tree)

curvepoint = PointOnCurve(clean_5, parameter=0.5)
shift_2 = ShiftList(List=flatten(curvepoint), Shift=1, Wrap=True)  # -> graft(List)
vec2pt_2 = Vector2Pt(PointA=curvepoint, PointB=shift_2, Unitize=False)  # -> Vector, Length
pframe = PerpFrame(Curve=clean_5, Parameter=Slider(0, range=0..0.01))
align = AlignPlane(Plane=pframe, Direction=vec2pt_2.Vector)  # -> Plane, Angle

len = Length(Curve=clean_5)
subtraction_4 = Subtraction(A=len, B=Slider(2, range=0..10))

rectangle = Rectangle(Plane=align.Plane, XSize=Domain(-1.25, 1.25), YSize=Domain(-0.25, 0.25), Radius=0.1)  # -> Rectangle, Length
subcrv = SubCurve(BaseCurve=clean_5, Domain=subtraction_4)
swp1 = Sweep1(Rail=subcrv, Sections=rectangle.Rectangle, Miter=1)  # -> simplify(Brep)
edges = BrepEdges(Brep=swp1)  # -> Naked, Interior, NonManifold
item_10 = ListItem(List=edges.Naked, Index=0, Wrap=True)
offset_out = OffsetOut(curve=item_10, distance_or_xylinus_config=Slider(0.4, range=0..1))
end = EndPoints(Curve=clean_5)  # -> Start, End
extr = ExtrudePoint(Base=offset_out, Point=end.End)  # -> simplify(Extrusion)
β = Shader(beta_sheet_color)
cap = CapHoles(Brep=simplify([swp1, extr]))
sunion = SolidUnion(Breps=cap)

preview_2 = CustomPreview(Geometry=sunion, Shader=β)

# ---- group: alpha helices
clean_6 = CleanTree(RemoveNulls=True, RemoveInvalid=True, RemoveEmpty=True, Tree=intcrv_2.Curve)  # -> simplify(Tree)
pframe_2 = PerpFrame(Curve=clean_6, Parameter=0)
rectangle_2 = Rectangle(Plane=pframe_2, XSize=Domain(-0.25, 0.25), YSize=Domain(-1.25, 1.25), Radius=0.2)  # -> Rectangle, Length
α = Shader(alpha_helix_color)

# ----
extrcrv = ExtrudeAlong(Base=rectangle_2.Rectangle, Curve=clean_6)
cap_2 = CapHoles(Brep=extrcrv)  # -> simplify(Brep)

# ---- group: alpha helices (continued)
preview_3 = CustomPreview(Geometry=cap_2, Shader=α)

# ----
entwine = Entwine(Branch00=cap_2, Branch01=sunion, Branch02=pipe, FlattenInputs=True)
geo = Geometry(entwine)
ribbon = ClusterOutput(geo)

# ==== cluster BranchBrowser: allows you to scroll through the branchs of the tree sequentially using an integer instead of a path
T = ClusterInput()
i = ClusterInput()
tstat = TreeStatistics(Tree=T)  # -> Paths, Length, Count
item = ListItem(List=tstat.Paths, Index=i, Wrap=True)
branch = TreeBranch(Tree=T, Path=item, MaintainPaths=True)
B = ClusterOutput(branch)

# ==== cluster OffsetOut: Offset curves outward. Use for interior curves.
curve = ClusterInput()  # Curves to offset outwards.
distance_or_xylinus_config = ClusterInput()  # Distance to offset curve. If a config is input, the offset distance will be 1/2 the extrusion width.

# ---- group: if fed a config use 1/2 extrusion width, otherwise pass data
data = Data(distance_or_xylinus_config)
item = ListItem(List=data, Index=0, Wrap=True)
item_2 = ListItem(List=data, Index="3", Wrap=True)
box = Box(item)
division = Division(A=item_2, B=2)
null = NullItem(Item=box)  # -> NullFlags, InvalidFlags, Description
filter = StreamFilter(Gate=null.NullFlags, Stream0=division, Stream1=data)
distance = Number(filter)

# ---- group: interior
crv = Curve(curve)

# ----
number_slider = Slider(2, range=0..4)

# ---- group: run a test offset and check to see if it is bigger
D = Number(distance)
offset = Offset(Curve=crv, Distance=D, Plane=PlaneXY(0, 0, 0), Corners=number_slider)
trim = TrimTree(Tree=offset, Depth=1)
area = Area(Geometry=trim)  # -> Area, Centroid
area_2 = Area(Geometry=crv)  # -> Area, Centroid
larger = LargerThan(FirstNumber=area.Area, SecondNumber=area_2.Area)  # -> LargerThan, OrEqualTo

# ---- group: use test offset to determine the direction of the final offset
D_2 = Number(distance)
long = LongestList(ListA=larger.LargerThan, ListB=D_2, PaddingMode=2)  # -> ListA, ListB
neg = Negative(Value=long.ListB)
p_n_c = PickNChoose(Pattern=larger.LargerThan, Stream0=neg, Stream1=long.ListB)
offset_2 = Offset(Curve=crv, Distance=p_n_c, Plane=PlaneXY(0, 0, 0), Corners=number_slider)
trim_2 = TrimTree(Tree=offset_2, Depth=1)

# ---- group: double check and just ditch what isn't right
area_3 = Area(Geometry=trim_2)  # -> Area, Centroid
area_4 = Area(Geometry=crv)  # -> Area, Centroid
larger_2 = LargerThan(FirstNumber=area_3.Area, SecondNumber=area_4.Area)  # -> LargerThan, OrEqualTo
dispatch = Dispatch(List=trim_2, DispatchPattern=larger_2.LargerThan)  # -> ListA, ListB
crv_2 = Curve(dispatch.ListB)

# ---- group: double check and just ditch what isn't right / good interior offsets
crv_3 = Curve(dispatch.ListA)

# ----
offset_cruves = ClusterOutput(crv_3)
