# Grasshopper definition split curves.gh (Grasshopper 1.0.7)

point = Point([<point referenced from the Rhino model> x6])
point_2 = Point([<point referenced from the Rhino model> x6])
domain = Domain([Domain(3, 6), Domain(7, 10)])
sub_list = SubList(List=[point, point_2], Domain=domain, Wrap=True)  # -> List, Index
polyline = PolyLine(Vertices=sub_list.List, Closed=False)
panel = Panel(sub_list.List)
