# Grasshopper definition statereader.gh (Grasshopper 1.0.7)

data_input_path = File()
data = ReadFile(DataInputPath=data_input_path, PerLineParse=True)
num = Number(0)
cull_i = CullIndex(List=data, Indices=num, Wrap=True)
split = TextSplit(Text=cull_i, Separators=",")

end_aa = ListItem(List=split, Index="2", Wrap=True)  # -> flatten(Item)
start_aa = ListItem(List=split, Index="1", Wrap=True)  # -> flatten(Item)
start_aa_2 = Number(start_aa)
end_aa_2 = Number(end_aa)

centre = ListItem(List=split, Index="10", Wrap=True)  # -> flatten(Item)
exposure = ListItem(List=split, Index="9", Wrap=True)  # -> flatten(Item)
uptake = ListItem(List=split, Index="12", Wrap=True)  # -> flatten(Item)
uptake_2 = Number(uptake)
centre_2 = Number(centre)
exposure_2 = Number(exposure)

state = ListItem(List=split, Index="8", Wrap=True)  # -> flatten(Item)
state_2 = Text(state)
start_aa_3 = Number(start_aa_2)
end_aa_3 = Number(end_aa_2)
state_3 = Text(state_2)
centre_3 = Number(centre_2)
uptake_3 = Number(uptake_2)
exposure_3 = Number(exposure_2)
