# Grasshopper definition testUI.gh (Grasshopper 1.0.7)
# plug-ins: Human UI

cluster = Cluster()
cluster_2 = Cluster(mesh_colors=ColourSwatch(SwatchColor=RGB(0, 0, 0)))
cluster_3 = Cluster(mesh_colors=ColourSwatch(SwatchColor=RGB(0, 255, 8)))
cluster_4 = Cluster(mesh_colors=ColourSwatch(SwatchColor=RGB(220, 120, 250)))
cluster_5 = Cluster(mesh_colors=ColourSwatch(SwatchColor=RGB(7, 76, 173)))
cluster_6 = Cluster(mesh_colors=ColourSwatch(SwatchColor=RGB(170, 46, 219)))
cluster_7 = Cluster(mesh_colors=ColourSwatch(SwatchColor=RGB(138, 138, 138)))
cluster_8 = Cluster(mesh_colors=ColourSwatch(SwatchColor=RGB(255, 255, 255)))
cluster_9 = Cluster(mesh_colors=ColourSwatch(SwatchColor=RGB(0, 212, 255)))
cluster_10 = Cluster(mesh_colors=ColourSwatch(SwatchColor=RGB(238, 255, 0)))
cluster_11 = Cluster(mesh_colors=ColourSwatch(SwatchColor=RGB(0, 70, 232)))
merge = Merge(
    Data1=flatten(cluster_6),
    Data2=flatten(cluster_9),
    Data3=flatten(cluster_11),
    Data4=flatten(cluster_10),
    Data5=flatten(cluster_8),
    Data6=flatten(cluster_7),
    Data7=flatten(cluster_2),
    Data8=flatten(cluster_5),
    Data9=flatten(cluster),
    Data10=flatten(cluster_3),
    Data11=flatten(cluster_4))

panel = Panel("""1
1
1
1
0
0
0
0
2
2
2
2
3
3
3
3""")
panel_2 = Panel("""0
1
2
0
1
2
0
1
2
0
1
2
0
1
2""")
create_grid = CreateGrid(
    UIElements=merge,
    RowDefinitions=[Slider(168, range=0..1000), Slider(154, range=0..1000), Slider(154, range=0..1000), Slider(173, range=0..1000)],
    ColumnDefinitions=[Slider(156, range=0..1000), Slider(149, range=0..1000), Slider(225, range=0..1000), Slider(173, range=0..1000)],
    ElementRow=panel,
    ElementColumn=panel_2,
    ElementRowSpan=1,
    ElementColumnSpan=1)
panel_3 = Panel("30,30,0,0,0,0")
adjust_element_positioning = AdjustElementPositioning(
    ElementsToAdjust=create_grid,
    AbsolutePositioning=False,
    Width=Slider(1831, range=0..10000),
    Height=Slider(612, range=0..1000))

create_stack = CreateStack(Horizontal=True)
create_expander = CreateExpander(Open=True)
activate_interface = BooleanToggle(True)
create_expander_2 = CreateExpander(UIElements=create_grid, Open=True)
launch_window = LaunchWindow(
    Show=activate_interface,
    Name="Control Window",
    Width=Slider(1000, range=0..1000),
    Height=Slider(724, range=0..1000),
    ChildStatus=0,
    EnableHorizScroll=False)
add_elements = AddElements(Window=launch_window, Elements=flatten(create_expander_2), DoVLChecking=True)  # -> AddedElements, ElementNames

# ==== cluster Cluster
colour_swatch = ColourSwatch(SwatchColor=RGB(72, 0, 255))
mesh_colors = ClusterInput()
mesh_sphere = MeshSphere(Base=PlaneXY(0, 0, 0), Radius=10, UCount=10, VCount=20)
create_3d_view = Create3DView(
    MeshToDisplay=mesh_sphere,
    MeshColors=RGB(255, 0, 0),
    ViewWidth=Slider(132, range=0..1000),
    ViewHeight=Slider(108, range=0..1000))
sphere = Sphere(Base="0,0,0", Radius=Slider(5, range=0..10))
_3dview = ClusterOutput(create_3d_view)
set_3d_view = Set3DView(_3DView=create_3d_view, MeshToDisplay=sphere, MeshColors=mesh_colors)
